# Grasshopper definition 1.1.1Alpha_Latiz Hypaar.gh (Grasshopper 1.0.7)
# plug-ins: ProvingGround.Conduit, Human UI, LunchBox

# ----
# ANALYSIS
# BREP MESH
number_slider = Slider(1.17, range=0..10)
settings_custom = SettingsCustom(
    StitchSeams=True,
    SimplePlanes=False,
    Refine=True,
    MinCount=16,
    MaxCount=400,
    AspectRatio=20,
    MaxDistance=0,
    MaxAngle=20,
    MinEdge=number_slider,
    MaxEdge=number_slider)
brep = Brep(<brep referenced from the Rhino model>)
mesh_brep = MeshBrep(Brep=brep, Settings=settings_custom)

# ----
# BUILDING TYPE MENU
edif_a = BooleanToggle(False)
edif_d = BooleanToggle(False)
edif_e = BooleanToggle(False)
edif_b = BooleanToggle(False)
edif_c = BooleanToggle(False)
entwine = Entwine(Branch00=edif_a, Branch01=edif_b, Branch02=edif_c, Branch03=edif_d, Branch04=edif_e, FlattenInputs=True)  # -> flatten(Result)
panel = Panel("""EDIFICIO A
EDIFICIO B
EDIFICIO C
EDIFICIO D
EDIFICIO E""")
create_toggle = CreateToggle(Default=entwine, Label=panel, OnLabel="ON", OffLabel="OFF")

# ----
# SECOND VALUES
panel_2 = Panel("REFRESH DESIGN")
run = BooleanToggle(False)
create_toggle_2 = CreateToggle(Default=run, Label=panel_2, OnLabel="RUN", OffLabel="OFF")
value_listener = ValueListener(Elements=create_toggle_2, SomeProperty=True)  # -> flatten(Values), Indices

# ----
# LOGO 02
panel_3 = Panel("C:\Users\Sergio\Pictures\LOGO.png")
file_path = FilePath(panel_3)
create_button = CreateButton(ImagePath=file_path, ButtonStyle=0)

# ----
# EDIT TYPE RUN UI
edit_data = BooleanToggle(True)

widht = Slider(313, range=0..1000)
height = Slider(795, range=0..1000)
launch_window = LaunchWindow(Show=edit_data, Name="EDIT TYPE", Width=widht, Height=height, ChildStatus=0, EnableHorizScroll=False)

# ----
# LOGO
panel_4 = Panel("C:\Users\Sergio\Pictures\LOGO.png")
file_path_2 = FilePath(panel_4)
create_button_2 = CreateButton(ImagePath=file_path_2, ButtonStyle=0)

# ----
# USER INTERFACE
boolean_toggle = BooleanToggle(True)
# RUN UI
widht_2 = Slider(313, range=0..1000)
height_2 = Slider(795, range=0..1000)
launch_window_2 = LaunchWindow(Show=boolean_toggle, Name="LATIZ HYPROOF", Width=widht_2, Height=height_2, ChildStatus=0, EnableHorizScroll=False)

# ----
# FIXED INPUTS
panel_5 = Panel("15")
create_text_box = CreateTextBox(Label="NÚMERO DE NIVELES", DefaultText=panel_5, UpdateButton=True, showLabel=True)
create_text_box_2 = CreateTextBox(Label="DENSIDAD VIVIENDAS", DefaultText="120", UpdateButton=True, showLabel=True)
create_text_box_3 = CreateTextBox(Label="CUS", DefaultText="109585", UpdateButton=True, showLabel=True)

# ----
# 3. Add the element to the window
add_elements = AddElements(
    Window=launch_window_2,
    Elements=flatten([create_button_2, create_text_box_3, create_text_box, create_text_box_2, create_toggle]),
    DoVLChecking=True)  # -> AddedElements, ElementNames

# ---- group: Orientacion Grid
pi = Pi(Factor=Slider(0.25, range=0..0.5))

# ---- group: Tamaño Gird
number_slider_2 = Slider(7, range=1..15)

# ---- group: Pendiente
angulo_maximo = Slider(22, range=0..90)

# ----
grid_orientation = Slider(9, range=0..100)

rotation = Slider(44.633, range=0..100)
sotanos = Slider(-16, range=-20..0)
altura_desplante = Slider(9, range=0..20)
edif_e_module_jump = Slider(10, range=0..100)
edif_e_pocision = Slider(34, range=0..450)
number_slider_3 = Slider(0.346, range=0..1)

edif_b_pocision = Slider(132, range=0..450)
rotation_2 = Slider(20.275, range=0..100)
altura_desplante_2 = Slider(9, range=0..20)
edif_b_module_jump = Slider(12, range=0..100)
sotanos_2 = Slider(-17, range=-20..0)

rotation_3 = Slider(31.29, range=0..100)
edif_d_module_jump = Slider(14, range=0..100)
sotanos_3 = Slider(-19, range=-20..0)
altura_desplante_3 = Slider(5, range=0..20)
edif_d_pocision = Slider(43, range=0..450)
number_slider_4 = Slider(0.458, range=0..1)

sotanos_4 = Slider(-13, range=-20..0)
altura_desplante_4 = Slider(2, range=0..20)
edif_c_pocision = Slider(97, range=0..450)
edif_c_module_jump = Slider(12, range=0..100)
rotation_4 = Slider(31.361, range=0..100)
colour_swatch = ColourSwatch(SwatchColor=RGBA(206, 74, 0, 148))

# ---- group: Bubble Chart
number_slider_5 = Slider(9, range=0..100)
random = Random(Range="0 to 20", Number=number_slider_5, Seed=Slider(399, range=0..1000))
random_2 = Random(Range="-1.5 to 1.5", Number=number_slider_5, Seed=Slider(230, range=0..1000))
random_3 = Random(Range="-1.5 to 1.5", Number=number_slider_5, Seed=Slider(364, range=0..1000))
format = CSharpScript(x=random)  # -> out, A; inputs x: Double
# ---------- format: C# ----------
    A = x.ToString("#.0");
# ---------- end format ----------
curve = Curve(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)
draw_a_bubble_chart = DrawChart(
    Boundary=curve,
    BubbleSize=random,
    BubbleScale=Slider(0.14, range=0.05..0.4),
    XValues=random_3,
    YValues=random_2,
    AxisPadding=0.1,
    Labels=format.A,
    LabelSize=Slider(0.29, range=0.1..0.35))

# ---- group: text objects
# Text objects automatically use the font from the current style sheet called "Default Font". You can override this font to make it as you like it.
# 
# You also can specify a new font style for any object that takes a font style for input
_0_top_to_bottom_1_bottom_to_top = Slider(0, range=0..1)
_0_top_to_bottom_1_bottom_to_top_2 = Slider(0, range=0..1)
panel_6 = Panel("""Default fonts use adaptive
sizing, and will change
text heights to
fill the boundary space.""")
conduit_font = ConduitFont(Font="ISOCP", TextHeight=12, AdaptiveHeight=True, TextSpacing=1.15, Alignment=0, Bold=False, Italic=False, Color="white")
curve_2 = Curve(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)
curve_3 = Curve(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)
draw_text = DrawTextTest(
    Boundary=curve_2,
    Text=panel_6,
    TextOrdering=_0_top_to_bottom_1_bottom_to_top,
    TextDistribution=0,
    OrientVertically=False)
draw_text_2 = DrawTextTest(
    Boundary=curve_3,
    Text="A custom font in addition to the style sheet",
    TextOrdering=_0_top_to_bottom_1_bottom_to_top_2,
    TextDistribution=0,
    OrientVertically=False,
    CustomFont=conduit_font)

# ----
unit_x = UnitX(Factor=Slider(-11.891, range=-100..10))

# ----
# BUILDING PRIORITY
prioridad_edificio_a = Slider(30, range=0..100)
prioridad_edificio_e = Slider(40, range=0..100)
prioridad_edificio_c = Slider(0, range=0..100)
prioridad_edificio_d = Slider(30, range=0..100)
prioridad_edificio_b = Slider(0, range=0..100)
create_slider = CreateSlider(Slider=prioridad_edificio_e, ShowBounds=False, ShowTicks=False, ShowTooltip=False, ShowValLabel=True, showLabel=True)
create_slider_2 = CreateSlider(Slider=prioridad_edificio_a, ShowBounds=False, ShowTicks=False, ShowTooltip=False, ShowValLabel=True, showLabel=True)
create_slider_3 = CreateSlider(Slider=prioridad_edificio_c, ShowBounds=False, ShowTicks=False, ShowTooltip=False, ShowValLabel=True, showLabel=True)
create_slider_4 = CreateSlider(Slider=prioridad_edificio_d, ShowBounds=False, ShowTicks=False, ShowTooltip=False, ShowValLabel=True, showLabel=True)
create_slider_5 = CreateSlider(Slider=prioridad_edificio_b, ShowBounds=False, ShowTicks=False, ShowTooltip=False, ShowValLabel=True, showLabel=True)

entwine_2 = Entwine(
    Branch00=create_slider_2,
    Branch01=create_slider_5,
    Branch02=create_slider_3,
    Branch03=create_slider_4,
    Branch04=create_slider,
    FlattenInputs=True)  # -> flatten(Result)
add_elements_2 = AddElements(Window=launch_window, Elements=flatten([create_button, entwine_2, create_toggle_2]), DoVLChecking=True)  # -> AddedElements, ElementNames
value_listener_2 = ValueListener(Elements=entwine_2, SomeProperty=True)  # -> flatten(Values), Indices

# ----
# TOPOGRAPHY MESH ANALYSIS
mcomp = Decompose(Mesh=mesh_brep)  # -> Vertices, Faces, Colours, Normals
vcomp = Decompose(Vector=mcomp.Normals)  # -> XComponent, YComponent, ZComponent
expression = Expression(z=vcomp.ZComponent, Expression="Deg(0.0 - (Asin(Abs(z)) - 0.5*π))")
gradient = Gradient(
    LowerLimit=0,
    UpperLimit=90,
    Parameter=expression,
    stops=[0.145: RGB(0, 128, 0), 0.336: RGB(166, 255, 0), 0.563: RGB(240, 172, 36), 0.762: RGB(255, 0, 0)])
mesh = Mesh(Vertices=mcomp.Vertices, Faces=mcomp.Faces, Colours=gradient)
xy = XYPlane(Origin=Point(0, 0, 0))
prot = RotatePlane(Plane=xy, Angle=pi)
bbox = BoundingBox(Content=mesh, Plane=prot)  # -> Box, Box_2
debrep = DeconstructBrep(Brep=bbox.Box)  # -> Faces, Edges, Vertices
item = ListItem(List=debrep.Faces, Index="4", Wrap=True)
dim = Dimensions(Surface=item)  # -> UDimension, VDimension
division = Division(A=dim.VDimension, B=number_slider_2)
division_2 = Division(A=dim.UDimension, B=number_slider_2)
int = Integer(division_2)
int_2 = Integer(division)
quads = QuadPanels(Surface=item, UDivisions=int, VDivisions=int_2)
# ANALYSIS OUTPUTS
area = Area(Geometry=quads)  # -> Area, Centroid

Z = UnitZ(Factor=1)
project = ProjectPoint(Point=area.Centroid, Direction=Z, Geometry=mesh)  # -> Point, Index

null = NullItem(Item=project.Point)  # -> NullFlags, InvalidFlags, Description
dispatch = Dispatch(List=project.Point, DispatchPattern=null.NullFlags)  # -> ListA, ListB
meshcp = MeshClosestPoint(Point=dispatch.ListB, Mesh=mesh)  # -> Point, Index, Parameter
meval = MeshEval(Mesh=mesh, Parameter=meshcp.Parameter)  # -> Point, Normal, Colour
vcomp_2 = Decompose(Vector=meval.Normal)  # -> XComponent, YComponent, ZComponent
expression_2 = Expression(z=vcomp_2.ZComponent, Expression="Deg(0.0 - (Asin(Abs(z)) - 0.5*π))")
smaller = SmallerThan(FirstNumber=expression_2, SecondNumber=angulo_maximo)  # -> SmallerThan, OrEqualTo
dispatch_2 = Dispatch(List=meval.Point, DispatchPattern=smaller.SmallerThan)  # -> ListA, ListB
# BUILT-IN INPUTS
pgroups = PointGroups(Points=dispatch_2.ListA, Distance=Slider(11, range=1..55))  # -> Groups, Indices

# ----
# POINT MATRIX
flatten_tree = FlattenTree(Tree=pgroups.Groups, Path="{0}")
xy_plane = XYPlane(Origin=flatten_tree)
rotate_plane = RotatePlane(Plane=xy_plane, Angle=grid_orientation)

# ----
# EDIT PROPERTIES
value_listener_3 = ValueListener(Elements=[create_text_box_3, create_text_box, create_text_box_2, create_toggle], SomeProperty=True)  # -> Values, Indices
flatten_tree_2 = FlattenTree(Tree=value_listener_3.Values, Path="{0}")
merge = Merge(Data1=flatten_tree_2, Data2=value_listener_2.Values)
flatten_tree_3 = FlattenTree(Tree=merge, Path="{0}")

# ----
# TESTING PRIORITY VS BUILDING CHECKLIST
list_item = ListItem(List=flatten_tree_2, Index=3, Wrap=True)  # -> Item, Item1, Item2, Item3, Item4
merge_2 = Merge(Data1=list_item.Item, Data2=list_item.Item1, Data3=list_item.Item2, Data4=list_item.Item3, Data5=list_item.Item4)
ghpython_script = GhPythonScript(BOOL=merge_2)  # -> out, a; inputs BOOL: list
# ---------- ghpython_script: Python ----------
"""Provides a scripting component.
    Inputs:
        x:
        y:
    Output:
        a: The a output variable"""

__author__ = "Sergio"
__version__ = "2019.03.28"

import rhinoscriptsyntax as rs
import math as math

lst= BOOL
ct=100/lst.count(True)
v = 0

if lst.count(True) == 3:
        for num in lst:
            if num == False:
                print(0)
            else:
                v=v+1
                if v==1 or v==2:
                    print(40)
                else: 
                    print(20)
else:
    for num in lst:
            if num == False:
                print(0)
            else:
                print(ct)
# ---------- end ghpython_script ----------
list_item_2 = ListItem(List=ghpython_script.out, Index=0, Wrap=True)  # -> Item, Item1, Item2, Item3, Item4

panel_7 = Panel(list_item_2.Item4)
panel_8 = Panel(list_item_2.Item)
panel_9 = Panel(list_item_2.Item1)
panel_10 = Panel(list_item_2.Item2)
panel_11 = Panel(list_item_2.Item3)

entwine_3 = Entwine(Branch00=panel_8, Branch01=panel_9, Branch02=panel_10, Branch03=panel_11, Branch04=panel_7, FlattenInputs=True)  # -> flatten(Result)
merge_3 = Merge(Data1=flatten_tree_2, Data2=entwine_3)
flatten_tree_4 = FlattenTree(Tree=merge_3, Path="{0}")
ghpython_script_2 = GhPythonScript(TEST=value_listener.Values, lst=flatten_tree_3, x=flatten_tree_4)  # -> out, a; inputs TEST: list, lst: list, x: list
# ---------- ghpython_script_2: Python ----------
"""Provides a scripting component.
    Inputs:
        x:
        y:
    Output:
        a: The a output variable"""

__author__ = "Sergio"
__version__ = "2019.03.28"

import rhinoscriptsyntax as rs

for num in TEST:
    if num == True:
        a=lst
    else:
        a=x
# ---------- end ghpython_script_2 ----------

# ----
# MASK
# RESTRICTIONS
panel_12 = Panel("True")
equality = Equality(FirstNumber=ghpython_script_2.a, SecondNumber=panel_12)  # -> Equality, Inequality
list_length = ListLength(List=equality.Equality)
series = Series(Start=0, Step=1, Count=list_length)
ghpython_script_3 = GhPythonScript(x=series, y=equality.Equality)  # -> flatten(out), a
# ---------- ghpython_script_3: Python ----------
"""Provides a scripting component.
    Inputs:
        x:
        y:
    Output:
        a: The a output variable"""

__author__ = "Sergio"
__version__ = "2019.03.28"

import rhinoscriptsyntax as rs

a= [y]
b = [x]
BA = []
listac = zip(a,b)
for it,nn in listac:
	if it == True:
		print(nn)
# ---------- end ghpython_script_3 ----------
integer = Integer(ghpython_script_3.out)

# ----
# PERCENTAGE OF POPULLATION
panel_13 = Panel("8")
construct_domain = ConstructDomain(DomainStart=panel_13, DomainEnd="12")
subtraction = Subtraction(A="12", B=panel_13)
range = Range(Domain=construct_domain, Steps=subtraction)
list_item_3 = ListItem(List=ghpython_script_2.a, Index=range, Wrap=True)

integer_2 = Integer(0)
integer_3 = Integer(2)
integer_4 = Integer(1)
list_item_4 = ListItem(List=ghpython_script_2.a, Index=integer_2, Wrap=True)
list_item_5 = ListItem(List=ghpython_script_2.a, Index=integer_4, Wrap=True)
list_item_6 = ListItem(List=ghpython_script_2.a, Index=integer_3, Wrap=True)

number = Number(list_item_4)
integer_5 = Integer(list_item_5)
integer_6 = Integer(list_item_6)
integer_7 = Integer(list_item_3)
# ITERATOR
ghpython_script_4 = GhPythonScript(mask=integer, cus=number, niveles_max=integer_5, edif_prior=integer_7, num_vivmax=integer_6)  # -> out, out_A, out_B, out_C, out_D, out_E; inputs mask: list, edif_prior: list
# ---------- ghpython_script_4: Python ----------
"""Provides a scripting component.
    Inputs:
        x:
        y:
    Output:
        a: The a output variable"""

__author__ = "Sergio"
__version__ = "2019.03.28"

import rhinoscriptsyntax as rs
import array as ar

import Rhino as rh
import Grasshopper as gh
import GhPython as gp
import math 
import rhinoscriptsyntax as rs
import sys
sys.path.append( "Z:\Shared\PRODUCCION\TALLER PROGRAMACION\RZM LATIZ PROTOTYPE\LIBRERIAS_PY\CLASSES")
from EDIF_CLASS import *

# Las entradas de este nodo se almacenan como lista en las variables IN.

#Var : Inputs
edif_niveles=0
num_max_vivedif=0
edif_areamax=0

#Objects
edif_A=Edificio("A",0,400,4,20,20,100,edif_prior[0],0,0)
edif_B=Edificio("B",0,576,4,12,48,144,edif_prior[1],0,0)
edif_C=Edificio("C",0,864,6,12,72,144,edif_prior[2],0,0)
edif_D=Edificio("D",0,1200,8,24,48,147,edif_prior[3],0,0)
edif_E=Edificio("E",0,1600,12,24,72,133,edif_prior[4],0,0)

output = []

for i in mask:
    if i == 3:
        # MATHEMATHIC METHOD
        num_max_vivedif = round(edif_A.prior * num_vivmax / 100)
        viv_init = edif_A.dptos
        niv_tedif = round(num_max_vivedif / viv_init)

        if niv_tedif > niveles_max:
            edif_A.count = niv_tedif / niveles_max
        else:
            edif_A.count = 1

        edif_A.count = math.ceil(edif_A.count)
        edif_A.niveles = round(niv_tedif / edif_A.count)
        edif_A.dptos = edif_A.niveles * viv_init
        edif_A.areacons = edif_A.huella * edif_A.niveles

        output_A = [edif_A.type, edif_A.count, edif_A.dptos, edif_A.niveles, edif_A.areacons]
        out_A = output_A

    elif i == 4:
        num_max_vivedif = round(edif_B.prior * num_vivmax / 100)
        viv_init = edif_B.dptos
        niv_tedif = round(num_max_vivedif / viv_init)

        if niv_tedif > niveles_max:
            edif_B.count = niv_tedif / niveles_max
        else:
            edif_B.count = 1

        edif_B.count = math.ceil(edif_B.count)
        edif_B.niveles = round(niv_tedif / edif_B.count)
        edif_B.dptos = edif_B.niveles * viv_init
        edif_B.areacons = edif_B.huella * edif_B.niveles

        output_B = [edif_B.type, edif_B.count, edif_B.dptos, edif_B.niveles, edif_B.areacons]
        out_B = output_B

    elif i == 5:
        num_max_vivedif = round(edif_C.prior * num_vivmax / 100)
        viv_init = edif_C.dptos
        niv_tedif = round(num_max_vivedif / viv_init)

        if niv_tedif > niveles_max:
            edif_C.count = niv_tedif / niveles_max
        else:
            edif_C.count = 1

        edif_C.count = math.ceil(edif_C.count)
        edif_C.niveles = round(niv_tedif / edif_C.count)
        edif_C.dptos = edif_C.niveles * viv_init
        edif_C.areacons = edif_C.huella * edif_C.niveles

        output_C = [edif_C.type, edif_C.count, edif_C.dptos, edif_C.niveles, edif_C.areacons]
        out_C = output_C

    elif i == 6:
        num_max_vivedif = round(edif_D.prior * num_vivmax / 100)
        viv_init = edif_D.dptos
        niv_tedif = round(num_max_vivedif / viv_init)

        if niv_tedif > niveles_max:
            edif_D.count = niv_tedif / niveles_max
        else:
            edif_D.count = 1

        edif_D.count = math.ceil(edif_D.count)
        edif_D.niveles = round(niv_tedif / edif_D.count)
        edif_D.dptos = edif_D.niveles * viv_init
        edif_D.areacons = edif_D.huella * edif_D.niveles

        output_D = [edif_D.type, edif_D.count, edif_D.dptos, edif_D.niveles, edif_D.areacons]
        out_D = output_D

    elif i == 7:
        num_max_vivedif = round(edif_E.prior * num_vivmax / 100)
        viv_init = edif_E.dptos
        niv_tedif = round(num_max_vivedif / viv_init)

        if niv_tedif > niveles_max:
            edif_E.count = niv_tedif / niveles_max
        else:
            edif_E.count = 1

        edif_E.count = math.ceil(edif_E.count)
        edif_E.niveles = round(niv_tedif / edif_E.count)
        edif_E.dptos = edif_E.niveles * viv_init
        edif_E.areacons = edif_E.huella * edif_E.niveles

        output_E = [edif_E.type, edif_E.count, edif_E.dptos, edif_E.niveles, edif_E.areacons]
        out_E = output_E
# ---------- end ghpython_script_4 ----------

# ----
# EDIF_E
list_item_7 = ListItem(List=ghpython_script_4.out_E, Index=3, Wrap=True)
list_item_8 = ListItem(List=ghpython_script_4.out_E, Index=1, Wrap=True)
colour_swatch_2 = ColourSwatch(SwatchColor=RGBA(55, 255, 0, 148))
addition = Addition(A=list_item_7, B=1)
series_2 = Series(Start=0, Step=3, Count=addition)
integer_8 = Integer(list_item_8)
create_material = CreateMaterial(Diffuse=colour_swatch_2, Specular=colour_swatch_2, Emission=RGB(0, 0, 0), Transparency=0, Shine=Slider(8, range=0..100))

# ----
# EDIF_A
list_item_9 = ListItem(List=ghpython_script_4.out_A, Index=1, Wrap=True)
list_item_10 = ListItem(List=ghpython_script_4.out_A, Index=3, Wrap=True)
colour_swatch_3 = ColourSwatch(SwatchColor=RGBA(255, 0, 152, 148))
addition_2 = Addition(A=list_item_10, B=1)
integer_9 = Integer(list_item_9)
create_material_2 = CreateMaterial(Diffuse=colour_swatch_3, Specular=colour_swatch_3, Emission=RGB(0, 0, 0), Transparency=0, Shine=Slider(8, range=0..100))
series_3 = Series(Start=0, Step=3, Count=addition_2)

# ----
# EDIF_B
list_item_11 = ListItem(List=ghpython_script_4.out_B, Index=1, Wrap=True)
list_item_12 = ListItem(List=ghpython_script_4.out_B, Index=3, Wrap=True)
colour_swatch_4 = ColourSwatch(SwatchColor=RGBA(48, 45, 47, 148))
colour_swatch_5 = ColourSwatch(SwatchColor=RGBA(255, 255, 0, 148))
addition_3 = Addition(A=list_item_12, B=1)
create_material_3 = CreateMaterial(Diffuse=colour_swatch_5, Specular=colour_swatch_5, Emission=RGB(0, 0, 0), Transparency=0, Shine=Slider(8, range=0..100))
series_4 = Series(Start=0, Step=3, Count=addition_3)
integer_10 = Integer(list_item_11)

# ----
# EDIF_D
number_slider_6 = Slider(34, range=0..100)
list_item_13 = ListItem(List=ghpython_script_4.out_D, Index=1, Wrap=True)
list_item_14 = ListItem(List=ghpython_script_4.out_D, Index=3, Wrap=True)
colour_swatch_6 = ColourSwatch(SwatchColor=RGBA(206, 74, 255, 148))
addition_4 = Addition(A=list_item_14, B=1)
create_material_4 = CreateMaterial(Diffuse=colour_swatch_6, Specular=colour_swatch_6, Emission=RGB(0, 0, 0), Transparency=0, Shine=number_slider_6)
series_5 = Series(Start=0, Step=3, Count=addition_4)
integer_11 = Integer(list_item_13)

# ----
# EDIF_C
number_slider_7 = Slider(8, range=0..100)
list_item_15 = ListItem(List=ghpython_script_4.out_C, Index=1, Wrap=True)
list_item_16 = ListItem(List=ghpython_script_4.out_C, Index=3, Wrap=True)
addition_5 = Addition(A=list_item_16, B=1)
create_material_5 = CreateMaterial(Diffuse=colour_swatch, Specular=colour_swatch, Emission=RGB(0, 0, 0), Transparency=0, Shine=number_slider_7)
series_6 = Series(Start=0, Step=3, Count=addition_5)
integer_12 = Integer(list_item_15)

altura_desplante_5 = Slider(4.601, range=-10..20)
edif_a_pocision = Slider(54, range=0..100)
edif_a_module_jump = Slider(36, range=0..100)
rotation_5 = Slider(22.698, range=0..100)
sotanos_5 = Slider(-7, range=-20..0)

# ----
# GEOMETRY MANIPULATION
number_slider_8 = Slider(0.1, range=0..0.1)
panel_14 = Panel("6")
division_3 = Division(A="12", B=2)
division_4 = Division(A="72", B=2)
series_7 = Series(Start=edif_c_pocision, Step=edif_c_module_jump, Count=integer_12)  # -> graft(Series)
list_item_17 = ListItem(List=rotate_plane, Index=series_7, Wrap=True)
center_box = CenterBox(Base=list_item_17, X=division_3, Y=division_4, Z=number_slider_8)
brep_2 = Brep(center_box)
deconstruct_brep = DeconstructBrep(Brep=brep_2)  # -> Faces, Edges, Vertices
list_item_18 = ListItem(List=deconstruct_brep.Faces, Index=Slider(4, range=0..100), Wrap=True)
brep_wireframe = BrepWireframe(Brep=list_item_18, Density=-1)
join_curves = JoinCurves(Curves=brep_wireframe, Preserve=False)
rotate = Rotate(Geometry=join_curves, Angle=rotation_4, Plane=list_item_17)  # -> Geometry, Transform
unit_z = UnitZ(Factor=sotanos_4)
move = Move(Geometry=rotate.Geometry, Motion=unit_z)  # -> Geometry, Transform
fragment_patch = FragmentPatch(Boundary=move.Geometry)
area_2 = Area(Geometry=fragment_patch)  # -> Area, Centroid

# ----
# FLOORS
unit_z_2 = UnitZ(Factor=altura_desplante_4)
unit_z_3 = UnitZ(Factor=series_6)
move_2 = Move(Geometry=rotate.Geometry, Motion=unit_z_2)  # -> Geometry, Transform
move_3 = Move(Geometry=move_2.Geometry, Motion=unit_z_3)  # -> Geometry, Transform
fragment_patch_2 = FragmentPatch(Boundary=move_3.Geometry)
loft = Loft(Curves=move_3.Geometry, Options={Adjust=False, Closed=False, LoftEnds=0, LoftSimp=0, LoftType=0, Rebuild=10, Refit=0.01})
custom_preview = CustomPreview(Geometry=fragment_patch_2, Material=colour_swatch_4)
custom_preview_2 = CustomPreview(Geometry=loft, Material=create_material_5)

# ----
# GEOMETRY MANIPULATION
series_8 = Series(Start=edif_a_pocision, Step=edif_a_module_jump, Count=integer_9)  # -> graft(Series)
list_item_19 = ListItem(List=rotate_plane, Index=series_8, Wrap=True)
panel_15 = Panel("4")
division_5 = Division(A="20", B=2)
division_6 = Division(A="20", B=2)
unit_z_4 = UnitZ(Factor=altura_desplante_5)
unit_z_5 = UnitZ(Factor=sotanos_5)
unit_z_6 = UnitZ(Factor=Slider(0.02119, range=-1..1.01))

xy_plane_2 = XYPlane(Origin=list_item_19)

center_box_2 = CenterBox(Base=xy_plane_2, X=division_5, Y=division_6, Z=Slider(0.1, range=0..0.1))
brep_3 = Brep(center_box_2)
deconstruct_brep_2 = DeconstructBrep(Brep=brep_3)  # -> Faces, Edges, Vertices
list_item_20 = ListItem(List=deconstruct_brep_2.Faces, Index=Slider(4, range=0..100), Wrap=True)
brep_wireframe_2 = BrepWireframe(Brep=list_item_20, Density=-1)
join_curves_2 = JoinCurves(Curves=brep_wireframe_2, Preserve=False)
rotate_2 = Rotate(Geometry=join_curves_2, Angle=rotation_5, Plane=list_item_19)  # -> Geometry, Transform
move_4 = Move(Geometry=rotate_2.Geometry, Motion=unit_z_4)  # -> Geometry, Transform
move_5 = Move(Geometry=rotate_2.Geometry, Motion=unit_z_5)  # -> Geometry, Transform
fragment_patch_3 = FragmentPatch(Boundary=move_4.Geometry)
fragment_patch_4 = FragmentPatch(Boundary=move_5.Geometry)
area_3 = Area(Geometry=fragment_patch_3)  # -> Area, Centroid
area_4 = Area(Geometry=fragment_patch_4)  # -> Area, Centroid
line = Line(StartPoint=area_3.Centroid, EndPoint=area_4.Centroid)
length = Length(Curve=line)
unit_z_7 = UnitZ(Factor=length)
extrude = Extrude(Base=fragment_patch_4, Direction=unit_z_7)
brep_brep = BrepBrep(BrepA=brep, BrepB=extrude)  # -> Curves, Points
fragment_patch_5 = FragmentPatch(Boundary=brep_brep.Curves)
extrude_2 = Extrude(Base=fragment_patch_5, Direction=unit_z_6)
trim_solid = TrimSolid(Shape=extrude, Cutters=extrude_2)
list_item_21 = ListItem(List=trim_solid, Index=0, Wrap=True)  # -> Item, Item1

# ----
# FLOORS
unit_z_8 = UnitZ(Factor=series_3)
move_6 = Move(Geometry=fragment_patch_3, Motion=unit_z_8)  # -> Geometry, Transform
move_7 = Move(Geometry=move_4.Geometry, Motion=unit_z_8)  # -> Geometry, Transform
loft_2 = Loft(Curves=move_7.Geometry, Options={Adjust=False, Closed=False, LoftEnds=0, LoftSimp=0, LoftType=0, Rebuild=10, Refit=0.01})
custom_preview_3 = CustomPreview(Geometry=loft_2, Material=create_material_2)
custom_preview_4 = CustomPreview(Geometry=move_6.Geometry, Material=colour_swatch_4)

fragment_patch_6 = FragmentPatch(Boundary=move_2.Geometry)
area_5 = Area(Geometry=fragment_patch_6)  # -> Area, Centroid
line_2 = Line(StartPoint=area_5.Centroid, EndPoint=area_2.Centroid)
length_2 = Length(Curve=line_2)
unit_z_9 = UnitZ(Factor=length_2)
extrude_3 = Extrude(Base=fragment_patch, Direction=unit_z_9)
brep_brep_2 = BrepBrep(BrepA=brep, BrepB=extrude_3)  # -> Curves, Points
fragment_patch_7 = FragmentPatch(Boundary=brep_brep_2.Curves)
extrude_4 = Extrude(Base=fragment_patch_7, Direction=unit_z_6)
trim_solid_2 = TrimSolid(Shape=extrude_3, Cutters=extrude_4)
list_item_22 = ListItem(List=trim_solid_2, Index=0, Wrap=True)  # -> Item, Item1

# ----
# COLOR SCHEME
colour_swatch_7 = ColourSwatch(SwatchColor=RGB(0, 255, 255))
colour_swatch_8 = ColourSwatch(SwatchColor=RGB(255, 0, 0))
number_slider_9 = Slider(0.223, range=0..1)
create_material_6 = CreateMaterial(Diffuse=colour_swatch_7, Specular=colour_swatch_7, Emission=colour_swatch_7, Transparency=number_slider_9, Shine=20)
create_material_7 = CreateMaterial(Diffuse=colour_swatch_8, Specular=colour_swatch_8, Emission=colour_swatch_8, Transparency=number_slider_9, Shine=20)
custom_preview_5 = CustomPreview(Geometry=list_item_21.Item1, Material=create_material_6)
custom_preview_6 = CustomPreview(Geometry=list_item_21.Item, Material=create_material_7)

# ----
# COLOR SCHEME
number_slider_10 = Slider(0.316, range=0..1)
colour_swatch_9 = ColourSwatch(SwatchColor=RGB(0, 255, 255))
colour_swatch_10 = ColourSwatch(SwatchColor=RGB(255, 0, 0))
create_material_8 = CreateMaterial(Diffuse=colour_swatch_9, Specular=colour_swatch_9, Emission=colour_swatch_9, Transparency=number_slider_10, Shine=20)
create_material_9 = CreateMaterial(Diffuse=colour_swatch_10, Specular=colour_swatch_10, Emission=colour_swatch_10, Transparency=number_slider_10, Shine=20)
custom_preview_7 = CustomPreview(Geometry=list_item_22.Item1, Material=create_material_8)
custom_preview_8 = CustomPreview(Geometry=list_item_22.Item, Material=create_material_9)

# ----
# EDIF_A FILL (M3)
cluster = Cluster(breps=[list_item_21.Item1, extrude_2])

# ----
# EDIF_C  FILL (M3)
cluster_2 = Cluster(breps=[list_item_22.Item1, extrude_4])

# ----
# EDIF_C  CUT  (M3)
cluster_3 = Cluster_2(breps=[list_item_22.Item, fragment_patch_7])

# ----
# EDIF_A  CUT  (M3)
cluster_4 = Cluster_2(breps=[list_item_21.Item, fragment_patch_5])

# ----
# GEOMETRY MANIPULATION
number_slider_11 = Slider(4, range=0..100)
panel_16 = Panel("8")
series_9 = Series(Start=edif_d_pocision, Step=edif_d_module_jump, Count=integer_11)  # -> graft(Series)
division_7 = Division(A="24", B=2)
division_8 = Division(A="48", B=2)
list_item_23 = ListItem(List=rotate_plane, Index=series_9, Wrap=True)
center_box_3 = CenterBox(Base=list_item_23, X=division_7, Y=division_8, Z=Slider(0.1, range=0..0.1))
brep_4 = Brep(center_box_3)
deconstruct_brep_3 = DeconstructBrep(Brep=brep_4)  # -> Faces, Edges, Vertices
list_item_24 = ListItem(List=deconstruct_brep_3.Faces, Index=number_slider_11, Wrap=True)
brep_wireframe_3 = BrepWireframe(Brep=list_item_24, Density=-1)
join_curves_3 = JoinCurves(Curves=brep_wireframe_3, Preserve=False)
unit_z_10 = UnitZ(Factor=sotanos_3)
rotate_3 = Rotate(Geometry=join_curves_3, Angle=rotation_3, Plane=list_item_23)  # -> Geometry, Transform
move_8 = Move(Geometry=rotate_3.Geometry, Motion=unit_z_10)  # -> Geometry, Transform
fragment_patch_8 = FragmentPatch(Boundary=move_8.Geometry)
area_6 = Area(Geometry=fragment_patch_8)  # -> Area, Centroid

# ----
# FLOORS
unit_z_11 = UnitZ(Factor=altura_desplante_3)
move_9 = Move(Geometry=rotate_3.Geometry, Motion=unit_z_11)  # -> Geometry, Transform
unit_z_12 = UnitZ(Factor=series_5)
move_10 = Move(Geometry=move_9.Geometry, Motion=unit_z_12)  # -> Geometry, Transform
fragment_patch_9 = FragmentPatch(Boundary=move_10.Geometry)
loft_3 = Loft(
    Curves=move_10.Geometry,
    Options={Adjust=False, Closed=False, LoftEnds=0, LoftSimp=0, LoftType=0, Rebuild=10, Refit=0.01})
custom_preview_9 = CustomPreview(Geometry=fragment_patch_9, Material=colour_swatch_4)
custom_preview_10 = CustomPreview(Geometry=loft_3, Material=create_material_4)

fragment_patch_10 = FragmentPatch(Boundary=move_9.Geometry)
area_7 = Area(Geometry=fragment_patch_10)  # -> Area, Centroid
line_3 = Line(StartPoint=area_7.Centroid, EndPoint=area_6.Centroid)
length_3 = Length(Curve=line_3)
unit_z_13 = UnitZ(Factor=length_3)
extrude_5 = Extrude(Base=fragment_patch_8, Direction=unit_z_13)
brep_brep_3 = BrepBrep(BrepA=brep, BrepB=extrude_5)  # -> Curves, Points
fragment_patch_11 = FragmentPatch(Boundary=brep_brep_3.Curves)
extrude_6 = Extrude(Base=fragment_patch_11, Direction=unit_z_6)
trim_solid_3 = TrimSolid(Shape=extrude_5, Cutters=extrude_6)
list_item_25 = ListItem(List=trim_solid_3, Index=0, Wrap=True)  # -> Item, Item1

# ----
# COLOR SCHEME
colour_swatch_11 = ColourSwatch(SwatchColor=RGB(0, 255, 255))
colour_swatch_12 = ColourSwatch(SwatchColor=RGB(255, 0, 0))
create_material_10 = CreateMaterial(Diffuse=colour_swatch_11, Specular=colour_swatch_11, Emission=colour_swatch_11, Transparency=number_slider_4, Shine=20)
create_material_11 = CreateMaterial(Diffuse=colour_swatch_12, Specular=colour_swatch_12, Emission=colour_swatch_12, Transparency=number_slider_4, Shine=20)
custom_preview_11 = CustomPreview(Geometry=list_item_25.Item1, Material=create_material_10)
custom_preview_12 = CustomPreview(Geometry=list_item_25.Item, Material=create_material_11)

# ----
# EDIF_D  FILL (M3)
cluster_5 = Cluster(breps=[list_item_25.Item1, extrude_6])

# ----
# EDIF_D  CUT  (M3)
cluster_6 = Cluster_2(breps=[list_item_25.Item, fragment_patch_11])

# ----
# GEOMETRY MANIPULATION
series_10 = Series(Start=edif_b_pocision, Step=edif_b_module_jump, Count=integer_10)  # -> graft(Series)
list_item_26 = ListItem(List=rotate_plane, Index=series_10, Wrap=True)
division_9 = Division(A="12", B=2)
division_10 = Division(A="48", B=2)
center_box_4 = CenterBox(Base=list_item_26, X=division_9, Y=division_10, Z=Slider(0.1, range=0..0.1))
unit_z_14 = UnitZ(Factor=altura_desplante_2)
brep_5 = Brep(center_box_4)
deconstruct_brep_4 = DeconstructBrep(Brep=brep_5)  # -> Faces, Edges, Vertices
list_item_27 = ListItem(List=deconstruct_brep_4.Faces, Index=Slider(4, range=0..100), Wrap=True)
unit_z_15 = UnitZ(Factor=sotanos_2)
brep_wireframe_4 = BrepWireframe(Brep=list_item_27, Density=-1)
join_curves_4 = JoinCurves(Curves=brep_wireframe_4, Preserve=False)
rotate_4 = Rotate(Geometry=join_curves_4, Angle=rotation_2, Plane=list_item_26)  # -> Geometry, Transform
move_11 = Move(Geometry=rotate_4.Geometry, Motion=unit_z_15)  # -> Geometry, Transform
fragment_patch_12 = FragmentPatch(Boundary=move_11.Geometry)
area_8 = Area(Geometry=fragment_patch_12)  # -> Area, Centroid

# ----
# FLOORS
move_12 = Move(Geometry=rotate_4.Geometry, Motion=unit_z_14)  # -> Geometry, Transform
unit_z_16 = UnitZ(Factor=series_4)
move_13 = Move(Geometry=move_12.Geometry, Motion=unit_z_16)  # -> Geometry, Transform
fragment_patch_13 = FragmentPatch(Boundary=move_13.Geometry)
loft_4 = Loft(
    Curves=move_13.Geometry,
    Options={Adjust=False, Closed=False, LoftEnds=0, LoftSimp=0, LoftType=0, Rebuild=10, Refit=0.01})
custom_preview_13 = CustomPreview(Geometry=loft_4, Material=create_material_3)
custom_preview_14 = CustomPreview(Geometry=fragment_patch_13, Material=colour_swatch_4)

fragment_patch_14 = FragmentPatch(Boundary=move_12.Geometry)
area_9 = Area(Geometry=fragment_patch_14)  # -> Area, Centroid
line_4 = Line(StartPoint=area_9.Centroid, EndPoint=area_8.Centroid)
length_4 = Length(Curve=line_4)
unit_z_17 = UnitZ(Factor=length_4)
extrude_7 = Extrude(Base=fragment_patch_12, Direction=unit_z_17)
brep_brep_4 = BrepBrep(BrepA=brep, BrepB=extrude_7)  # -> Curves, Points
fragment_patch_15 = FragmentPatch(Boundary=brep_brep_4.Curves)
extrude_8 = Extrude(Base=fragment_patch_15, Direction=unit_z_6)
trim_solid_4 = TrimSolid(Shape=extrude_7, Cutters=extrude_8)
list_item_28 = ListItem(List=trim_solid_4, Index=0, Wrap=True)  # -> Item, Item1

# ----
# COLOR SCHEME
number_slider_12 = Slider(0.223, range=0..1)
colour_swatch_13 = ColourSwatch(SwatchColor=RGB(0, 255, 255))
colour_swatch_14 = ColourSwatch(SwatchColor=RGB(255, 0, 0))
create_material_12 = CreateMaterial(Diffuse=colour_swatch_13, Specular=colour_swatch_13, Emission=colour_swatch_13, Transparency=number_slider_12, Shine=20)
create_material_13 = CreateMaterial(Diffuse=colour_swatch_14, Specular=colour_swatch_14, Emission=colour_swatch_14, Transparency=number_slider_12, Shine=20)
custom_preview_15 = CustomPreview(Geometry=list_item_28.Item1, Material=create_material_12)
custom_preview_16 = CustomPreview(Geometry=list_item_28.Item, Material=create_material_13)

# ----
# EDIF_B  FILL (M3)
cluster_7 = Cluster(breps=[list_item_28.Item1, extrude_8])

# ----
# EDIF_B  CUT  (M3)
cluster_8 = Cluster_2(breps=[list_item_28.Item, fragment_patch_15])

panel_18 = Panel("12")
panel_19 = Panel("24")
panel_20 = Panel("72")
series_11 = Series(Start=edif_e_pocision, Step=edif_e_module_jump, Count=integer_8)
division_11 = Division(A="24", B=2)
division_12 = Division(A="48", B=2)
list_item_29 = ListItem(List=rotate_plane, Index=series_11, Wrap=True)
center_box_5 = CenterBox(Base=list_item_29, X=division_11, Y=division_12, Z=Slider(0.1, range=0..0.1))
brep_6 = Brep(center_box_5)
deconstruct_brep_5 = DeconstructBrep(Brep=brep_6)  # -> Faces, Edges, Vertices
list_item_30 = ListItem(List=deconstruct_brep_5.Faces, Index=Slider(4, range=0..100), Wrap=True)
brep_wireframe_5 = BrepWireframe(Brep=list_item_30, Density=-1)
join_curves_5 = JoinCurves(Curves=brep_wireframe_5, Preserve=False)
unit_z_18 = UnitZ(Factor=sotanos)
rotate_5 = Rotate(Geometry=join_curves_5, Angle=rotation, Plane=list_item_29)  # -> Geometry, Transform
move_14 = Move(Geometry=rotate_5.Geometry, Motion=unit_z_18)  # -> Geometry, Transform
fragment_patch_16 = FragmentPatch(Boundary=move_14.Geometry)
area_10 = Area(Geometry=fragment_patch_16)  # -> Area, Centroid

# ----
# FLOORS
unit_z_19 = UnitZ(Factor=altura_desplante)
unit_z_20 = UnitZ(Factor=series_2)
move_15 = Move(Geometry=rotate_5.Geometry, Motion=unit_z_19)  # -> Geometry, Transform
move_16 = Move(Geometry=move_15.Geometry, Motion=unit_z_20)  # -> Geometry, Transform
fragment_patch_17 = FragmentPatch(Boundary=move_16.Geometry)
loft_5 = Loft(
    Curves=move_16.Geometry,
    Options={Adjust=False, Closed=False, LoftEnds=0, LoftSimp=0, LoftType=0, Rebuild=10, Refit=0.01})
custom_preview_17 = CustomPreview(Geometry=fragment_patch_17, Material=colour_swatch_4)
custom_preview_18 = CustomPreview(Geometry=loft_5, Material=create_material)

fragment_patch_18 = FragmentPatch(Boundary=move_15.Geometry)
area_11 = Area(Geometry=fragment_patch_18)  # -> Area, Centroid
line_5 = Line(StartPoint=area_11.Centroid, EndPoint=area_10.Centroid)
length_5 = Length(Curve=line_5)
unit_z_21 = UnitZ(Factor=length_5)
extrude_9 = Extrude(Base=fragment_patch_16, Direction=unit_z_21)
brep_brep_5 = BrepBrep(BrepA=brep, BrepB=extrude_9)  # -> Curves, Points
fragment_patch_19 = FragmentPatch(Boundary=brep_brep_5.Curves)
extrude_10 = Extrude(Base=fragment_patch_19, Direction=unit_z_6)
trim_solid_5 = TrimSolid(Shape=extrude_9, Cutters=extrude_10)
list_item_31 = ListItem(List=trim_solid_5, Index=0, Wrap=True)  # -> Item, Item1

# ----
# COLOR SCHEME
colour_swatch_15 = ColourSwatch(SwatchColor=RGB(0, 255, 255))
colour_swatch_16 = ColourSwatch(SwatchColor=RGB(255, 0, 0))
create_material_14 = CreateMaterial(Diffuse=colour_swatch_15, Specular=colour_swatch_15, Emission=colour_swatch_15, Transparency=number_slider_3, Shine=20)
create_material_15 = CreateMaterial(Diffuse=colour_swatch_16, Specular=colour_swatch_16, Emission=colour_swatch_16, Transparency=number_slider_3, Shine=20)
custom_preview_19 = CustomPreview(Geometry=list_item_31.Item1, Material=create_material_14)
custom_preview_20 = CustomPreview(Geometry=list_item_31.Item, Material=create_material_15)

# ----
# EDIF_E  FILL (M3)
cluster_9 = Cluster(breps=[list_item_31.Item1, extrude_10])

# ----
# CONSTRUCTION AREA
area_12 = Area(Geometry=fragment_patch_17)  # -> Area, Centroid
area_13 = Area(Geometry=fragment_patch_13)  # -> Area, Centroid
area_14 = Area(Geometry=move_6.Geometry)  # -> Area, Centroid
area_15 = Area(Geometry=fragment_patch_9)  # -> Area, Centroid
area_16 = Area(Geometry=fragment_patch_2)  # -> Area, Centroid
ghpython_script_5 = GhPythonScript(SUM=area_16.Area)  # -> out, a; inputs SUM: list
# ---------- ghpython_script_5: Python ----------
"""Provides a scripting component.
    Inputs:
        x:
        y:
    Output:
        a: The a output variable"""

__author__ = "Sergio"
__version__ = "2019.03.28"

import rhinoscriptsyntax as rs
import math as math
ab=[]
for num in SUM:
    ab.append(num)
    lst = (math.fsum(ab))
    a=lst
# ---------- end ghpython_script_5 ----------
ghpython_script_6 = GhPythonScript(SUM=area_14.Area)  # -> out, a; inputs SUM: list; same code as ghpython_script_5
ghpython_script_7 = GhPythonScript(SUM=area_12.Area)  # -> out, a; inputs SUM: list; same code as ghpython_script_5
ghpython_script_8 = GhPythonScript(SUM=area_15.Area)  # -> out, a; inputs SUM: list; same code as ghpython_script_5
ghpython_script_9 = GhPythonScript(SUM=area_13.Area)  # -> out, a; inputs SUM: list; same code as ghpython_script_5
entwine_4 = Entwine(
    Branch00=ghpython_script_6.a,
    Branch01=ghpython_script_9.a,
    Branch02=ghpython_script_5.a,
    Branch03=ghpython_script_8.a,
    Branch04=ghpython_script_7.a,
    FlattenInputs=True)  # -> flatten(Result)
clean_tree = CleanTree(RemoveNulls=True, RemoveInvalid=True, RemoveEmpty=False, Tree=entwine_4)
number_2 = Number(clean_tree)
ghpython_script_10 = GhPythonScript(SUM=number_2)  # -> out, a; inputs SUM: list; same code as ghpython_script_5

# ----
# LAYOUT FLOOR PLAN AREA (M2)
multiplication = Multiplication(A=integer_10, B="576")
multiplication_2 = Multiplication(A=integer_12, B="864")
# OUTPUTS
multiplication_3 = Multiplication(A=integer_9, B="400")
multiplication_4 = Multiplication(A=integer_8, B="1600")
multiplication_5 = Multiplication(A=integer_12, B="1200")
entwine_5 = Entwine(
    Branch00=multiplication_3,
    Branch01=multiplication,
    Branch02=multiplication_2,
    Branch03=multiplication_5,
    Branch04=multiplication_4,
    FlattenInputs=True)  # -> flatten(Result)
clean_tree_2 = CleanTree(RemoveNulls=True, RemoveInvalid=True, RemoveEmpty=False, Tree=entwine_5)
number_3 = Number(clean_tree_2)
ghpython_script_11 = GhPythonScript(SUM=number_3)  # -> out, a; inputs SUM: list; same code as ghpython_script_5

# ----
# EDIF_E  CUT  (M3)
cluster_10 = Cluster_2(breps=[list_item_31.Item, fragment_patch_19])

# ----
# FILL VOLUME (M3)
entwine_6 = Entwine(Branch00=cluster, Branch01=cluster_7, Branch02=cluster_2, Branch03=cluster_5, Branch04=cluster_9, FlattenInputs=True)  # -> flatten(Result)
clean_tree_3 = CleanTree(RemoveNulls=True, RemoveInvalid=True, RemoveEmpty=False, Tree=entwine_6)
number_4 = Number(clean_tree_3)
ghpython_script_12 = GhPythonScript(SUM=number_4)  # -> out, a; inputs SUM: list; same code as ghpython_script_5

# ----
# CUT VOLUME (M3)
entwine_7 = Entwine(Branch00=cluster_4, Branch01=cluster_8, Branch02=cluster_3, Branch03=cluster_6, Branch04=cluster_10, FlattenInputs=True)  # -> flatten(Result)
clean_tree_4 = CleanTree(RemoveNulls=True, RemoveInvalid=True, RemoveEmpty=False, Tree=entwine_7)
number_5 = Number(clean_tree_4)
ghpython_script_13 = GhPythonScript(SUM=number_5)  # -> out, a; inputs SUM: list; same code as ghpython_script_5

# ----
# FINANCIAL MATH
fill_volume_cost_foreign = Panel("63.77")
fill_volume_cost_local = Panel("115.200")
construction_cost_m2 = Panel("63.770")
soft_cost = Panel("0.12")
cut_volume_cost = Panel("63.770")
house_income_m2 = Panel("38585.0000")
number_6 = Number(house_income_m2)
number_7 = Number(fill_volume_cost_local)
number_8 = Number(construction_cost_m2)
number_9 = Number(soft_cost)
number_10 = Number(cut_volume_cost)
number_11 = Number(fill_volume_cost_foreign)
multiplication_6 = Multiplication(A=number_7, B=ghpython_script_12.a)
multiplication_7 = Multiplication(A=number_6, B=ghpython_script_10.a)
multiplication_8 = Multiplication(A=construction_cost_m2, B=ghpython_script_10.a)
multiplication_9 = Multiplication(A=number_9, B=ghpython_script_10.a)
multiplication_10 = Multiplication(A=number_10, B=ghpython_script_13.a)
multiplication_11 = Multiplication(A=number_11, B=ghpython_script_12.a)

# ----
# FINANCIAL OUTPUTS
fill_volume_cost_local_2 = Panel(multiplication_6)
fill_volume_cost_foreign_2 = Panel(multiplication_11)
soft_cost_2 = Panel(multiplication_9)
cut_volume_cost_2 = Panel(multiplication_10)
house_income_m2_2 = Panel(multiplication_7)
construction_cost_m2_2 = Panel(multiplication_8)

# ----
# TERRAIN OUTPUTS
floor_plan_area_m2 = Panel(ghpython_script_11.a)
construction_area_m2 = Panel(ghpython_script_10.a)
fill_volume_m3 = Panel(ghpython_script_12.a)
cut_volume_m3 = Panel(ghpython_script_13.a)

number_slider_13 = Slider(6, range=0..10)
construct_domain_2 = ConstructDomain(DomainStart=100000, DomainEnd=10000000)
number_12 = Number(construct_domain_2)
construct_domain_3 = ConstructDomain(DomainStart=100000, DomainEnd=graft(construction_cost_m2_2))
construct_domain_4 = ConstructDomain(DomainStart=100000, DomainEnd=graft(cut_volume_cost_2))
construct_domain_5 = ConstructDomain(DomainStart=100000, DomainEnd=graft(fill_volume_cost_local_2))
construct_domain_6 = ConstructDomain(DomainStart=100000, DomainEnd=graft(fill_volume_cost_foreign_2))
construct_domain_7 = ConstructDomain(DomainStart=500, DomainEnd=graft(soft_cost_2))
remap_numbers = RemapNumbers(Value=graft(house_income_m2_2), Source=number_12, Target=construct_domain_2)  # -> Mapped, Clipped
range_2 = Range(Domain=remap_numbers.Mapped, Steps=number_slider_13)
range_3 = Range(Domain=construct_domain_3, Steps=number_slider_13)
range_4 = Range(Domain=construct_domain_4, Steps=number_slider_13)
range_5 = Range(Domain=construct_domain_5, Steps=number_slider_13)
range_6 = Range(Domain=construct_domain_6, Steps=number_slider_13)
range_7 = Range(Domain=construct_domain_7, Steps=number_slider_13)
entwine_8 = Entwine(
    Branch00=range_2,
    Branch01=range_3,
    Branch02=range_4,
    Branch03=range_5,
    Branch04=range_6,
    Branch05=range_7,
    FlattenInputs=True)

# ----
# PIE CHART FOR TERRAIN OUTPUTS
number_slider_14 = Slider(0.04, range=0..1)
panel_21 = Panel("""FLOOR PLAN AREA(M2)4,640
CONSTRUCTION AREA(M2)23,696.0
FILL VOLUME(M3)15,982.02
CUT VOLUME(M3)44,242.39""")
entwine_9 = Entwine(
    Branch00=floor_plan_area_m2,
    Branch01=construction_area_m2,
    Branch02=fill_volume_m3,
    Branch03=cut_volume_m3,
    FlattenInputs=True)  # -> flatten(Result)
merge_4 = Merge(
    Data1=ColourSwatch(SwatchColor=RGB(247, 4, 203)),
    Data2=ColourSwatch(SwatchColor=RGB(106, 255, 255)),
    Data3=ColourSwatch(SwatchColor=RGB(102, 102, 255)),
    Data4=ColourSwatch(SwatchColor=RGB(184, 255, 102)))
conduit_pie_style = ConduitPieStyle(
    StyleName="IMPERATIVE STYLE",
    InnerRadius=Slider(0.56, range=0..1),
    OuterRadius=Slider(0.92, range=0..1),
    LabelRadius=Slider(1.07, range=0..2),
    LabelFontFace="BankGothic Md BT",
    RelativeLabelHeight=number_slider_14,
    LabelColor=ColourSwatch(SwatchColor=RGB(243, 255, 255)))
conduit_colorpalette = ConduitColorPalette(
    PaletteName="Palette",
    Seed=Slider(52, range=0..100),
    HueRange=Domain(-0.05, 0.05),
    SaturationRange=Domain(-0.15, 0.15),
    LuminanceRange=Domain(-0.1, 0.1),
    BaseColors=merge_4)
curve_4 = Curve(<curve referenced from the Rhino model>)
draw_pie_chart = DrawPieChart(
    BoundaryRectangle=curve_4,
    Labels=panel_21,
    DataValues=entwine_9,
    PieStyle=conduit_pie_style,
    ColorPalette=conduit_colorpalette)

construct_domain_8 = ConstructDomain(DomainStart=soft_cost_2, DomainEnd=Slider(100000000, range=0..100000000))
conduit_colorpalette_2 = ConduitColorPalette(
    PaletteName="Palette 2",
    Seed=Slider(23, range=0..100),
    HueRange=Domain(-0.05, 0.05),
    SaturationRange=Domain(-0.15, 0.15),
    LuminanceRange=Domain(-0.1, 0.1),
    BaseColors=ColourSwatch(SwatchColor=RGB(202, 119, 203)))
conduit_colorpalette_3 = ConduitColorPalette(
    PaletteName="Palette 2",
    Seed=Slider(39, range=0..100),
    HueRange=Domain(-0.05, 0.05),
    SaturationRange=Domain(-0.15, 0.15),
    LuminanceRange=Domain(-0.1, 0.1),
    BaseColors=ColourSwatch(SwatchColor=RGB(232, 105, 255)))
entwine_10 = Entwine(Branch00=conduit_colorpalette_2, Branch01=conduit_colorpalette_3, FlattenInputs=True)

panel_22 = Panel("""HOUSE INCOME / M2 ($)
CONSTRUCTION COST M2 / ($) 
CUT VOLUME COST ($)
FILL VOLUME COST ($) - LOCAL
FILL VOLUME COST ($) - FOREIGN 
SOFT COST (%)
FINANCIAL OUTPUTS""")
reverse_list = ReverseList(List=panel_22)
conduit_font_2 = ConduitFont(
    StyleName="FINANCIAL",
    Font="BankGothic Md BT",
    TextHeight=Slider(6.901, range=0..10),
    AdaptiveHeight=Toggle(False),
    TextSpacing=1.15,
    Alignment=0,
    Bold=Toggle(True),
    Italic=False,
    Color=ColourSwatch(SwatchColor=RGB(255, 255, 255)))
curve_5 = Curve(<curve referenced from the Rhino model>)
draw_chart = DrawChart(
    Boundary=curve_5,
    Data=entwine_8,
    Categories=reverse_list,
    CategoryAxisTitle="FINANCIAL OUTPUTS",
    ValueAxisTitle="FINANCIAL OUTPUTS",
    ValueAxisRange=construct_domain_8,
    AxisPadding=Slider(0.763, range=0..1),
    CategoryPadding=Slider(0, range=0..1),
    CategorySpacing=Slider(-6.599, range=-200..1),
    LineWeight=2,
    ChartFont=conduit_font_2,
    ColorPalette=entwine_10,
    IsBar=True,
    IsColumn=False,
    IsLine=False)

nyc = Panel("""38
36
40
25
20
33
39
39
44
50
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""")
la = Panel("""54
56
53
62
54
52
52
53
53
57
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""")
miami = Panel("""79
78
72
66
66
70
69
72
74
76
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""")
entwine_11 = Entwine(Branch00=nyc, Branch01=la, Branch02=miami, FlattenInputs=True)  # -> simplify(Result)
curve_6 = Curve(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)

# ----
# You can specify the line weights for each series
number_slider_15 = Slider(1, range=1..5)
tree_statistics = TreeStatistics(Tree=entwine_11)  # -> Paths, Length, Count
list_length_2 = ListLength(List=tree_statistics.Paths)
repeat_data = RepeatData(Data=number_slider_15, Length=list_length_2)
replace_items = ReplaceItems(List=repeat_data, Item=Slider(3, range=1..5), Indices=Slider(0, range=0..2), Wrap=False)

draw_chart_2 = DrawChart(
    Boundary=curve_6,
    Data=entwine_11,
    ValueAxisRange="0 to 90",
    AxisPadding=0.1,
    CategoryPadding=0.1,
    CategorySpacing=0.2,
    LineWeight=replace_items,
    IsBar=False,
    IsColumn=False,
    IsLine=True)

merge_5 = Merge(
    Data3=draw_pie_chart,
    Data4=draw_chart,
    Data5=draw_text,
    Data6=draw_text_2,
    Data7=draw_chart_2,
    Data8=draw_a_bubble_chart)  # -> flatten(Result)

# ---- group: utility for getting the current active viewport
point = Point(Point(11.73649984, -303.2999099, 0))

# ----
move_17 = Move(Geometry=point, Motion=unit_x)  # -> Geometry, Transform

# ---- group: utility for getting the current active viewport (continued)
get_viewport_boundary_dimensions = GetViewportBoundaryDimensions(Refresh=Button(), Origin=move_17.Geometry, Scale=Slider(0.114, range=0..1), xDim=1654, yDim=819)

# ---- group: Right-click the HUD component icon to load a style sheet from file
# These are some of the default style names that components use if no style information is passed to them.
# 
# In your style sheet, if you create styles with these names, then components will default to those when your style sheet is loaded
# Main Defaults: Default Font
# Default Chart Font
# Default Palette
# Default Pie
# Default Axis
# Default Curve
heads_up_display_hud = HeadsUpDisplayHUD(
    ShowHUD=Toggle(True),
    DrawingObjects=merge_5,
    DrawingBoundary=get_viewport_boundary_dimensions,
    ConduitStyleSheet="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")

# ==== cluster Cluster
breps = ClusterInput()
brep_join = BrepJoin(Breps=breps)  # -> Breps, Closed
solid_union = SolidUnion(Breps=brep_join.Breps)
volume = Volume(Geometry=solid_union)  # -> Volume, Centroid
volume_2 = ClusterOutput(volume.Volume)

# ==== cluster Cluster_2
breps = ClusterInput()
brep_join = BrepJoin(Breps=breps)  # -> Breps, Closed
volume = Volume(Geometry=brep_join.Breps)  # -> flatten(Volume), Centroid
volume_2 = ClusterOutput(volume.Volume)
