# Grasshopper definition 2.3.1.0Alpha_Latiz Hypaar.gh (Grasshopper 1.0.4)
# plug-ins: Blindfold, OpenNest, LunchBox, Wallacei

# ----
# TOPOGRAPHY MESH PANEL
lote = Slider(25, range=0..100)
reticula_grid = Slider(7, range=1..15)
angle_range = Slider(20, range=1..30)
random_seed = Slider(31, range=1..55)
offset_bounds = Slider(-10, range=-20..10)

# ----
# BREP FOR SPACE ANALYSIS
point = Point(<point referenced from the Rhino model>)
curve = Curve([<curve referenced from the Rhino model> x59])
boundary_surfaces = BoundarySurfaces(Edges=curve)
area = Area(Geometry=boundary_surfaces)  # -> Area, Centroid
distance = Distance(PointA=point, PointB=area.Centroid)
sort_list = SortList(Keys=distance, ValuesA=boundary_surfaces)  # -> Keys, ValuesA
list_item = ListItem(List=sort_list.ValuesA, Index=lote, Wrap=True)

wlc_01prior = GenePool(Decimals=0, Maximum=100, Minimum=0, Value=[64, 91, 80, 93, 98])
wlc_02_place1 = GenePool(Decimals=0, Maximum=320, Minimum=1, Value=[246.1508842, 180.8788317, 200.6239508, 38.11933716, 302.756136])
wlc_05 = Slider(1, range=0..4)
sds = GenePool(Decimals=0, Maximum=30, Minimum=1, Value=[8.188325143, 18.94587197, 9.764517016, 17.3720196, 2.089351507])
ssviv = Slider(116, range=50..200)
flatten_tree = FlattenTree(Tree=wlc_01prior, Path="{0}")
integer = Integer(ssviv)

# ----
# TOPOGRAPHY BOUNDS
brep_wireframe = BrepWireframe(Brep=list_item, Density=-1)
join_curves = JoinCurves(Curves=brep_wireframe, Preserve=False)
offset_curve = OffsetCurve(Curve=join_curves, Distance=offset_bounds, Plane=PlaneXY(0, 0, 0), Corners=1)
unit_z = UnitZ(Factor=Slider(372, range=0..1000))
boundary_surfaces_2 = BoundarySurfaces(Edges=offset_curve)
extrude = Extrude(Base=boundary_surfaces_2, Direction=unit_z)

curve_2 = Curve([<curve referenced from the Rhino model> x4])
opennest = OpenNest(
    Sheets=offset_curve,
    Polylines=curve_2,
    Spacing=Slider(0.678, range=0..1),
    PlacementType=Slider(2, range=0..10),
    Tolerance=0.01,
    Rotations=Slider(334, range=0..360),
    Iterations=Slider(1, range=0..10))  # -> Sheets, Polylines, ID, Transform
graft_tree = GraftTree(Tree=opennest.Polylines, IncludeEmptyLists=True, IncludeNullItems=True)
galapagos = Galapagos(fitness=wlc__house_income, gene=wlc_01prior)

brep = Brep([<brep referenced from the Rhino model> x59])

# ----
# VISUALIZATIUON
#  ENVIRONMENT
area_2 = Area(Geometry=brep)  # -> Area, Centroid
distance_2 = Distance(PointA=point, PointB=area_2.Centroid)
sort_list_2 = SortList(Keys=distance_2, ValuesValuesA=brep)  # -> Keys, ValuesValuesA
brep_2 = Brep([<brep referenced from the Rhino model> x59])
panel = Panel("""LOTE 12
LOTE 24
LOTE 24
LOTE A
LOTE 7
LOTE 8
LOTE 52
LOTE 35
LOTE 31-B
LOTE 20
LOTE 33
LOTE 34
LOTE 37
LOTE 21
LOTE 32
LOTE 16
LOTE 28
LOTE 27
LOTE R
LOTE R
LOTE 17
LOTE 18
LOTE 9
LOTE 13
LOTE 26
LOTE 15
LOTE 23 
LOTE 23
LOTE 14
LOTE 25
LOTE B
LOTE 3-5
LOTE 6
LOTE 10
LOTE 2
LOTE 11
LOTE 51
LOTE 31-A
LOTE 22
LOTE 38
LOTE 36
LOTE 39
LOTE 40
LOTE D
LOTE 41
LOTE 49
LOTE 53
LOTE 50
LOTE 30 
LOTE E
LOTE 46
LOTE 47
LOTE 48
LOTE 44
LOTE 43
LOTE 45
LOTE 42
LOTE 29
LOTE 29-A
C.S.A.G""")
area_3 = Area(Geometry=brep_2)  # -> Area, graft(Centroid)
graft_tree_2 = GraftTree(Tree=panel, IncludeEmptyLists=True, IncludeNullItems=True)
text_tag = TextTag(Location=area_3.Centroid, Text=graft_tree_2, Colour=ColourSwatch(SwatchColor=RGB(0, 0, 0)))

list_length = ListLength(List=sort_list_2.ValuesValuesA)
series = Series(Start=0, Step=1, Count=list_length)
list_item_2 = ListItem(List=sort_list_2.ValuesValuesA, Index=series, Wrap=True)
list_item_3 = ListItem(List=sort_list_2.ValuesValuesA, Index=lote, Wrap=True)
item_index = ItemIndex(List=sort_list_2.ValuesValuesA, Item=list_item_2)
item_index_2 = ItemIndex(List=sort_list_2.ValuesValuesA, Item=list_item_3)
equality = Equality(FirstNumber=item_index_2, SecondNumber=item_index)  # -> Equality, Inequality
dispatch = Dispatch(List=sort_list_2.ValuesValuesA, DispatchPattern=equality.Equality)  # -> ListA, ListB
blindfold = Blindfold(Refresh=Button(), Visibility=Toggle(False), Limited=dispatch.ListB)
blindfold_2 = Blindfold(Refresh=Button(), Visibility=Toggle(True), Limited=list_item_3)

area_4 = Area(Geometry=list_item_3)  # -> Area, Centroid
ghpython_script = GhPythonScript(Area=area_4.Area, B=flatten_tree, C=integer)  # -> out, edif_a, edif_b, edif_c, edif_d, edif_e; inputs B: list, C: Int32
# ---------- ghpython_script: Python ----------
"""Provides a scripting component.
    Inputs:
        x:
        y:
    Output:
        a: The a output variable"""

__author__ = "Sergio"
__version__ = "2019.03.28"
import sys
import math

sys.path.append( "Z:\Shared\PRODUCCION\TALLER PROGRAMACION\RZM LATIZ PROTOTYPE\LIBRERIAS_PY\CLASSES")
from HYBRID_CLASS import *
from LOTE_CLASS import*


# Objects
edif_A = Edificio("A",400,4,20,20,100,B[0])
edif_B = Edificio("B",576,4,12,48,144,B[1])
edif_C = Edificio("C",864,6,12,72,144,B[2])
edif_D =Edificio("D",1200,8,24,48,147,B[3])
edif_E = Edificio("E",1600,12,24,72,133,B[4])
lote_gen = Lote("GENERIC","C.U",C,15,75,Area,0.50,0.25,0.25)


#Inputs
num_max_vivedif=0
num_vivmax = lote_gen.max_viv
niveles_max = lote_gen.max_niv
""""///////////////////////////////////////////////////////////////////////////////////////////"""
#EDIF_A

# Data edif_A
num_max_vivedif = round(edif_A.prior * num_vivmax / 100)
viv_init = edif_A.dptos
niv_tedif = round(num_max_vivedif / viv_init)

#Bounds
if niv_tedif > niveles_max:
            edif_A_count = niv_tedif / niveles_max
else:
            edif_A_count = 1
            
edif_A_count = math.ceil(edif_A_count)
edif_A.niveles = round(niv_tedif / edif_A_count)
n=0
while edif_A.niveles %2 ==0:
    n+=1
    edif_A.niveles = edif_A.niveles+n
else:
    edif_A.niveles = edif_A.niveles

#Data extraction
lst_a=[edif_A.type,edif_A.huella, edif_A.dptos,edif_A.ancho, edif_A.largo,edif_A_count
,edif_A.niveles]
edif_a=lst_a

"""""///////////////////////////////////////////////////////////////////////////////////////////////"""

#EDIF_B

# DATA edif_B
num_max_vivedif = round(edif_B.prior * num_vivmax / 100)
viv_init = edif_B.dptos
niv_tedif = round(num_max_vivedif / viv_init)

#Bounds
if niv_tedif > niveles_max:
            edif_B_count = niv_tedif / niveles_max
else:
            edif_B_count = 1
            
edif_B_count = math.ceil(edif_B_count)
edif_B.niveles = round(niv_tedif / edif_B_count)
n=0
while edif_B.niveles %2 ==0:
    n+=1
    edif_B.niveles = edif_B.niveles+n
else:
    edif_B.niveles = edif_B.niveles
#Data Extraction
lst_B=[edif_B.type,edif_B.huella, edif_B.dptos,edif_B.ancho, edif_B.largo,edif_B_count
,edif_B.niveles]
edif_b=lst_B

""""////////////////////////////////////////////////////////////////////////////////////////////"""
#EDIF_C

# DATA edif_C
num_max_vivedif = round(edif_C.prior * num_vivmax / 100)
viv_init = edif_C.dptos
niv_tedif = round(num_max_vivedif / viv_init)

#Bounds
if niv_tedif > niveles_max:
            edif_C_count = niv_tedif / niveles_max
else:
            edif_C_count = 1
            
edif_C_count = math.ceil(edif_C_count)
edif_C.niveles = round(niv_tedif / edif_C_count)
n=0
while edif_C.niveles %2 ==0:
    n+=1
    edif_C.niveles = edif_C.niveles+n
else:
    edif_C.niveles = edif_C.niveles
#Data Extraction
lst_C=[edif_C.type,edif_C.huella, edif_C.dptos,edif_C.ancho, edif_C.largo,edif_C_count
,edif_C.niveles]
edif_c=lst_C

""""////////////////////////////////////////////////////////////////////////////////////////////"""
#EDIF_D

# DATA edif_D
num_max_vivedif = round(edif_D.prior * num_vivmax / 100)
viv_init = edif_D.dptos
niv_tedif = round(num_max_vivedif / viv_init)
#Bounds
if niv_tedif > niveles_max:
            edif_D_count = niv_tedif / niveles_max
else:
            edif_D_count = 1
            
edif_D_count = math.ceil(edif_D_count)
edif_D.niveles = round(niv_tedif / edif_D_count)
n=0
while edif_D.niveles %2 ==0:
    n+=1
    edif_D.niveles = edif_D.niveles+n
else:
    edif_D.niveles = edif_D.niveles
#Data Extraction
lst_D=[edif_D.type,edif_D.huella, edif_D.dptos,edif_D.ancho, edif_D.largo,edif_D_count
,edif_D.niveles]
edif_d=lst_D

""""////////////////////////////////////////////////////////////////////////////////////////////"""
#EDIF_E


# DATA edif_E
num_max_vivedif = round(edif_E.prior * num_vivmax / 100)
viv_init = edif_E.dptos
niv_tedif = round(num_max_vivedif / viv_init)
#Bounds
if niv_tedif > niveles_max:
            edif_E_count = niv_tedif / niveles_max
else:
            edif_E_count = 1
            
edif_E_count = math.ceil(edif_E_count)
edif_E.niveles = round(niv_tedif / edif_E_count)
n=0
while edif_E.niveles %2 ==0:
    n+=1
    edif_E.niveles = edif_E.niveles+n
else:
    edif_E.niveles = edif_E.niveles

#Data edifi_E
lst_E=[edif_E.type,edif_E.huella, edif_E.dptos,edif_E.ancho, edif_E.largo,edif_E_count
,edif_E.niveles]
edif_e=lst_E
# ---------- end ghpython_script ----------

# ----
# LAYOUT 2D (2D BOX PROP)
entwine = Entwine(
    Branch00=ghpython_script.edif_a,
    Branch01=ghpython_script.edif_b,
    Branch02=ghpython_script.edif_c,
    Branch03=ghpython_script.edif_d,
    Branch04=ghpython_script.edif_e,
    FlattenInputs=True)
list_item_4 = ListItem(List=entwine, Index=3, Wrap=True)  # -> Item, Item1
division = Division(A=list_item_4.Item1, B=2)
division_2 = Division(A=list_item_4.Item, B=2)

# ----
# FITNESS
entwine_2 = Entwine(
    Branch00=ghpython_script.edif_a,
    Branch01=ghpython_script.edif_b,
    Branch02=ghpython_script.edif_c,
    Branch03=ghpython_script.edif_d,
    Branch04=ghpython_script.edif_e,
    FlattenInputs=True)
list_item_5 = ListItem(List=entwine_2, Index=5, Wrap=True)  # -> Item, Item1

series_2 = Series(Start=wlc_02_place1, Step=sds, Count=list_item_5.Item)

# ----
# TOPOGRAPHY MESH ANALYSIS
# ANALYSIS
# BREP MESH
number_slider = Slider(1.17, range=0..10)
settings_custom = SettingsCustom(
    StitchSeams=True,
    SimplePlanes=False,
    Refine=True,
    MinCount=16,
    MaxCount=400,
    AspectRatio=20,
    MaxDistance=0,
    MaxAngle=20,
    MinEdge=number_slider,
    MaxEdge=number_slider)
mesh_brep = MeshBrep(Brep=list_item_3, Settings=settings_custom)
mcomp = Decompose(Mesh=mesh_brep)  # -> Vertices, Faces, Colours, Normals
vcomp = Decompose(Vector=mcomp.Normals)  # -> XComponent, YComponent, ZComponent
expression = Expression(z=vcomp.ZComponent, Expression="Deg(0.0 - (Asin(Abs(z)) - 0.5*π))")
gradient = Gradient(
    LowerLimit=0,
    UpperLimit=90,
    Parameter=expression,
    stops=[0: RGB(101, 153, 5), 0: RGB(0, 128, 0), 0.441: RGB(240, 172, 36), 0.864: RGB(255, 0, 0)])
mesh = Mesh(Vertices=mcomp.Vertices, Faces=mcomp.Faces, Colours=gradient)
pi = Pi(Factor=Slider(0.31, range=0..0.5))
xy_plane = XYPlane(Origin=Point(0, 0, 0))
rotate_plane = RotatePlane(Plane=xy_plane, Angle=pi)
bounding_box = BoundingBox(Content=mesh, Plane=rotate_plane)  # -> Box, Box_2
deconstruct_brep = DeconstructBrep(Brep=bounding_box.Box)  # -> Faces, Edges, Vertices
list_item_6 = ListItem(List=deconstruct_brep.Faces, Index="4", Wrap=True)
dimensions = Dimensions(Surface=list_item_6)  # -> UDimension, VDimension
division_3 = Division(A=dimensions.VDimension, B=reticula_grid)
division_4 = Division(A=dimensions.UDimension, B=reticula_grid)
integer_2 = Integer(division_4)
integer_3 = Integer(division_3)
quad_panels = QuadPanels(Surface=list_item_6, UDivisions=integer_2, VDivisions=integer_3)
area_5 = Area(Geometry=quad_panels)  # -> Area, Centroid

unit_z_2 = UnitZ(Factor=1)
project_point = ProjectPoint(Point=area_5.Centroid, Direction=unit_z_2, Geometry=mesh)  # -> Point, Index

null_item = NullItem(Item=project_point.Point)  # -> NullFlags, InvalidFlags, Description
dispatch_2 = Dispatch(List=project_point.Point, DispatchPattern=null_item.NullFlags)  # -> ListA, ListB
mesh_closest_point = MeshClosestPoint(Point=dispatch_2.ListB, Mesh=mesh)  # -> Point, Index, Parameter
mesh_eval = MeshEval(Mesh=mesh, Parameter=mesh_closest_point.Parameter)  # -> Point, Normal, Colour
vcomp_2 = Decompose(Vector=mesh_eval.Normal)  # -> XComponent, YComponent, ZComponent
expression_2 = Expression(z=vcomp_2.ZComponent, Expression="Deg(0.0 - (Asin(Abs(z)) - 0.5*π))")
smaller_than = SmallerThan(FirstNumber=expression_2, SecondNumber=angle_range)  # -> SmallerThan, OrEqualTo
dispatch_3 = Dispatch(List=mesh_eval.Point, DispatchPattern=smaller_than.SmallerThan)  # -> ListA, ListB
point_groups = PointGroups(Points=dispatch_3.ListA, Distance=random_seed)  # -> Groups, Indices

# ----
# POINT MATRIX IN BOUNDS
boolean_toggle = BooleanToggle(True)
flatten_tree_2 = FlattenTree(Tree=point_groups.Groups, Path="{0}")
point_in_brep = PointInBrep(Brep=extrude, Point=flatten_tree_2, Strict=boolean_toggle)

list_item_7 = ListItem(List=flatten_tree_2, Index=series_2, Wrap=True)

center_box = CenterBox(Base=list_item_7, X=division_2, Y=division, Z=0)
brep_wireframe_2 = BrepWireframe(Brep=center_box, Density=-1)
series_3 = Series(Start=Slider(3, range=0..100), Step=4, Count=list_item_5.Item1)
join_curves_2 = JoinCurves(Curves=brep_wireframe_2, Preserve=False)
boundary_surfaces_3 = BoundarySurfaces(Edges=join_curves_2)
unit_z_3 = UnitZ(Factor=series_3)
unit_z_4 = UnitZ(Factor=Slider(0.3, range=0..1))
move = Move(Geometry=join_curves_2, Motion=unit_z_3)  # -> Geometry, Transform

area_6 = Area(Geometry=move.Geometry)  # -> Area, Centroid

move_2 = Move(Geometry=boundary_surfaces_3, Motion=unit_z_3)  # -> Geometry, Transform
extrude_2 = Extrude(Base=move_2.Geometry, Direction=unit_z_4)

# ----
# POINT MATRIX
dispatch_4 = Dispatch(List=flatten_tree_2, DispatchPattern=point_in_brep)  # -> ListA, ListB
point_2 = Point(dispatch_4.ListA)
cloud_display = CloudDisplay(Points=point_2, Colours=ColourSwatch(SwatchColor=RGB(255, 255, 255)), Size=Slider(2.39, range=0..10), SpriteType=0)

flatten_tree_3 = FlattenTree(Tree=area_6.Centroid, Path="{0}")
loft = Loft(Curves=move.Geometry, Options={Adjust=False, Closed=False, LoftEnds=0, LoftSimp=0, LoftType=0, Rebuild=10, Refit=0.01})
cross_reference = CrossReference(ListListA=area_6.Centroid, ListListB=flatten_tree_3, CrossMode=1)  # -> ListListA, ListListB
# OUTPUTS
distance_3 = Distance(PointA=cross_reference.ListListA, PointB=cross_reference.ListListB)

# ----
# CONSTRUCTION AREA
area_7 = Area(Geometry=flatten(move.Geometry))  # -> Area, Centroid
number = Number(area_7.Area)
ghpython_script_2 = GhPythonScript(SUM=number)  # -> out, a; inputs SUM: list
# ---------- ghpython_script_2: Python ----------
"""Provides a scripting component.
    Inputs:
        x:
        y:
    Output:
        a: The a output variable"""

__author__ = "Sergio"
__version__ = "2019.03.28"

import math as math
ab=[]
for num in SUM:
    ab.append(num)
    lst = (math.fsum(ab))
    a=lst
# ---------- end ghpython_script_2 ----------

# ----
# FINANCIAL MATH
house_income_m2 = Panel("38585")
construction_cost_m2 = Panel("63.770")
soft_cost = Panel("0.12")
number_2 = Number(construction_cost_m2)
number_3 = Number(house_income_m2)
number_4 = Number(soft_cost)
multiplication = Multiplication(A=number_4, B=ghpython_script_2.a)
multiplication_2 = Multiplication(A=number_2, B=ghpython_script_2.a)
multiplication_3 = Multiplication(A=number_3, B=ghpython_script_2.a)

# ----
# LAYOUT FLOOR PLAN AREA (M2)
flatten_tree_4 = FlattenTree(Tree=area_6.Area, Path="{0}")
number_5 = Number(flatten_tree_4)
ghpython_script_3 = GhPythonScript(SUM=number_5)  # -> out, a; inputs SUM: list; same code as ghpython_script_2

ghpython_script_4 = GhPythonScript(SUM=distance_3)  # -> out, a; inputs SUM: list; same code as ghpython_script_2
number_6 = Number(ghpython_script_4.a)
division_5 = Division(A=number_6, B=5)  # -> flatten(Result)
one_over_x = OneOverX(Value=multiplication_3)
panel_2 = Panel(multiplication_3)
list_item_8 = ListItem(List=division_5, Index=wlc_05, Wrap=True)
wlc_maximize_distance = Number(list_item_8)
wlc__house_income = Number(multiplication_3)
wlc_minimize_construction_area = Number(ghpython_script_2.a)
wlc_construction_cost = Number(multiplication_2)
wlc_soft_cost = Number(multiplication)
wlc__m2_floor_area = Number(ghpython_script_3.a)
panel_3 = Panel(list_item_8)
list_item_9 = ListItem(List=flatten_tree_2, Index=Slider(283, range=0..1000), Wrap=True)
panel_4 = Panel(wlc__house_income)
deconstruct = Deconstruct(Point=list_item_9)  # -> XComponent, YComponent, ZComponent
vector_xyz = VectorXYZ(XComponent=deconstruct.XComponent, YComponent=deconstruct.YComponent, ZComponent=deconstruct.ZComponent)  # -> Vector, Length
wallacei_x = WallaceiX(
    Genes=[wlc_01prior, wlc_05],
    Objectives=[wlc__house_income, wlc_soft_cost],
    Data=wlc_minimize_construction_area,
    allFitness="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",
    allGenomes="1|11|47|77|66|43_1|94|10|64|3|25_1|99|68|65|28|62_3|70|95|9|16|38_3|17|79|31|82|89_2|72|70|1|99|81_3|6|51|53|27|99_3|39|43|68|68|47_1|35|53|17|35|69_2|16|95|9|97|49_1|0|10|64|29|25_3|100|51|53|1|86_3|17|79|31|30|89_1|99|54|59|78|62_1|36|53|17|36|69_1|11|47|77|64|43_2|19|95|8|16|49_3|69|95|9|97|38_1|35|45|17|35|69_3|6|51|53|27|94",
    curFrontIdx="1|0;1|1;1|2;1|3;1|4;1|5;1|6;1|7;1|8;1|9",
    popGen="10,2",
    total="649985")  # -> WallaceiGenomes, FitnessValues, Data, Phenotypes; disabled
move_3 = Move(Geometry=graft_tree, Motion=vector_xyz.Vector)  # -> Geometry, Transform
