# Grasshopper definition 2.3.3.0Alpha_Latiz Hypaar.gh (Grasshopper 1.0.4)
# plug-ins: Blindfold, OpenNest, LunchBox

# ----
# TOPOGRAPHY MESH PANEL
lote = Slider(43, range=0..100)
reticula_grid = Slider(8, range=1..15)
angle_range = Slider(29, range=1..30)
random_seed = Slider(8, range=1..55)
offset_bounds = Slider(-10, range=-20..10)

# ----
# BREP FOR SPACE ANALYSIS
point = Point(<point referenced from the Rhino model>)
curve = Curve([<curve referenced from the Rhino model> x59])
boundary_surfaces = BoundarySurfaces(Edges=curve)
area = Area(Geometry=boundary_surfaces)  # -> Area, Centroid
distance = Distance(PointA=point, PointB=area.Centroid)
sort_list = SortList(Keys=distance, ValuesValuesA=boundary_surfaces)  # -> Keys, ValuesValuesA
list_item = ListItem(List=sort_list.ValuesValuesA, Index=lote, Wrap=True)

gene_pool = GenePool(Decimals=0, Maximum=100, Minimum=0, Value=[64.96995015, 26.60399504, 95.56552991, 36.27455837, 47.31238775])
wlc_edifswitch = GenePool(Decimals=0, Maximum=1, Minimum=0, Value=[0.934006311, 0.2787465566, 0.4150110406, 0.803673901, 0.2461582251])
construct_domain = ConstructDomain(DomainStart=Slider(0, range=0..100), DomainEnd=Slider(100, range=0..100))
list_length = ListLength(List=gene_pool)
subtraction = Subtraction(A=list_length, B=1)
bounds = Bounds(Numbers=gene_pool)
range = Range(Domain=bounds, Steps=subtraction)

list_length_2 = ListLength(List=wlc_edifswitch)
equality = Equality(FirstNumber=wlc_edifswitch, SecondNumber=Slider(0, range=0..1))  # -> Equality, Inequality
series = Series(Start=0, Step=1, Count=list_length_2)
ghpython_script = GhPythonScript(x=equality.Equality, y=series)  # -> out, a, b; inputs x: list of Boolean, y: list of Int32
# ---------- ghpython_script: Python ----------
"""Provides a scripting component.
    Inputs:
        x:
        y:
    Output:
        a: The a output variable"""

__author__ = "Sergio"
__version__ = "2019.03.28"

import math as math
lst = zip(x,y)
bc=[]
for bol , num in lst:
    if bol == True:
        print(num)
    else:
        bc.append(10)
        a=bc

j =[]
for bol , num in lst:
    if bol == False:
        j.append(num)
        b=j
# ---------- end ghpython_script ----------
merge = Merge(Data1=wlc_edifswitch, Data2="0")
ghpython_script_2 = GhPythonScript(x=merge)  # -> count, bool, e_prior; inputs x: list of Int32
# ---------- ghpython_script_2: Python ----------
"""Provides a scripting component.
    Inputs:
        x:
        y:
    Output:
        a: The a output variable"""

__author__ = "Sergio"
__version__ = "2019.03.28"

import math as math
    
a=[]
for num in x:
    if num == 1:
        a.append(True)
    else:
        a.append(False)
        bool=a
        lat=bool.count(True)

a = []
b =[]
for its in bool:
    if its == True and lat == 3:
        prior =(40,60,20)
        a.append(prior)
        e_prior=a[0]
    elif its == True:
        prior = 100/lat
        a.append(prior)
        e_prior =a
    else:
       print(0)
# ---------- end ghpython_script_2 ----------
insert_items = InsertItems(List=ghpython_script_2.e_prior, Item=Slider(0, range=0..100), Indices=ghpython_script.out, Wrap=True)

remap_numbers = RemapNumbers(Value=gene_pool, Source=range, Target=construct_domain)  # -> Mapped, Clipped
panel = Panel(bounds)
panel_2 = Panel(remap_numbers.Clipped)
list_length_3 = ListLength(List=ghpython_script.a)
series_2 = Series(Start=5, Step=50, Count=list_length_3)
construct_point = ConstructPoint(XCoordinate=series_2, YCoordinate=0, ZCoordinate=0)
ssviv = Slider(117, range=50..350)
xy_plane = XYPlane(Origin=construct_point)
integer = Integer(ssviv)

# ----
# TOPOGRAPHY BOUNDS
brep_wireframe = BrepWireframe(Brep=list_item, Density=-1)
join_curves = JoinCurves(Curves=brep_wireframe, Preserve=False)
offset_curve = OffsetCurve(Curve=join_curves, Distance=offset_bounds, Plane=PlaneXY(0, 0, 0), Corners=1)
unit_z = UnitZ(Factor=Slider(372, range=0..1000))
boundary_surfaces_2 = BoundarySurfaces(Edges=offset_curve)
extrude = Extrude(Base=boundary_surfaces_2, Direction=unit_z)

vector_xyz = VectorXYZ(XComponent=Slider(50, range=0..100), YComponent=0, ZComponent=0)  # -> Vector, Length
curve_2 = Curve(<curve referenced from the Rhino model>)
geometry = Geometry([<curve referenced from the Rhino model> x3])
number_slider = Slider(1, range=0..1)
move = Move(Motion=vector_xyz.Vector)  # -> Geometry, Transform
opennest = OpenNest(
    Sheets=curve_2,
    Geo=geometry,
    Spacing=Slider(1, range=0..10),
    Placement=Slider(1, range=0..1),
    Tolerance=Slider(0.01, range=0..0.01),
    Rotations=Slider(233, range=0..1000),
    Iterations=Slider(9, range=0..10),
    Seed=1,
    Reset=Toggle(True),
    Run=Toggle(True))  # -> Sheets, Geo, ID, Transform, IDS
unit_z_2 = UnitZ(Factor=Slider(50, range=0..100))

brep = Brep([<brep referenced from the Rhino model> x59])

# ----
# VISUALIZATIUON
#  ENVIRONMENT
area_2 = Area(Geometry=brep)  # -> Area, Centroid
distance_2 = Distance(PointA=point, PointB=area_2.Centroid)
sort_list_2 = SortList(Keys=distance_2, ValuesValuesA=brep)  # -> Keys, ValuesValuesA
brep_2 = Brep([<brep referenced from the Rhino model> x59])
panel_3 = Panel("""LOTE 12
LOTE 24
LOTE 24
LOTE A
LOTE 7
LOTE 8
LOTE 52
LOTE 35
LOTE 31-B
LOTE 20
LOTE 33
LOTE 34
LOTE 37
LOTE 21
LOTE 32
LOTE 16
LOTE 28
LOTE 27
LOTE R
LOTE R
LOTE 17
LOTE 18
LOTE 9
LOTE 13
LOTE 26
LOTE 15
LOTE 23 
LOTE 23
LOTE 14
LOTE 25
LOTE B
LOTE 3-5
LOTE 6
LOTE 10
LOTE 2
LOTE 11
LOTE 51
LOTE 31-A
LOTE 22
LOTE 38
LOTE 36
LOTE 39
LOTE 40
LOTE D
LOTE 41
LOTE 49
LOTE 53
LOTE 50
LOTE 30 
LOTE E
LOTE 46
LOTE 47
LOTE 48
LOTE 44
LOTE 43
LOTE 45
LOTE 42
LOTE 29
LOTE 29-A
C.S.A.G""")
area_3 = Area(Geometry=brep_2)  # -> Area, graft(Centroid)
graft_tree = GraftTree(Tree=panel_3, IncludeEmptyLists=True, IncludeNullItems=True)
text_tag = TextTag(Location=area_3.Centroid, Text=graft_tree, Colour=ColourSwatch(SwatchColor=RGB(0, 0, 0)))

list_length_4 = ListLength(List=sort_list_2.ValuesValuesA)
series_3 = Series(Start=0, Step=1, Count=list_length_4)
list_item_2 = ListItem(List=sort_list_2.ValuesValuesA, Index=series_3, Wrap=True)
list_item_3 = ListItem(List=sort_list_2.ValuesValuesA, Index=lote, Wrap=True)
item_index = ItemIndex(List=sort_list_2.ValuesValuesA, Item=list_item_2)
item_index_2 = ItemIndex(List=sort_list_2.ValuesValuesA, Item=list_item_3)
equality_2 = Equality(FirstNumber=item_index_2, SecondNumber=item_index)  # -> Equality, Inequality
dispatch = Dispatch(List=sort_list_2.ValuesValuesA, DispatchPattern=equality_2.Equality)  # -> ListA, ListB
blindfold = Blindfold(Refresh=Button(), Visibility=Toggle(False), Limited=dispatch.ListB)
blindfold_2 = Blindfold(Refresh=Button(), Visibility=Toggle(True), Limited=list_item_3)

area_4 = Area(Geometry=list_item_3)  # -> Area, Centroid
ghpython_script_3 = GhPythonScript(Area=area_4.Area, B=insert_items, C=integer)  # -> out, edif_a, edif_b, edif_c, edif_d, edif_e; inputs B: list, C: Int32
# ---------- ghpython_script_3: Python ----------
"""Provides a scripting component.
    Inputs:
        x:
        y:
    Output:
        a: The a output variable"""

__author__ = "Sergio"
__version__ = "2019.03.28"
import sys
import math

sys.path.append( "Z:\Shared\PRODUCCION\TALLER PROGRAMACION\RZM LATIZ PROTOTYPE\LIBRERIAS_PY\CLASSES")
from HYBRID_CLASS import *
from LOTE_CLASS import*


# Objects
edif_A = Edificio("A",400,4,20,20,100,B[0])
edif_B = Edificio("B",576,4,12,48,144,B[1])
edif_C = Edificio("C",864,6,12,72,144,B[2])
edif_D =Edificio("D",1200,8,24,48,147,B[3])
edif_E = Edificio("E",1600,12,24,72,133,B[4])
lote_gen = Lote("GENERIC","C.U",C,15,75,Area,0.50,0.25,0.25)


#Inputs
num_max_vivedif=0
num_vivmax = lote_gen.max_viv
niveles_max = lote_gen.max_niv
""""///////////////////////////////////////////////////////////////////////////////////////////"""
#EDIF_A

# Data edif_A
num_max_vivedif = round(edif_A.prior * num_vivmax / 100)
viv_init = edif_A.dptos
niv_tedif = round(num_max_vivedif / viv_init)

#Bounds
if niv_tedif > niveles_max:
            edif_A_count = niv_tedif / niveles_max
else:
            edif_A_count = 1
            
edif_A_count = math.ceil(edif_A_count)
edif_A.niveles = round(niv_tedif / edif_A_count)
n=0
while edif_A.niveles %2 ==0:
    n+=1
    edif_A.niveles = edif_A.niveles+n
else:
    edif_A.niveles = edif_A.niveles

#Data extraction
lst_a=[edif_A.type,edif_A.huella, edif_A.dptos,edif_A.ancho, edif_A.largo,edif_A_count
,edif_A.niveles]
edif_a=lst_a

"""""///////////////////////////////////////////////////////////////////////////////////////////////"""

#EDIF_B

# DATA edif_B
num_max_vivedif = round(edif_B.prior * num_vivmax / 100)
viv_init = edif_B.dptos
niv_tedif = round(num_max_vivedif / viv_init)

#Bounds
if niv_tedif > niveles_max:
            edif_B_count = niv_tedif / niveles_max
else:
            edif_B_count = 1
            
edif_B_count = math.ceil(edif_B_count)
edif_B.niveles = round(niv_tedif / edif_B_count)
n=0
while edif_B.niveles %2 ==0:
    n+=1
    edif_B.niveles = edif_B.niveles+n
else:
    edif_B.niveles = edif_B.niveles
#Data Extraction
lst_B=[edif_B.type,edif_B.huella, edif_B.dptos,edif_B.ancho, edif_B.largo,edif_B_count
,edif_B.niveles]
edif_b=lst_B

""""////////////////////////////////////////////////////////////////////////////////////////////"""
#EDIF_C

# DATA edif_C
num_max_vivedif = round(edif_C.prior * num_vivmax / 100)
viv_init = edif_C.dptos
niv_tedif = round(num_max_vivedif / viv_init)

#Bounds
if niv_tedif > niveles_max:
            edif_C_count = niv_tedif / niveles_max
else:
            edif_C_count = 1
            
edif_C_count = math.ceil(edif_C_count)
edif_C.niveles = round(niv_tedif / edif_C_count)
n=0
while edif_C.niveles %2 ==0:
    n+=1
    edif_C.niveles = edif_C.niveles+n
else:
    edif_C.niveles = edif_C.niveles
#Data Extraction
lst_C=[edif_C.type,edif_C.huella, edif_C.dptos,edif_C.ancho, edif_C.largo,edif_C_count
,edif_C.niveles]
edif_c=lst_C

""""////////////////////////////////////////////////////////////////////////////////////////////"""
#EDIF_D

# DATA edif_D
num_max_vivedif = round(edif_D.prior * num_vivmax / 100)
viv_init = edif_D.dptos
niv_tedif = round(num_max_vivedif / viv_init)
#Bounds
if niv_tedif > niveles_max:
            edif_D_count = niv_tedif / niveles_max
else:
            edif_D_count =1
            
edif_D_count = math.ceil(edif_D_count)
edif_D.niveles = round(niv_tedif / edif_D_count)
n=0
while edif_D.niveles %2 ==0:
    n+=1
    edif_D.niveles = edif_D.niveles+n
else:
    edif_D.niveles = edif_D.niveles
#Data Extraction
lst_D=[edif_D.type,edif_D.huella, edif_D.dptos,edif_D.ancho, edif_D.largo,edif_D_count
,edif_D.niveles]
edif_d=lst_D

""""////////////////////////////////////////////////////////////////////////////////////////////"""
#EDIF_E


# DATA edif_E
num_max_vivedif = round(edif_E.prior * num_vivmax / 100)
viv_init = edif_E.dptos
niv_tedif = round(num_max_vivedif / viv_init)
#Bounds
if niv_tedif > niveles_max:
            edif_E_count = niv_tedif / niveles_max
else:
            edif_E_count =1
            
edif_E_count = math.ceil(edif_E_count)
edif_E.niveles = round(niv_tedif / edif_E_count)
n=0
while edif_E.niveles %2 ==0:
    n+=1
    edif_E.niveles = edif_E.niveles+n
else:
    edif_E.niveles = edif_E.niveles

#Data edifi_E
lst_E=[edif_E.type,edif_E.huella, edif_E.dptos,edif_E.ancho, edif_E.largo,edif_E_count
,edif_E.niveles]
edif_e=lst_E
# ---------- end ghpython_script_3 ----------
entwine = Entwine(
    Branch00=ghpython_script_3.edif_a,
    Branch01=ghpython_script_3.edif_b,
    Branch02=ghpython_script_3.edif_c,
    Branch03=ghpython_script_3.edif_d,
    Branch04=ghpython_script_3.edif_e,
    FlattenInputs=True)
list_item_4 = ListItem(List=entwine, Index=Slider(6, range=0..10), Wrap=True)  # -> flatten(Item)
list_item_5 = ListItem(List=entwine, Index=Slider(4, range=0..10), Wrap=True)  # -> flatten(Item1), flatten(Item)
equality_3 = Equality(FirstNumber=list_item_4, SecondNumber=Slider(1, range=0..1))  # -> Equality, Inequality
list_item_6 = ListItem(List=list_item_5.Item, Index=ghpython_script.b, Wrap=True)
list_item_7 = ListItem(List=list_item_5.Item1, Index=ghpython_script.b, Wrap=True)
dispatch_2 = Dispatch(List=list_item_4, DispatchPattern=equality_3.Equality)  # -> ListA, ListB
division = Division(A=list_item_6, B=2)
division_2 = Division(A=list_item_7, B=2)
center_box = CenterBox(Base=xy_plane, X=division_2, Y=division, Z=1)
brep_wireframe_2 = BrepWireframe(Brep=center_box, Density=-1)

# ----
# TOPOGRAPHY MESH ANALYSIS
# ANALYSIS
# BREP MESH
number_slider_2 = Slider(1.17, range=0..10)
settings_custom = SettingsCustom(
    StitchSeams=True,
    SimplePlanes=False,
    Refine=True,
    MinCount=16,
    MaxCount=400,
    AspectRatio=20,
    MaxDistance=0,
    MaxAngle=20,
    MinEdge=number_slider_2,
    MaxEdge=number_slider_2)
mesh_brep = MeshBrep(Brep=list_item_3, Settings=settings_custom)
mcomp = Decompose(Mesh=mesh_brep)  # -> Vertices, Faces, Colours, Normals
vcomp = Decompose(Vector=mcomp.Normals)  # -> XComponent, YComponent, ZComponent
expression = Expression(z=vcomp.ZComponent, Expression="Deg(0.0 - (Asin(Abs(z)) - 0.5*π))")
gradient = Gradient(
    LowerLimit=0,
    UpperLimit=90,
    Parameter=expression,
    stops=[0: RGB(101, 153, 5), 0: RGB(0, 128, 0), 0.441: RGB(240, 172, 36), 0.864: RGB(255, 0, 0)])
mesh = Mesh(Vertices=mcomp.Vertices, Faces=mcomp.Faces, Colours=gradient)
pi = Pi(Factor=Slider(0.34, range=0..0.5))
xy_plane_2 = XYPlane(Origin=Point(0, 0, 0))
rotate_plane = RotatePlane(Plane=xy_plane_2, Angle=pi)
bounding_box = BoundingBox(Content=mesh, Plane=rotate_plane)  # -> Box, Box_2
deconstruct_brep = DeconstructBrep(Brep=bounding_box.Box)  # -> Faces, Edges, Vertices
list_item_8 = ListItem(List=deconstruct_brep.Faces, Index="4", Wrap=True)
dimensions = Dimensions(Surface=list_item_8)  # -> UDimension, VDimension
division_3 = Division(A=dimensions.VDimension, B=reticula_grid)
division_4 = Division(A=dimensions.UDimension, B=reticula_grid)
integer_2 = Integer(division_3)
integer_3 = Integer(division_4)
quad_panels = QuadPanels(Surface=list_item_8, UDivisions=integer_3, VDivisions=integer_2)
area_5 = Area(Geometry=quad_panels)  # -> Area, Centroid

unit_z_3 = UnitZ(Factor=1)
project_point = ProjectPoint(Point=area_5.Centroid, Direction=unit_z_3, Geometry=mesh)  # -> Point, Index

null_item = NullItem(Item=project_point.Point)  # -> NullFlags, InvalidFlags, Description
dispatch_3 = Dispatch(List=project_point.Point, DispatchPattern=null_item.NullFlags)  # -> ListA, ListB
mesh_closest_point = MeshClosestPoint(Point=dispatch_3.ListB, Mesh=mesh)  # -> Point, Index, Parameter
mesh_eval = MeshEval(Mesh=mesh, Parameter=mesh_closest_point.Parameter)  # -> Point, Normal, Colour
vcomp_2 = Decompose(Vector=mesh_eval.Normal)  # -> XComponent, YComponent, ZComponent
expression_2 = Expression(z=vcomp_2.ZComponent, Expression="Deg(0.0 - (Asin(Abs(z)) - 0.5*π))")
smaller_than = SmallerThan(FirstNumber=expression_2, SecondNumber=angle_range)  # -> SmallerThan, OrEqualTo
dispatch_4 = Dispatch(List=mesh_eval.Point, DispatchPattern=smaller_than.SmallerThan)  # -> ListA, ListB
point_groups = PointGroups(Points=dispatch_4.ListA, Distance=random_seed)  # -> Groups, Indices

# ----
# POINT MATRIX IN BOUNDS
boolean_toggle = BooleanToggle(True)
flatten_tree = FlattenTree(Tree=point_groups.Groups, Path="{0}")
point_in_brep = PointInBrep(Brep=extrude, Point=flatten_tree, Strict=boolean_toggle)

# ----
# POINT MATRIX
dispatch_5 = Dispatch(List=flatten_tree, DispatchPattern=point_in_brep)  # -> ListA, ListB
point_2 = Point(dispatch_5.ListA)
cloud_display = CloudDisplay(Points=point_2, Colours=ColourSwatch(SwatchColor=RGB(255, 255, 255)), Size=Slider(2.39, range=0..10), SpriteType=0)

convex_hull = ConvexHull(Points=point_2, Plane=PlaneXY(0, 0, 0))  # -> Hull, HullZ, Indices
extrude_2 = Extrude(Base=convex_hull.HullZ, Direction=unit_z_2)
