# Grasshopper definition 2.5.1.0Alpha_Latiz Hypaar.gh (Grasshopper 1.0.4)
# plug-ins: ProvingGround.Conduit, Pufferfish, Blindfold, OpenNest, Biomorpher, Wallacei

# ----
# TOPOGRAPHY MESH PANEL
lote = Slider(0, range=0..100)
reticula_grid = Slider(7, range=1..15)
angle_range = Slider(20, range=1..30)
distance_point_groups = Slider(22, range=1..55)
rotación_grid = Slider(0.12, range=0..0.5)
layout_cell_radius = Slider(35, range=15..50)
limite_layout = Slider(0.6, range=0..1)
lados_poligono = Slider(12, range=0..60)

# ----
# MAIN INTERACTOR INPUTS
# (EDIF_SELECTION & PRIOR)
gene_pool = GenePool(Decimals=1, Maximum=30, Minimum=-15, Value=[27.97905909, -0.570008294, 11.71572364, 13.77815772, -0.5714139182])
wlc_01prior = GenePool(Decimals=0, Maximum=100, Minimum=0, Value=[43.60980715, 50.32313436, 29.03225256, 27.51387657, 54.64195952, 86.61653306])
random_seed = Slider(0, range=0..10)
separacion_edif = Slider(17, range=10..50)
cut = Slider(-13, range=-50..20)
rotacion = Slider(45, range=0..360)
wlc_edifswitch = GenePool(Decimals=0, Maximum=1, Minimum=0, Value=[0.1502212752, 0.7058500642, 0.9822859722, 0.1293218965, 0.03169946327])

nivoficinas = Slider(2, range=0..10)
nivcomercio = Slider(0, range=0..10)
ssviv = Slider(120, range=50..500)
integer = Integer(nivoficinas)
integer_2 = Integer(nivcomercio)
integer_3 = Integer(ssviv)

colour_swatch = ColourSwatch(SwatchColor=RGB(217, 217, 217))
create_material = CreateMaterial(
    Diffuse=ColourSwatch(SwatchColor=RGB(8, 8, 8)),
    Specular=colour_swatch,
    Emission=colour_swatch,
    Transparency=Slider(0.716, range=0..1),
    Shine=0)
unit_z = UnitZ(Factor=Slider(0.5, range=0..1))
comercial_income_m2 = Panel("57000")
number = Number(comercial_income_m2)
curve = Curve(<curve referenced from the Rhino model>)
colour_swatch_2 = ColourSwatch(SwatchColor=RGB(243, 255, 255))
curve_2 = Curve(<curve referenced from the Rhino model>)
curve_3 = Curve(curve_2)
point = Point(Point(11.73649984, -303.2999099, 0))
unit_x = UnitX(Factor=Slider(-18.513, range=-100..10))
move = Move(Geometry=point, Motion=unit_x)  # -> Geometry, Transform
get_viewport_boundary_dimensions = GetViewportBoundaryDimensions(Refresh=Button(), Origin=move.Geometry, Scale=Slider(0.243, range=0..1))
number_slider = Slider(5, range=0..10)
galapagos = Galapagos(fitness=wlc__profit, gene=[wlc_01prior, wlc_edifswitch])

brep = Brep([<brep referenced from the Rhino model> x59])

# ----
# VISUALIZATION
#  ENVIRONMENT
area = Area(Geometry=brep)  # -> Area, Centroid
sort_list = SortList(Keys=area.Area, ValuesValuesA=brep)  # -> Keys, ValuesValuesA
reverse_list = ReverseList(List=sort_list.ValuesValuesA)
panel = Panel("""LOTE 12
LOTE 24
LOTE 24
LOTE A
LOTE 7
LOTE 8
LOTE 52
LOTE 35
LOTE 31-B
LOTE 20
LOTE 33
LOTE 34
LOTE 37
LOTE 21
LOTE 32
LOTE 16
LOTE 28
LOTE 27
LOTE R
LOTE R
LOTE 17
LOTE 18
LOTE 9
LOTE 13
LOTE 26
LOTE 15
LOTE 23 
LOTE 23
LOTE 14
LOTE 25
LOTE B
LOTE 3-5
LOTE 6
LOTE 10
LOTE 2
LOTE 11
LOTE 51
LOTE 31-A
LOTE 22
LOTE 38
LOTE 36
LOTE 39
LOTE 40
LOTE D
LOTE 41
LOTE 49
LOTE 53
LOTE 50
LOTE 30 
LOTE E
LOTE 46
LOTE 47
LOTE 48
LOTE 44
LOTE 43
LOTE 45
LOTE 42
LOTE 29
LOTE 29-A
C.S.A.G""")
brep_2 = Brep([<brep referenced from the Rhino model> x59])
area_2 = Area(Geometry=brep_2)  # -> Area, graft(Centroid)
graft_tree = GraftTree(Tree=panel, IncludeEmptyLists=True, IncludeNullItems=True)
text_tag = TextTag(Location=area_2.Centroid, Text=graft_tree, Colour=ColourSwatch(SwatchColor=RGB(0, 0, 0)))

list_length = ListLength(List=reverse_list)
series = Series(Start=0, Step=1, Count=list_length)
list_item = ListItem(List=reverse_list, Index=series, Wrap=True)
list_item_2 = ListItem(List=reverse_list, Index=lote, Wrap=True)
item_index = ItemIndex(List=reverse_list, Item=list_item)
item_index_2 = ItemIndex(List=reverse_list, Item=list_item_2)
equality = Equality(FirstNumber=item_index_2, SecondNumber=item_index)  # -> Equality, Inequality
dispatch = Dispatch(List=reverse_list, DispatchPattern=equality.Equality)  # -> ListA, ListB
blindfold = Blindfold(Refresh=Button(), Visibility=Toggle(True), Limited=list_item_2)
blindfold_2 = Blindfold(Refresh=Button(), Visibility=Toggle(False), Limited=dispatch.ListB)

brep_3 = Brep(list_item_2)

# ----
# TOPOGRAPHY
# MESH ANALYSIS
cluster = Cluster(
    brep=list_item_2,
    factor=rotación_grid,
    B_2=reticula_grid,
    B=reticula_grid,
    second_number=angle_range,
    distance=distance_point_groups)  # -> mesh_2, groups
mesh = Mesh(cluster.mesh_2)
cloud_display = CloudDisplay(Points=cluster.groups, Colours=ColourSwatch(SwatchColor=RGB(255, 255, 255)), Size=1, SpriteType=0)

# ----
# TRIANGULATE NEW
# BOUNDARY POLYGON
voronoi = Voronoi(Points=cluster.groups, Radius=layout_cell_radius, BruteForceOverride=False)
number_slider_2 = Slider(10, range=0..10)
boundary_surfaces = BoundarySurfaces(Edges=voronoi)
settings_custom = SettingsCustom(
    StitchSeams=True,
    SimplePlanes=False,
    Refine=True,
    MinCount=10,
    MaxCount=400,
    AspectRatio=20,
    MaxDistance=0,
    MaxAngle=20,
    MinEdge=number_slider_2,
    MaxEdge=number_slider_2)
brep_join = BrepJoin(Breps=boundary_surfaces)  # -> Breps, Closed
mesh_brep = MeshBrep(Brep=brep_join.Breps, Settings=settings_custom)
mesh_edges = MeshEdges(Mesh=mesh_brep)  # -> flatten(NakedEdges), InteriorEdges, NonManifoldEdges
join_curves = JoinCurves(Curves=mesh_edges.NakedEdges, Preserve=False)
length = Length(Curve=join_curves)
sort_list_2 = SortList(Keys=flatten(length), ValuesValuesA=flatten(join_curves))  # -> Keys, ValuesValuesA
reverse_list_2 = ReverseList(List=sort_list_2.ValuesValuesA)
list_item_3 = ListItem(List=reverse_list_2, Index=0, Wrap=True)
boundary_surfaces_2 = BoundarySurfaces(Edges=list_item_3)
area_3 = Area(Geometry=boundary_surfaces_2)  # -> Area, Centroid
scale = Scale(Geometry=list_item_3, Center=area_3.Centroid, Factor=limite_layout)  # -> Geometry, Transform
divide_curve = DivideCurve(Curve=scale.Geometry, Count=lados_poligono, Kinks=False)  # -> Points, Tangents, Parameters
polyline = PolyLine(Vertices=divide_curve.Points, Closed=True)

# ----
# OBJECT PROPERTIES & PYHTON SCRIPT
number_slider_3 = Slider(0, range=0..100)
list_length_2 = ListLength(List=wlc_edifswitch)
series_2 = Series(Start=0, Step=1, Count=list_length_2)
merge = Merge(Data1=wlc_edifswitch, Data2=number_slider_3)
ghpython_script = GhPythonScript(x=merge, y=flatten(wlc_01prior))  # -> out, prior, indexes; inputs x: list of Int32, y: list of Int32
# ---------- ghpython_script: Python ----------
"""Provides a scripting component.
    Inputs:
        x:
        y:
    Output:
        a: The a output variable"""

__author__ = "Sergio"
__version__ = "2019.03.28"

import math as math

lista = zip(x,y)
a=[]

for edifs,priors in lista:
    if edifs == 1:
        a.append(priors)
        
        print(True)
    else:
        a.append(0)
        prior=a
        print(False)

lst = range(0,6,1)
listazip = zip(lst,x)

index = []
for nums,apriors in listazip:
    if apriors == 1:
        index.append(nums)
    else:
        pass
        indexes = index
# ---------- end ghpython_script ----------
list_item_4 = ListItem(List=ghpython_script.prior, Index=series_2, Wrap=True)
area_4 = Area(Geometry=list_item_2)  # -> Area, Centroid
ghpython_script_2 = GhPythonScript(Area=area_4.Area, mask=ghpython_script.indexes, B=list_item_4, C=integer_3, x=integer_2, y=integer)  # -> out, edif_a, edif_b, edif_c, edif_d, edif_e, D; inputs mask: list of Int32, B: list, C: Int32
# ---------- ghpython_script_2: Python ----------
"""Provides a scripting component.
    Inputs:
        x:
        y:
    Output:
        a: The a output variable"""

__author__ = "Sergio"
__version__ = "2019.03.28"
import sys
import math

sys.path.append( "Z:\Shared\PRODUCCION\TALLER PROGRAMACION\RZM LATIZ PROTOTYPE\LIBRERIAS_PY\CLASSES")
from HYBRID_CLASS import *
from LOTE_CLASS import*



V = sum(B)
v2 =[]
for i in B:
    a=round((i/V)*100)
    v2.append(a)
prior=v2

# Objects
edif_A = Edificio("A",400,4,20,20,100,v2[0])
edif_B = Edificio("B",576,4,12,48,144,v2[1])
edif_C = Edificio("C",864,6,12,72,144,v2[2])
edif_D =Edificio("D",1152,8,24,48,147,v2[3])
edif_E = Edificio("E",1728,12,24,72,133,v2[4])

lote_gen = Lote("GENERIC","C.U",C,15,75,Area,0.50,0.25,0.25)


output_d = (edif_A.huella,edif_B.huella,edif_C.huella,edif_D.huella,edif_E.huella)
D = output_d

#Inputs

niveles_max = lote_gen.max_niv
num_vivmax = lote_gen.max_viv
num_max_vivedif=0



# CODE

for i in mask:
    if i == 0:
        #math
        num_max_vivedif = round(edif_A.prior*num_vivmax/100)
        num_max_comer = round(edif_A.prior*x/100)
        num_max_ofi = round(edif_A.prior*y/100)
        viv_init = edif_A.dptos
        niv_tedif = round(num_max_vivedif / viv_init)
        sum_modules = (num_max_comer +num_max_ofi +niv_tedif)



        if sum_modules > niveles_max :
            edif_A.count = sum_modules / niveles_max
        else:
            edif_A.count = 1

        edif_A.count = math.ceil(edif_A.count)

        edif_A.niveles = round(niv_tedif/ edif_A.count)
        edif_A.niveles_com = round(num_max_comer /edif_A.count)
        edif_A.niveles_of = round(num_max_ofi / edif_A.count)

        edif_A.dptos = edif_A.niveles * viv_init
        edif_A.areacons = edif_A.huella * edif_A.niveles
       
        
        output_A = (edif_A.type,edif_A.count,edif_A.dptos,edif_A.niveles,edif_A.niveles_com,edif_A.niveles_of ,edif_A.areacons,edif_A.largo,edif_A.ancho,edif_A.huella)
        edif_a=output_A
        
    elif i == 1:
        num_max_vivedif = round(edif_B.prior*num_vivmax/100)
        num_max_comer = round(edif_B.prior*x/100)
        num_max_ofi = round(edif_B.prior*y/100)
        viv_init = edif_B.dptos
        niv_tedif = round(num_max_vivedif / viv_init)
        sum_modules = (num_max_comer +num_max_ofi +niv_tedif)
        
        if sum_modules > niveles_max:
            edif_B.count = sum_modules  / niveles_max
        else:
            edif_B.count = 1
            
        edif_B.count = math.ceil(edif_B.count)
        edif_B.niveles = round(niv_tedif/ edif_B.count)
        edif_B.niveles_com = round(num_max_comer /edif_B.count)
        edif_B.niveles_of = round(num_max_ofi / edif_B.count)
        edif_B.dptos = edif_B.niveles * viv_init
        edif_B.areacons = edif_B.huella * edif_B.niveles
        
        output_B= (edif_B.type,edif_B.count,edif_B.dptos,edif_B.niveles,edif_B.niveles_com,edif_B.niveles_of ,edif_B.areacons,edif_B.largo,edif_B.ancho,edif_B.huella)

        edif_b = output_B
        
    elif i == 2:
        num_max_vivedif = round(edif_C.prior*num_vivmax/100)
        num_max_comer = round(edif_C.prior*x/100)
        num_max_ofi = round(edif_C.prior*y/100)
        viv_init = edif_C.dptos
        niv_tedif = round(num_max_vivedif / viv_init)
        sum_modules = (num_max_comer +num_max_ofi +niv_tedif)
        
        if sum_modules > niveles_max:
            edif_C.count = sum_modules  / niveles_max
        else:
            edif_C.count = 1
            
        edif_C.count = math.ceil(edif_C.count)
        edif_C.niveles = round(niv_tedif/ edif_C.count)
        edif_C.niveles_com = round(num_max_comer /edif_C.count)
        edif_C.niveles_of = round(num_max_ofi / edif_C.count)
        edif_C.dptos = edif_C.niveles * viv_init
        edif_C.areacons = edif_C.huella * edif_C.niveles
        
        output_C= (edif_C.type,edif_C.count,edif_C.dptos,edif_C.niveles,edif_C.niveles_com,edif_C.niveles_of ,edif_C.areacons,edif_C.largo,edif_C.ancho,edif_C.huella)

        edif_c = output_C
        
        
    elif i == 3:
        num_max_vivedif = round(edif_D.prior*num_vivmax/100)
        num_max_comer = round(edif_D.prior*x/100)
        num_max_ofi = round(edif_D.prior*y/100)
        viv_init = edif_D.dptos
        niv_tedif = round(num_max_vivedif / viv_init)
        sum_modules = (num_max_comer +num_max_ofi +niv_tedif)
        
        if sum_modules > niveles_max:
            edif_D.count = sum_modules  / niveles_max
        else:
            edif_D.count = 1
            
        edif_D.count = math.ceil(edif_D.count)
        edif_D.niveles = round(niv_tedif/ edif_D.count)
        edif_D.niveles_com = round(num_max_comer /edif_D.count)
        edif_D.niveles_of = round(num_max_ofi / edif_D.count)
        edif_D.dptos = edif_D.niveles * viv_init
        edif_D.areacons = edif_D.huella * edif_D.niveles
        
        output_D= (edif_D.type,edif_D.count,edif_D.dptos,edif_D.niveles,edif_D.niveles_com,edif_D.niveles_of ,edif_D.areacons,edif_D.largo,edif_D.ancho,edif_D.huella)

        edif_d = output_D
        
    elif i == 4:
        num_max_vivedif = round(edif_E.prior*num_vivmax/100)
        num_max_comer = round(edif_E.prior*x/100)
        num_max_ofi = round(edif_E.prior*y/100)
        viv_init = edif_E.dptos
        niv_tedif = round(num_max_vivedif / viv_init)
        sum_modules = (num_max_comer +num_max_ofi +niv_tedif)
        
        if sum_modules > niveles_max:
            edif_E.count = sum_modules  / niveles_max
        else:
            edif_E.count = 1
            
        edif_E.count = math.ceil(edif_E.count)
        edif_E.niveles = round(niv_tedif/ edif_E.count)
        edif_E.niveles_com = round(num_max_comer /edif_E.count)
        edif_E.niveles_of = round(num_max_ofi / edif_E.count)
        edif_E.dptos = edif_E.niveles * viv_init
        edif_E.areacons = edif_E.huella * edif_E.niveles
        
        output_E= (edif_E.type,edif_E.count,edif_E.dptos,edif_E.niveles,edif_E.niveles_com,edif_E.niveles_of ,edif_E.areacons,edif_E.largo,edif_E.ancho,edif_E.huella)

        edif_e = output_E
# ---------- end ghpython_script_2 ----------
entwine = Entwine(
    Branch00=ghpython_script_2.edif_a,
    Branch01=ghpython_script_2.edif_b,
    Branch02=ghpython_script_2.edif_c,
    Branch03=ghpython_script_2.edif_d,
    Branch04=ghpython_script_2.edif_e,
    FlattenInputs=True)
list_item_5 = ListItem(List=entwine, Index=0, Wrap=True)  # -> Item, Item1, Item2, Item3, Item4, Item5, Item6, Item7, Item8, Item9

# ----
# cajones*vivienda
repeat_data = RepeatData(Data=list_item_5.Item2, Length=list_item_5.Item1)
clean_tree = CleanTree(RemoveNulls=True, RemoveInvalid=True, RemoveEmpty=invert(False), Tree=repeat_data)
multiplication = Multiplication(A=clean_tree, B=Slider(3.5, range=0..10))

# ----
# 2D BOXES CREATION
area_5 = Area(Geometry=list_item_2)  # -> Area, Centroid
division = Division(A=list_item_5.Item7, B=2)
division_2 = Division(A=list_item_5.Item8, B=2)
repeat_data_2 = RepeatData(Data=division_2, Length=list_item_5.Item1)
repeat_data_3 = RepeatData(Data=division, Length=list_item_5.Item1)
repeat_data_4 = RepeatData(Data=area_5.Centroid, Length=list_item_5.Item1)
center_box = CenterBox(Base=repeat_data_4, X=repeat_data_3, Y=repeat_data_2, Z=0)
rectangle = Rectangle(center_box)
curve_4 = Curve(rectangle)
geometry = Geometry(flatten(curve_4))

# ----
# m2 reales Estacionamiento
number_slider_4 = Slider(0.2, range=0..1)
multiplication_2 = Multiplication(A=multiplication, B=Slider(5, range=0..10))
multiplication_3 = Multiplication(A=multiplication_2, B=number_slider_4)
addition = Addition(A=multiplication_2, B=multiplication_3)

# ----
# NUMERO DE NIVELES ESTACIONAMIENTO
repeat_data_5 = RepeatData(Data=list_item_5.Item9, Length=list_item_5.Item1)
clean_tree_2 = CleanTree(RemoveNulls=True, RemoveInvalid=True, RemoveEmpty=False, Tree=repeat_data_5)
division_3 = Division(A=addition, B=clean_tree_2)
round = Round(Number=division_3)  # -> Nearest, Floor, Ceiling

# ----
# LAYOUT 2D SOLVER
curve_5 = Curve(polyline)
opennest = OpenNest(
    Sheets=curve_5,
    Geo=geometry,
    Spacing=separacion_edif,
    Placement=1,
    Tolerance=0.1,
    Rotations=rotacion,
    Iterations=5,
    Seed=random_seed,
    Reset=True,
    Run=True)  # -> Sheets, Geo, ID, flatten(Transform), IDS
cluster_2 = Cluster_2(curve=opennest.Geo, integer=ghpython_script_2.D)  # -> list_a, list_a_2, list_a_3, list_a_4, list_a_5, integer_4
entwine_2 = Entwine(
    Branch00=cluster_2.list_a,
    Branch01=cluster_2.list_a_2,
    Branch02=cluster_2.list_a_3,
    Branch03=cluster_2.list_a_4,
    Branch04=cluster_2.list_a_5,
    FlattenInputs=True)

# ----
# FLOORPLAN
deconstruct = Deconstruct(Point=area_4.Centroid)  # -> XComponent, YComponent, ZComponent
vector_xyz = VectorXYZ(XComponent=0, YComponent=0, ZComponent=deconstruct.ZComponent)  # -> Vector, Length
repeat_data_6 = RepeatData(Data=vector_xyz.Vector, Length=list_item_5.Item1)
move_2 = Move(Geometry=entwine_2, Motion=repeat_data_6)  # -> Geometry, Transform

# ----
# HEIGHT DISPLAY
graft_tree_2 = GraftTree(Tree=gene_pool, IncludeEmptyLists=True, IncludeNullItems=True)
repeat_data_7 = RepeatData(Data=graft_tree_2, Length=list_item_5.Item1)
unit_z_2 = UnitZ(Factor=repeat_data_7)
move_3 = Move(Geometry=move_2.Geometry, Motion=unit_z_2)  # -> Geometry, Transform
graft_tree_3 = GraftTree(Tree=move_3.Geometry, IncludeEmptyLists=True, IncludeNullItems=True)
area_6 = Area(Geometry=graft_tree_3)  # -> flatten(Area), flatten(Centroid)

colour_picker = ColourPicker(PickedColour=RGB(40, 163, 94))
colour = Colour(colour_picker)
colour_swatch_3 = ColourSwatch(SwatchColor=RGB(17, 79, 52))
create_material_2 = CreateMaterial(
    Diffuse=colour,
    Specular=colour_swatch_3,
    Emission=colour_swatch_3,
    Transparency=Slider(0.083, range=0..1),
    Shine=Slider(0, range=0..1))
custom_preview = CustomPreview(Geometry=list_item, Material=create_material_2)

boundary_surfaces_3 = BoundarySurfaces(Edges=flatten(graft_tree_3))
# OUTPUTS
mesh_brep_2 = MeshBrep(
    Brep=boundary_surfaces_3,
    Settings={GridMaxCount=0, GridMinCount=16, JaggedSeams=False, MaxEdgeLength=0, MinEdgeLength=0.0001, MinTolerance=0, Refine=True, RefineAngle=0, RelativeTolerance=0.65, SimplePlanes=True, Tolerance=0})
area_7 = Area(Geometry=mesh_brep_2)  # -> flatten(Area), flatten(Centroid)
clean_tree_3 = CleanTree(RemoveNulls=True, RemoveInvalid=invert(True), RemoveEmpty=invert(False), Tree=area_7.Area)
number_2 = Number(clean_tree_3)
ghpython_script_3 = GhPythonScript(SUM=number_2)  # -> out, a; inputs SUM: list
# ---------- ghpython_script_3: Python ----------
"""Provides a scripting component.
    Inputs:
        x:
        y:
    Output:
        a: The a output variable"""

__author__ = "Sergio"
__version__ = "2019.03.28"

import math as math
ab=[]
for num in SUM:
    ab.append(num)
    lst = (math.fsum(ab))
    a=lst
# ---------- end ghpython_script_3 ----------

# ----
# PARKING LOT FLOORS
number_slider_5 = Slider(-3, range=-3..10)
series_3 = Series(Start=-3, Step=number_slider_5, Count=flatten(round.Ceiling))
flatten_tree = FlattenTree(Tree=move_3.Geometry, Path="{0}")
unit_z_3 = UnitZ(Factor=series_3)
graft_tree_4 = GraftTree(Tree=flatten_tree, IncludeEmptyLists=True, IncludeNullItems=True)
move_4 = Move(Geometry=graft_tree_4, Motion=unit_z_3)  # -> Geometry, Transform
last_index = LastIndex(List=move_4.Geometry)
list_item_6 = ListItem(List=move_4.Geometry, Index=last_index, Wrap=True)
boundary_surfaces_4 = BoundarySurfaces(Edges=flatten(list_item_6))
colour_swatch_4 = ColourSwatch(SwatchColor=RGB(54, 255, 144))

# ----
# CUT & FILL
flatten_tree_2 = FlattenTree(Tree=list_item_6, Path="{0}")
unit_z_4 = UnitZ(Factor=cut)
move_5 = Move(Geometry=flatten_tree_2, Motion=unit_z_4)  # -> Geometry, Transform
area_8 = Area(Geometry=flatten_tree_2)  # -> Area, Centroid
area_9 = Area(Geometry=move_5.Geometry)  # -> Area, Centroid
distance = Distance(PointA=area_8.Centroid, PointB=area_9.Centroid)
boundary_surfaces_5 = BoundarySurfaces(Edges=move_5.Geometry)
unit_z_5 = UnitZ(Factor=distance)
extrude = Extrude(Base=boundary_surfaces_5, Direction=unit_z_5)
brep_4 = Brep(extrude)

line = Line(StartPoint=area_6.Centroid, EndPoint=area_8.Centroid)
length_2 = Length(Curve=line)
unit_z_6 = UnitZ(Factor=length_2)
extrude_2 = Extrude(Base=boundary_surfaces_4, Direction=unit_z_6)
custom_preview_2 = CustomPreview(Geometry=extrude_2, Material=colour_swatch_4)

brep_5 = Brep(extrude_2)
brep_join_2 = BrepJoin(Breps=[brep_5, brep_4])  # -> flatten(Breps), Closed
solid_union = SolidUnion(Breps=flatten(brep_join_2.Breps))
split_brep = SplitBrep(Brep=solid_union, Cutter=list_item_2)
list_item_7 = ListItem(List=split_brep, Index=0, Wrap=True)  # -> Item, Item1
brep_brep = BrepBrep(BrepA=list_item_7.Item, BrepB=list_item_2)  # -> flatten(Curves), Points
fragment_patch = FragmentPatch(Boundary=brep_brep.Curves)
brep_6 = Brep(fragment_patch)

# ----
# CUT VOLUME & AREA
# FILL VOLUME & AREA
colour_swatch_5 = ColourSwatch(SwatchColor=RGB(214, 39, 0))
custom_preview_3 = CustomPreview(Geometry=list_item_7.Item, Material=colour_swatch_5)
custom_preview_4 = CustomPreview(Geometry=list_item_7.Item1, Material=ColourSwatch(SwatchColor=RGBA(0, 255, 255, 163)))
flatten_tree_3 = FlattenTree(Tree=list_item_7.Item, Path="{0}")
brep_join_3 = BrepJoin(Breps=[flatten_tree_3, brep_6])  # -> Breps, Closed
flatten_tree_4 = FlattenTree(Tree=list_item_7.Item1, Path="{0}")
brep_join_4 = BrepJoin(Breps=[flatten_tree_4, brep_6])  # -> Breps, Closed

# ----
# UPPER BODY STRUCTURE
repeat_data_8 = RepeatData(Data=list_item_5.Item3, Length=list_item_5.Item1)
repeat_data_9 = RepeatData(Data=Slider(1, range=0..1), Length=list_item_5.Item1)
division_4 = Division(A=Slider(75, range=0..100), B=Slider(15, range=0..100))
addition_2 = Addition(A=repeat_data_8, B=repeat_data_9)

# ----
# COMERCIAL FLOORS
repeat_data_10 = RepeatData(Data=list_item_5.Item4, Length=list_item_5.Item1)
addition_3 = Addition(A=repeat_data_10, B=repeat_data_9)
series_4 = Series(Start=0, Step=division_4, Count=addition_3)
unit_z_7 = UnitZ(Factor=series_4)

last_index_2 = LastIndex(List=series_4)

list_item_8 = ListItem(List=series_4, Index=last_index_2, Wrap=True)
list_length_3 = ListLength(List=list_item_8)
subtraction = Subtraction(A=list_length_3, B=1)
multiplication_4 = Multiplication(A=subtraction, B=division_4)

series_5 = Series(Start=multiplication_4, Step=division_4, Count=addition_2)
unit_z_8 = UnitZ(Factor=series_5)

# ----
# UPPER BODY
#  BUILDINGS
graft_tree_5 = GraftTree(Tree=move_3.Geometry, IncludeEmptyLists=True, IncludeNullItems=True)
cluster_3 = Cluster_3(geometry=graft_tree_5, motion=unit_z_8)  # -> surfaces, geometry_2, extrusion, loft_2
cluster_4 = Cluster_3(geometry=graft_tree_5, motion=unit_z_7)  # -> surfaces, geometry_2, extrusion, loft_2
custom_preview_5 = CustomPreview(Geometry=cluster_3.extrusion, Material=ColourSwatch(SwatchColor=RGBA(227, 45, 157, 213)))
custom_preview_6 = CustomPreview(Material=ColourSwatch(SwatchColor=RGBA(227, 255, 157, 213)))

custom_preview_7 = CustomPreview(Geometry=[cluster_3.loft_2, cluster_4.loft_2], Material=create_material)
move_6 = Move(Geometry=cluster_4.extrusion, Motion=unit_z)  # -> Geometry, Transform

mesh_brep_3 = MeshBrep(
    Brep=cluster_3.loft_2,
    Settings={GridMaxCount=0, GridMinCount=16, JaggedSeams=False, MaxEdgeLength=0, MinEdgeLength=0.0001, MinTolerance=0, Refine=True, RefineAngle=0, RelativeTolerance=0.65, SimplePlanes=True, Tolerance=0})
mesh_brep_4 = MeshBrep(
    Brep=extrude_2,
    Settings={GridMaxCount=0, GridMinCount=16, JaggedSeams=False, MaxEdgeLength=0, MinEdgeLength=0.0001, MinTolerance=0, Refine=True, RefineAngle=0, RelativeTolerance=0.65, SimplePlanes=True, Tolerance=0})
mesh_brep_5 = MeshBrep(
    Brep=cluster_4.extrusion,
    Settings={GridMaxCount=0, GridMinCount=16, JaggedSeams=False, MaxEdgeLength=0, MinEdgeLength=0.0001, MinTolerance=0, Refine=True, RefineAngle=0, RelativeTolerance=0.65, SimplePlanes=True, Tolerance=0})
mesh_brep_6 = MeshBrep(
    Brep=cluster_4.loft_2,
    Settings={GridMaxCount=0, GridMinCount=16, JaggedSeams=False, MaxEdgeLength=0, MinEdgeLength=0.0001, MinTolerance=0, Refine=True, RefineAngle=0, RelativeTolerance=0.65, SimplePlanes=True, Tolerance=0})

mesh_brep_7 = MeshBrep(
    Brep=cluster_3.surfaces,
    Settings={GridMaxCount=0, GridMinCount=16, JaggedSeams=False, MaxEdgeLength=0, MinEdgeLength=0.0001, MinTolerance=0, Refine=True, RefineAngle=0, RelativeTolerance=0.65, SimplePlanes=True, Tolerance=0})
mesh_brep_8 = MeshBrep(
    Brep=cluster_3.extrusion,
    Settings={GridMaxCount=0, GridMinCount=16, JaggedSeams=False, MaxEdgeLength=0, MinEdgeLength=0.0001, MinTolerance=0, Refine=True, RefineAngle=0, RelativeTolerance=0.65, SimplePlanes=True, Tolerance=0})
area_10 = Area(Geometry=flatten(mesh_brep_7))  # -> Area, Centroid
ghpython_script_4 = GhPythonScript(SUM=area_10.Area)  # -> out, a; inputs SUM: list; same code as ghpython_script_3

mesh_brep_9 = MeshBrep(
    Brep=cluster_4.surfaces,
    Settings={GridMaxCount=0, GridMinCount=16, JaggedSeams=False, MaxEdgeLength=0, MinEdgeLength=0.0001, MinTolerance=0, Refine=True, RefineAngle=0, RelativeTolerance=0.65, SimplePlanes=True, Tolerance=0})
construction_cost_m2 = Panel("63.770")
soft_cost = Panel("0.12")
parking_lot_m2_cost = Panel("72.50")
house_income_m2 = Panel("38585.0000")
area_11 = Area(Geometry=flatten(mesh_brep_9))  # -> Area, Centroid
fill_volume_cost_local = Panel("115.200")
fill_volume_cost_foreign = Panel("63.77")
cut_volume_cost = Panel("63.770")
area_12 = Area(Geometry=move_4.Geometry)  # -> flatten(Area), Centroid
flatten_tree_5 = FlattenTree(Tree=multiplication, Path="{0}")
flatten_tree_6 = FlattenTree(Tree=addition, Path="{0}")
flatten_tree_7 = FlattenTree(Tree=repeat_data, Path="{0}")
number_3 = Number(parking_lot_m2_cost)
number_4 = Number(soft_cost)
number_5 = Number(construction_cost_m2)
number_6 = Number(house_income_m2)
number_7 = Number(fill_volume_cost_local)
ghpython_script_5 = GhPythonScript(SUM=area_12.Area)  # -> out, a; inputs SUM: list; same code as ghpython_script_3
number_8 = Number(fill_volume_cost_foreign)
number_9 = Number(cut_volume_cost)
ghpython_script_6 = GhPythonScript(SUM=area_11.Area)  # -> out, a; inputs SUM: list; same code as ghpython_script_3
ghpython_script_7 = GhPythonScript(SUM=flatten_tree_6)  # -> out, a; inputs SUM: list; same code as ghpython_script_3
multiplication_5 = Multiplication(A=number_3, B=ghpython_script_7.a)
multiplication_6 = Multiplication(A=number_6, B=ghpython_script_4.a)
ghpython_script_8 = GhPythonScript(SUM=flatten_tree_5)  # -> out, a; inputs SUM: list; same code as ghpython_script_3
ghpython_script_9 = GhPythonScript(SUM=flatten_tree_7)  # -> out, a; inputs SUM: list; same code as ghpython_script_3
multiplication_7 = Multiplication(A=number_5, B=ghpython_script_4.a)
multiplication_8 = Multiplication(A=number_4, B=ghpython_script_4.a)

multiplication_9 = Multiplication(A=number, B=ghpython_script_6.a)

mesh_brep_10 = MeshBrep(
    Brep=brep_join_3.Breps,
    Settings={GridMaxCount=0, GridMinCount=16, JaggedSeams=False, MaxEdgeLength=0, MinEdgeLength=0.0001, MinTolerance=0, Refine=True, RefineAngle=0, RelativeTolerance=0.65, SimplePlanes=True, Tolerance=0})  # -> flatten(Mesh)
mesh_brep_11 = MeshBrep(
    Brep=brep_join_4.Breps,
    Settings={GridMaxCount=0, GridMinCount=16, JaggedSeams=False, MaxEdgeLength=0, MinEdgeLength=0.0001, MinTolerance=0, Refine=True, RefineAngle=0, RelativeTolerance=0.65, SimplePlanes=True, Tolerance=0})  # -> flatten(Mesh)
volume = Volume(Geometry=mesh_brep_10)  # -> Volume, Centroid
volume_2 = Volume(Geometry=mesh_brep_11)  # -> Volume, Centroid

clean_tree_4 = CleanTree(RemoveNulls=True, RemoveInvalid=True, RemoveEmpty=False, Tree=volume.Volume)
clean_tree_5 = CleanTree(RemoveNulls=True, RemoveInvalid=True, RemoveEmpty=False, Tree=volume_2.Volume)

ghpython_script_10 = GhPythonScript(SUM=clean_tree_4)  # -> out, a; inputs SUM: list; same code as ghpython_script_3
ghpython_script_11 = GhPythonScript(SUM=clean_tree_5)  # -> out, a; inputs SUM: list; same code as ghpython_script_3

round_2 = Round(Number=ghpython_script_6.a)  # -> Nearest, Floor, Ceiling
round_3 = Round(Number=ghpython_script_5.a)  # -> Nearest, Floor, Ceiling
round_4 = Round(Number=ghpython_script_4.a)  # -> Nearest, Floor, Ceiling
# FINANCIAL MATH
round_5 = Round(Number=ghpython_script_4.a)  # -> Nearest, Floor, Ceiling
round_6 = Round(Number=ghpython_script_11.a)  # -> Nearest, Floor, Ceiling
round_7 = Round(Number=ghpython_script_10.a)  # -> Nearest, Floor, Ceiling
comercial_m2 = Panel(round_2.Nearest)
construction_area_m2 = Panel(round_4.Nearest)
floor_plan_area_m2 = Panel(round_5.Nearest)
fill_volume_m3 = Panel(round_6.Nearest)
cut_volume_m3 = Panel(round_7.Nearest)
parking_m2 = Panel(round_3.Nearest)
subtraction_2 = Subtraction(A=round_4.Nearest, B=round_2.Nearest)

multiplication_10 = Multiplication(A=round_4.Nearest, B=Slider(0.15, range=0..1))
subtraction_3 = Subtraction(A=round_4.Nearest, B=multiplication_10)
multiplication_11 = Multiplication(A=number_9, B=ghpython_script_10.a)
multiplication_12 = Multiplication(A=number_8, B=ghpython_script_11.a)
multiplication_13 = Multiplication(A=number_7, B=ghpython_script_11.a)

round_8 = Round(Number=multiplication_9)  # -> Nearest, Floor, Ceiling
round_9 = Round(Number=multiplication_11)  # -> Nearest, Floor, Ceiling
round_10 = Round(Number=multiplication_12)  # -> Nearest, Floor, Ceiling
round_11 = Round(Number=multiplication_6)  # -> Nearest, Floor, Ceiling
round_12 = Round(Number=multiplication_13)  # -> Nearest, Floor, Ceiling
round_13 = Round(Number=multiplication_7)  # -> Nearest, Floor, Ceiling
round_14 = Round(Number=multiplication_8)  # -> Nearest, Floor, Ceiling
fill_volume_cost_local_2 = Panel(round_12.Nearest)
fill_volume_cost_foreign_2 = Panel(round_10.Nearest)
soft_cost_2 = Panel(round_14.Nearest)
cut_volume_cost_2 = Panel(round_9.Nearest)
comercial_income_m2_2 = Panel(round_8.Nearest)
construction_cost_m2_2 = Panel(round_13.Nearest)
house_income_m2_2 = Panel(round_11.Nearest)

curve_6 = Curve(<curve referenced from the Rhino model>)
entwine_3 = Entwine(Branch00=house_income_m2_2, Branch01=comercial_income_m2_2, FlattenInputs=True)  # -> flatten(Result)
panel_2 = Panel("""HOUSE INCOME /M2($)
CONSTRUCTION COST / M2 ($)
SOFT COST (%)
COMERCIAL INCOME / M2($)""")
colour_swatch_6 = ColourSwatch(SwatchColor=RGB(0, 0, 0))
merge_2 = Merge(
    Data1=ColourSwatch(SwatchColor=RGB(247, 4, 203)),
    Data2=ColourSwatch(SwatchColor=RGB(106, 255, 255)),
    Data3=ColourSwatch(SwatchColor=RGB(102, 102, 255)),
    Data4=ColourSwatch(SwatchColor=RGB(184, 255, 102)))
conduit_pie_style = ConduitPieStyle(
    StyleName="IMPERATIVE STYLE 02",
    InnerRadius=Slider(0.6, range=0..1),
    OuterRadius=Slider(0.95, range=0..1),
    LabelRadius=Slider(1.21, range=0..2),
    LabelFontFace="BankGothic Md BT",
    RelativeLabelHeight=Slider(0.05, range=0..1),
    LabelColor=colour_swatch_6)
conduit_colorpalette = ConduitColorPalette(
    PaletteName="deded",
    Seed=Slider(52, range=0..100),
    HueRange=Domain(-0.05, 0.05),
    SaturationRange=Domain(-0.15, 0.15),
    LuminanceRange=Domain(-0.1, 0.1),
    BaseColors=merge_2)
draw_pie_chart = DrawPieChart(
    BoundaryRectangle=curve_6,
    Labels=panel_2,
    DataValues=entwine_3,
    PieStyle=conduit_pie_style,
    ColorPalette=conduit_colorpalette)

curve_7 = Curve(<curve referenced from the Rhino model>)
panel_3 = Panel("""FILL VOLUME COST ($)FOREIGN
FILL VOLUME COST($) LOCAL
CUT VOLUME COST($)
CONSTRUCTION COST / M2 ($)""")
colour_swatch_7 = ColourSwatch(SwatchColor=RGB(243, 255, 255))
entwine_4 = Entwine(
    Branch00=fill_volume_cost_foreign_2,
    Branch01=fill_volume_cost_local_2,
    Branch02=cut_volume_cost_2,
    Branch03=construction_cost_m2_2,
    FlattenInputs=True)  # -> flatten(Result)
merge_3 = Merge(
    Data1=ColourSwatch(SwatchColor=RGB(247, 4, 203)),
    Data2=ColourSwatch(SwatchColor=RGB(106, 255, 255)),
    Data3=ColourSwatch(SwatchColor=RGB(102, 102, 255)),
    Data4=ColourSwatch(SwatchColor=RGB(184, 255, 102)))
conduit_pie_style_2 = ConduitPieStyle(
    StyleName="IMPERATIVE STYLE",
    InnerRadius=Slider(0.56, range=0..1),
    OuterRadius=Slider(0.98, range=0..1),
    LabelRadius=Slider(1.13, range=0..2),
    LabelFontFace="BankGothic Md BT",
    RelativeLabelHeight=Slider(0.05, range=0..1),
    LabelColor=colour_swatch_6)
conduit_colorpalette_2 = ConduitColorPalette(
    PaletteName="Palettebcv",
    Seed=Slider(52, range=0..100),
    HueRange=Domain(-0.05, 0.05),
    SaturationRange=Domain(-0.15, 0.15),
    LuminanceRange=Domain(-0.1, 0.1),
    BaseColors=merge_3)
draw_pie_chart_2 = DrawPieChart(
    BoundaryRectangle=curve_7,
    Labels=panel_3,
    DataValues=entwine_4,
    PieStyle=conduit_pie_style_2,
    ColorPalette=conduit_colorpalette_2)

entwine_5 = Entwine(
    Branch00=floor_plan_area_m2,
    Branch01=construction_area_m2,
    Branch02=fill_volume_m3,
    Branch03=cut_volume_m3,
    Branch04=subtraction_2,
    FlattenInputs=True)  # -> flatten(Result)
# CONDUIT CHARTS
panel_4 = Panel("""HOUSING (M2)
CONST.AREA(M2)
FILL VOLUME(M3)
CUT VOLUME(M3)
PARKING(M2)""")
curve_8 = Curve(curve)
merge_4 = Merge(
    Data1=ColourSwatch(SwatchColor=RGB(247, 4, 203)),
    Data2=ColourSwatch(SwatchColor=RGB(255, 206, 107)),
    Data3=ColourSwatch(SwatchColor=RGB(10, 255, 252)),
    Data4=ColourSwatch(SwatchColor=RGB(241, 0, 102)),
    Data5=ColourSwatch(SwatchColor=RGB(80, 234, 102)),
    Data6=colour_swatch_4)
conduit_colorpalette_3 = ConduitColorPalette(
    PaletteName="ddwedewded",
    Seed=Slider(52, range=0..100),
    HueRange=Domain(-0.05, 0.05),
    SaturationRange=Domain(-0.15, 0.15),
    LuminanceRange=Domain(-0.1, 0.1),
    BaseColors=merge_4)
conduit_pie_style_3 = ConduitPieStyle(
    StyleName="vfedfefefef",
    InnerRadius=Slider(0.61, range=0..1),
    OuterRadius=Slider(0.9, range=0..1),
    LabelRadius=Slider(1.2, range=0..2),
    LabelFontFace="Arial Rounded MT Bold",
    RelativeLabelHeight=Slider(0.03, range=0..1),
    LabelColor=colour_swatch_6)
draw_pie_chart_3 = DrawPieChart(
    BoundaryRectangle=curve_8,
    Labels=panel_4,
    DataValues=entwine_5,
    PieStyle=conduit_pie_style_3,
    ColorPalette=conduit_colorpalette_3)

panel_5 = Panel("""M2 HOUSING
M2 COMERCIAL
M2 PARKING LOT""")
entwine_6 = Entwine(Branch00=subtraction_2, Branch01=comercial_m2, Branch02=parking_m2, FlattenInputs=True)  # -> flatten(Result)
merge_5 = Merge(
    Data1=ColourSwatch(SwatchColor=RGB(243, 25, 224)),
    Data2=ColourSwatch(SwatchColor=RGB(233, 242, 170)),
    Data3=ColourSwatch(SwatchColor=RGB(10, 186, 255)))
conduit_colorpalette_4 = ConduitColorPalette(
    PaletteName="PaletteCa",
    Seed=Slider(52, range=0..100),
    HueRange=Domain(-0.05, 0.05),
    SaturationRange=Domain(-0.15, 0.15),
    LuminanceRange=Domain(-0.1, 0.1),
    BaseColors=merge_5)
conduit_pie_style_4 = ConduitPieStyle(
    StyleName="parking lotsd",
    InnerRadius=Slider(0.62, range=0..1),
    OuterRadius=Slider(0.94, range=0..1),
    LabelRadius=Slider(1, range=0..2),
    LabelFontFace="BankGothic Md BT",
    RelativeLabelHeight=Slider(0.05, range=0..1),
    LabelColor=ColourSwatch(SwatchColor=RGB(0, 0, 0)))
draw_pie_chart_4 = DrawPieChart(
    BoundaryRectangle=curve_3,
    Labels=panel_5,
    DataValues=entwine_6,
    PieStyle=conduit_pie_style_4,
    ColorPalette=conduit_colorpalette_4)

merge_6 = Merge(Data3=draw_pie_chart_2, Data4=draw_pie_chart)
heads_up_display_hud = HeadsUpDisplayHUD(ShowHUD=Toggle(True), DrawingObjects=draw_pie_chart_3, DrawingBoundary=get_viewport_boundary_dimensions)

comercial_income = Number(round_8.Nearest)
numero_de_cajones = Number(ghpython_script_8.a)
numero_de_viviendas = Number(ghpython_script_9.a)
m2_estacionamiento = Number(ghpython_script_7.a)
parking_lot_cost = Number(multiplication_5)
m2_viviendas = Number(subtraction_3)
construction_total_area = Number(ghpython_script_4.a)
fill_volumecost_foreign = Number(multiplication_12)
construction_cost_m2_3 = Number(multiplication_7)
fill_volumecost_local = Number(multiplication_13)
cut_volume_cost_3 = Number(multiplication_11)
fill_volume = Number(ghpython_script_11.a)
# EVOLUTIONARY
# SOLVERS
floor_plan_area = Number(ghpython_script_3.a)
house_income = Number(multiplication_6)
cut_volume = Number(ghpython_script_10.a)
soft_cost_3 = Number(multiplication_8)

one_over_x = OneOverX(Value=soft_cost_3)
merge_7 = Merge(
    Data1=mesh_brep_8,
    Data2=mesh_brep_10,
    Data3=mesh_brep_11,
    Data4=mesh_brep_3,
    Data5=mesh_brep_4,
    Data6=mesh_brep_5,
    Data7=mesh_brep_6,
    Data8=mesh_brep_9)  # -> flatten(Result)
wlc_soft_cost = Number(one_over_x)
wlc__profit = Number(round_11.Nearest)
wallacei_x = WallaceiX(
    Genes=wlc_01prior,
    Objectives=[house_income, wlc_soft_cost],
    Data=construction_total_area,
    allFitness="0.0004580768|701938320.000004;0.0004827|666131440.000005;0.0004637875|693295280.000003;0.0004210455|763674320.000004;0.0005453752|589578800.000002;0.0004358438|737745200.000003;0.0004307968|746388240.000003;0.0004307968|746388240.000003;0.0004358438|737745200.000003;0.0004704908|683417520.000003;0.0004387812|732806320.000006;0.0004580768|701938320.000004;0.0004827|666131440.000005;0.0004580768|701938320.000004;0.0005582351|575996880.000003;0.0004163336|772317360.000005;0.0004800307|669835600.000005;0.0004827|666131440.000005;0.0004827|666131440.000005;0.0004800307|669835600.000005",
    allGenomes="25|11|47|77|66_43|35|94|10|64_3|25|32|99|68_65|28|62|70|70_95|9|16|38|80_1|25|32|75|66_26|11|47|100|81_25|9|47|98|68_3|27|32|79|66_97|11|47|76|80_43|33|94|8|56_25|12|47|80|66_43|35|94|11|64_25|11|47|77|66_95|9|13|10|64_43|35|15|10|64_95|10|93|9|66_43|35|94|10|64_43|36|94|10|66_95|9|97|10|62",
    curFrontIdx="3|0;3|1;3|2;3|3;3|4",
    popGen="5,4",
    total="238104")  # -> WallaceiGenomes, FitnessValues, Data, Phenotypes
biomorpher = Biomorpher(
    Genome=[wlc_01prior, wlc_edifswitch, gene_pool, rotacion],
    MeshEs=merge_7,
    Performance=[floor_plan_area, cut_volume, fill_volume, house_income],
    InitialPop=Slider(60, range=0..100))  # -> GenoGuids, Population, Historic, Clusters

# ==== cluster Cluster
number_slider = Slider(1.17, range=0..10)
settings_custom = SettingsCustom(
    StitchSeams=True,
    SimplePlanes=False,
    Refine=True,
    MinCount=16,
    MaxCount=400,
    AspectRatio=20,
    MaxDistance=0,
    MaxAngle=20,
    MinEdge=number_slider,
    MaxEdge=number_slider)
brep = ClusterInput()
# TOPOGRAPHY MESH ANALYSIS
# BREP MESH
mesh_brep = MeshBrep(Brep=brep, Settings=settings_custom)
mcomp = Decompose(Mesh=mesh_brep)  # -> Vertices, Faces, Colours, Normals
vcomp = Decompose(Vector=mcomp.Normals)  # -> XComponent, YComponent, ZComponent
expression = Expression(z=vcomp.ZComponent, Expression="Deg(0.0 - (Asin(Abs(z)) - 0.5*π))")
gradient = Gradient(
    LowerLimit=0,
    UpperLimit=90,
    Parameter=expression,
    stops=[0: RGB(101, 153, 5), 0: RGB(0, 128, 0), 0.441: RGB(240, 172, 36), 0.864: RGB(255, 0, 0)])
factor = ClusterInput()
mesh = Mesh(Vertices=mcomp.Vertices, Faces=mcomp.Faces, Colours=gradient)
xy_plane = XYPlane(Origin=Point(0, 0, 0))
pi = Pi(Factor=factor)
rotate_plane = RotatePlane(Plane=xy_plane, Angle=pi)
bounding_box = BoundingBox(Content=mesh, Plane=rotate_plane)  # -> Box, Box_2
deconstruct_brep = DeconstructBrep(Brep=bounding_box.Box)  # -> Faces, Edges, Vertices
B = ClusterInput()
B_2 = ClusterInput()
list_item = ListItem(List=deconstruct_brep.Faces, Index="4", Wrap=True)
dimensions = Dimensions(Surface=list_item)  # -> UDimension, VDimension
division = Division(A=dimensions.VDimension, B=B)
division_2 = Division(A=dimensions.UDimension, B=B_2)
integer = Integer(division_2)
integer_2 = Integer(division)
quad_panels = QuadPanels(Surface=list_item, UDivisions=integer, VDivisions=integer_2)
area = Area(Geometry=quad_panels)  # -> Area, Centroid

unit_z = UnitZ(Factor=1)
project_point = ProjectPoint(Point=area.Centroid, Direction=unit_z, Geometry=mesh)  # -> Point, Index

null_item = NullItem(Item=project_point.Point)  # -> NullFlags, InvalidFlags, Description
dispatch = Dispatch(List=project_point.Point, DispatchPattern=null_item.NullFlags)  # -> ListA, ListB
mesh_closest_point = MeshClosestPoint(Point=dispatch.ListB, Mesh=mesh)  # -> Point, Index, Parameter
mesh_eval = MeshEval(Mesh=mesh, Parameter=mesh_closest_point.Parameter)  # -> Point, Normal, Colour
vcomp_2 = Decompose(Vector=mesh_eval.Normal)  # -> XComponent, YComponent, ZComponent
expression_2 = Expression(z=vcomp_2.ZComponent, Expression="Deg(0.0 - (Asin(Abs(z)) - 0.5*π))")
second_number = ClusterInput()
distance = ClusterInput()
smaller_than = SmallerThan(FirstNumber=expression_2, SecondNumber=second_number)  # -> SmallerThan, OrEqualTo
dispatch_2 = Dispatch(List=mesh_eval.Point, DispatchPattern=smaller_than.SmallerThan)  # -> ListA, ListB
point_groups = PointGroups(Points=dispatch_2.ListA, Distance=distance)  # -> flatten(Groups), Indices
mesh_2 = ClusterOutput(mesh)
groups = ClusterOutput(point_groups.Groups)

# ==== cluster Cluster_2
curve = ClusterInput()
integer = ClusterInput()
curve_2 = Curve(curve)
integer_2 = Integer(integer)
area = Area(Geometry=curve_2)  # -> Area, Centroid
list_item = ListItem(List=integer_2, Index=0, Wrap=True)  # -> Item, Item1, Item2, Item3, Item4
integer_3 = Integer(area.Area)
equality = Equality(FirstNumber=list_item.Item, SecondNumber=integer_3)  # -> Equality, Inequality
equality_2 = Equality(FirstNumber=list_item.Item2, SecondNumber=integer_3)  # -> Equality, Inequality
equality_3 = Equality(FirstNumber=list_item.Item3, SecondNumber=integer_3)  # -> Equality, Inequality
equality_4 = Equality(FirstNumber=list_item.Item4, SecondNumber=integer_3)  # -> Equality, Inequality
equality_5 = Equality(FirstNumber=list_item.Item1, SecondNumber=integer_3)  # -> Equality, Inequality
integer_4 = ClusterOutput(integer_3)
dispatch = Dispatch(List=curve_2, DispatchPattern=equality.Equality)  # -> ListA, ListB
dispatch_2 = Dispatch(List=curve_2, DispatchPattern=equality_5.Equality)  # -> ListA, ListB
dispatch_3 = Dispatch(List=curve_2, DispatchPattern=equality_2.Equality)  # -> ListA, ListB
dispatch_4 = Dispatch(List=curve_2, DispatchPattern=equality_3.Equality)  # -> ListA, ListB
dispatch_5 = Dispatch(List=curve_2, DispatchPattern=equality_4.Equality)  # -> ListA, ListB
list_a = ClusterOutput(dispatch.ListA)
list_a_2 = ClusterOutput(dispatch_2.ListA)
list_a_3 = ClusterOutput(dispatch_3.ListA)
list_a_4 = ClusterOutput(dispatch_4.ListA)
list_a_5 = ClusterOutput(dispatch_5.ListA)

# ==== cluster Cluster_3
geometry = ClusterInput()
motion = ClusterInput()
move = Move(Geometry=geometry, Motion=motion)  # -> Geometry, Transform
clean_tree = CleanTree(RemoveNulls=True, RemoveInvalid=True, RemoveEmpty=invert(False), Tree=move.Geometry)
geometry_2 = ClusterOutput(move.Geometry)
boundary_surfaces = BoundarySurfaces(Edges=clean_tree)
unit_z = UnitZ(Factor=Slider(0.45, range=0..1))
surfaces = ClusterOutput(boundary_surfaces)
extrude = Extrude(Base=boundary_surfaces, Direction=unit_z)
loft = Loft(Curves=clean_tree, Options={Adjust=False, Closed=False, LoftEnds=0, LoftSimp=0, LoftType=0, Rebuild=10, Refit=0.01})
extrusion = ClusterOutput(extrude)
loft_2 = ClusterOutput(loft)
