# Grasshopper definition Branch2.2.1.0Alpha_Latiz Hypaar.gh (Grasshopper 1.0.7)
# plug-ins: ProvingGround.Conduit, Human UI, Blindfold, LunchBox

value_listener = ValueListener(SomeProperty=True)  # -> Values, Indices
panel = Panel("""LOTE 12
LOTE 24
LOTE 24
LOTE A
LOTE 7
LOTE 8
LOTE 52
LOTE 35
LOTE 31-B
LOTE 20
LOTE 33
LOTE 34
LOTE 37
LOTE 21
LOTE 32
LOTE 16
LOTE 28
LOTE 27
LOTE R
LOTE R
LOTE 17
LOTE 18
LOTE 9
LOTE 13
LOTE 26
LOTE 15
LOTE 23 
LOTE 23
LOTE 14
LOTE 25
LOTE B
LOTE 3-5
LOTE 6
LOTE 10
LOTE 2
LOTE 11
LOTE 51
LOTE 31-A
LOTE 22
LOTE 38
LOTE 36
LOTE 39
LOTE 40
LOTE D
LOTE 41
LOTE 49
LOTE 53
LOTE 50
LOTE 30 
LOTE E
LOTE 46
LOTE 47
LOTE 48
LOTE 44
LOTE 43
LOTE 45
LOTE 42
LOTE 29
LOTE 29-A
CENTRO DE SERVICIOS PARA ATENCION GERIÁTRICA""")
create_checklist = CreateChecklist(ChecklistItems=panel, Selected=Toggle(True))

file_path = FilePath("C:\Users\Sergio\Pictures\LOGO.png")
create_button = CreateButton(ImagePath=file_path, ButtonStyle=0)

widht = Slider(313, range=0..1000)
height = Slider(795, range=0..1000)
launch_window = LaunchWindow(Show=Toggle(True), Name="DESIGN SELECTION", Width=widht, Height=height, ChildStatus=0, EnableHorizScroll=False)

add_elements = AddElements(Window=launch_window, Elements=flatten([create_button, create_checklist]), DoVLChecking=True)  # -> AddedElements, ElementNames
value_listener_2 = ValueListener(Elements=create_checklist, SomeProperty=True)  # -> Values, Indices

brep = Brep([<brep referenced from the Rhino model> x59])
panel_2 = Panel("""LOTE 12
LOTE 24
LOTE 24
LOTE A
LOTE 7
LOTE 8
LOTE 52
LOTE 35
LOTE 31-B
LOTE 20
LOTE 33
LOTE 34
LOTE 37
LOTE 21
LOTE 32
LOTE 16
LOTE 28
LOTE 27
LOTE R
LOTE R
LOTE 17
LOTE 18
LOTE 9
LOTE 13
LOTE 26
LOTE 15
LOTE 23 
LOTE 23
LOTE 14
LOTE 25
LOTE B
LOTE 3-5
LOTE 6
LOTE 10
LOTE 2
LOTE 11
LOTE 51
LOTE 31-A
LOTE 22
LOTE 38
LOTE 36
LOTE 39
LOTE 40
LOTE D
LOTE 41
LOTE 49
LOTE 53
LOTE 50
LOTE 30 
LOTE E
LOTE 46
LOTE 47
LOTE 48
LOTE 44
LOTE 43
LOTE 45
LOTE 42
LOTE 29
LOTE 29-A
CENTRO DE SERVICIOS PARA ATENCION GERIÁTRICA""")
list_length = ListLength(List=brep)
series = Series(Start=0, Step=1, Count=list_length)
create_pulldown_menu = CreatePulldownMenu(ListItems=panel_2, showLabel=True)
value_listener_3 = ValueListener(Elements=create_pulldown_menu, SomeProperty=True)  # -> Values, Indices
list_item = ListItem(List=brep, Index=series, Wrap=True)
item_index = ItemIndex(List=brep, Item=list_item)
list_item_2 = ListItem(List=brep, Index=value_listener_2.Indices, Wrap=True)
item_index_2 = ItemIndex(List=brep, Item=list_item_2)
equality = Equality(FirstNumber=item_index_2, SecondNumber=item_index)  # -> Equality, Inequality
dispatch = Dispatch(List=brep, DispatchPattern=equality.Equality)  # -> ListA, ListB
blindfold = Blindfold(Refresh=Button(), Visibility=Toggle(True), Limited=list_item_2)
blindfold_2 = Blindfold(Refresh=Button(), Visibility=Toggle(False), Limited=dispatch.ListB)

# ----
# ANALYSIS
# BREP MESH
number_slider = Slider(1.17, range=0..10)
settings_custom = SettingsCustom(
    StitchSeams=True,
    SimplePlanes=False,
    Refine=True,
    MinCount=16,
    MaxCount=400,
    AspectRatio=20,
    MaxDistance=0,
    MaxAngle=20,
    MinEdge=number_slider,
    MaxEdge=number_slider)
brep_2 = Brep(list_item_2)
mesh_brep = MeshBrep(Brep=list_item_2, Settings=settings_custom)

panel_3 = Panel(value_listener_2.Indices)

panel_4 = Panel("""LOTE 12
LOTE 24
LOTE 24
LOTE A
LOTE 7
LOTE 8
LOTE 52
LOTE 35
LOTE 31-B
LOTE 20
LOTE 33
LOTE 34
LOTE 37
LOTE 21
LOTE 32
LOTE 16
LOTE 28
LOTE 27
LOTE R
LOTE R
LOTE 17
LOTE 18
LOTE 9
LOTE 13
LOTE 26
LOTE 15
LOTE 23 
LOTE 23
LOTE 14
LOTE 25
LOTE B
LOTE 3-5
LOTE 6
LOTE 10
LOTE 2
LOTE 11
LOTE 51
LOTE 31-A
LOTE 22
LOTE 38
LOTE 36
LOTE 39
LOTE 40
LOTE D
LOTE 41
LOTE 49
LOTE 53
LOTE 50
LOTE 30 
LOTE E
LOTE 46
LOTE 47
LOTE 48
LOTE 44
LOTE 43
LOTE 45
LOTE 42
LOTE 29
LOTE 29-A
C.S.A.G""")
brep_3 = Brep([<brep referenced from the Rhino model> x59])
area = Area(Geometry=brep_3)  # -> Area, graft(Centroid)
graft_tree = GraftTree(Tree=panel_4, IncludeEmptyLists=True, IncludeNullItems=True)
text_tag = TextTag(Location=area.Centroid, Text=graft_tree, Colour=ColourSwatch(SwatchColor=RGB(0, 0, 0)))

# ----
# BUILDING PRIORITY
panel_5 = Panel("0")
run = BooleanToggle(True)
run_2 = BooleanToggle(True)
run_3 = BooleanToggle(True)
run_4 = BooleanToggle(True)
run_5 = BooleanToggle(True)
create_text_box = CreateTextBox(Label="PRIORIDAD _A", DefaultText="0", UpdateButton=run_2, showLabel=True)
create_text_box_2 = CreateTextBox(Label="PRIORIDAD C", DefaultText="0", UpdateButton=run_4, showLabel=True)
create_text_box_3 = CreateTextBox(Label="PRIORIDAD D", DefaultText="0", UpdateButton=run_5, showLabel=True)
create_text_box_4 = CreateTextBox(Label="PRIORIDAD E", DefaultText="0", UpdateButton=run, showLabel=True)
create_text_box_5 = CreateTextBox(Label="PRIORIDAD B", DefaultText=panel_5, UpdateButton=run_3, showLabel=True)
entwine = Entwine(
    Branch00=create_text_box,
    Branch01=create_text_box_5,
    Branch02=create_text_box_2,
    Branch03=create_text_box_3,
    Branch04=create_text_box_4,
    FlattenInputs=True)  # -> flatten(Result)

# ----
# BUILDING TYPE MENU
edif_a = BooleanToggle(False)
edif_d = BooleanToggle(False)
edif_e = BooleanToggle(False)
edif_b = BooleanToggle(False)
edif_c = BooleanToggle(False)
entwine_2 = Entwine(Branch00=edif_a, Branch01=edif_b, Branch02=edif_c, Branch03=edif_d, Branch04=edif_e, FlattenInputs=True)  # -> flatten(Result)
panel_6 = Panel("""EDIFICIO A
EDIFICIO B
EDIFICIO C
EDIFICIO D
EDIFICIO E""")
create_toggle = CreateToggle(Default=entwine_2, Label=panel_6, OnLabel="ON", OffLabel="OFF")

# ----
# FIXED INPUTS
panel_7 = Panel("CUS")
edit_data = BooleanToggle(True)
create_text_box_6 = CreateTextBox(Label="NÚMERO DE NIVELES", DefaultText="15", UpdateButton=Toggle(True), showLabel=True)
create_text_box_7 = CreateTextBox(Label="DENSIDAD VIVIENDAS", DefaultText="120", UpdateButton=edit_data, showLabel=True)
create_text_box_8 = CreateTextBox(Label=panel_7, DefaultText="109585", UpdateButton=True, showLabel=True)

# ----
# LOGO
# DESIGN PROPERTIES
panel_8 = Panel("C:\Users\Sergio\Pictures\LOGO.png")
file_path_2 = FilePath(panel_8)
create_button_2 = CreateButton(ImagePath=file_path_2, ButtonStyle=0)

# ----
# USER INTERFACE
# RUN UI
boolean_toggle = BooleanToggle(True)
height_2 = Slider(795, range=0..1000)
widht_2 = Slider(313, range=0..1000)
launch_window_2 = LaunchWindow(Show=boolean_toggle, Name="LATIZ HYPROOF", Width=widht_2, Height=height_2, ChildStatus=0, EnableHorizScroll=False)

edif_c_pocision = Slider(24, range=0..500)
edif_c_module_jump = Slider(37, range=0..650)
edif_c_rotation = Slider(43.514, range=0..100)
edif_c_altura_desplante = Slider(7.202, range=-10..20)
edif_c__sotanos = Slider(-8, range=-20..0)
create_slider = CreateSlider(Slider=edif_c_pocision, ShowBounds=False, ShowTicks=False, ShowTooltip=False, ShowValLabel=True, showLabel=True)
create_slider_2 = CreateSlider(Slider=edif_c_module_jump, ShowBounds=False, ShowTicks=False, ShowTooltip=False, ShowValLabel=True, showLabel=True)
create_slider_3 = CreateSlider(Slider=edif_c_altura_desplante, ShowBounds=False, ShowTicks=False, ShowTooltip=False, ShowValLabel=True, showLabel=True)
create_slider_4 = CreateSlider(Slider=edif_c__sotanos, ShowBounds=False, ShowTicks=False, ShowTooltip=False, ShowValLabel=True, showLabel=True)
create_slider_5 = CreateSlider(Slider=edif_c_rotation, ShowBounds=False, ShowTicks=False, ShowTooltip=False, ShowValLabel=True, showLabel=True)
value_listener_4 = ValueListener(Elements=[create_slider, create_slider_2, create_slider_5, create_slider_3, create_slider_4], SomeProperty=True)  # -> flatten(Values), Indices
edificio_c = BooleanToggle(True)
create_expander = CreateExpander(
    UIElements=[create_slider, create_slider_2, create_slider_5, create_slider_3, create_slider_4],
    Header="EDIT_EDIFICIO C",
    Open=edificio_c)

edif_b_pocision = Slider(49, range=0..500)
edif_b_rotation = Slider(47.849, range=0..100)
edif_b__sotanos = Slider(-14, range=-20..0)
edif_b_module_jump = Slider(22, range=0..650)
edif_b_altura_desplante = Slider(7.636, range=-10..20)
create_slider_6 = CreateSlider(Slider=edif_b_pocision, ShowBounds=False, ShowTicks=False, ShowTooltip=False, ShowValLabel=True, showLabel=True)
create_slider_7 = CreateSlider(Slider=edif_b_module_jump, ShowBounds=False, ShowTicks=False, ShowTooltip=False, ShowValLabel=True, showLabel=True)
create_slider_8 = CreateSlider(Slider=edif_b_rotation, ShowBounds=False, ShowTicks=False, ShowTooltip=False, ShowValLabel=True, showLabel=True)
create_slider_9 = CreateSlider(Slider=edif_b_altura_desplante, ShowBounds=False, ShowTicks=False, ShowTooltip=False, ShowValLabel=True, showLabel=True)
create_slider_10 = CreateSlider(Slider=edif_b__sotanos, ShowBounds=False, ShowTicks=False, ShowTooltip=False, ShowValLabel=True, showLabel=True)
value_listener_5 = ValueListener(Elements=[create_slider_6, create_slider_7, create_slider_8, create_slider_9, create_slider_10], SomeProperty=True)  # -> flatten(Values), Indices
edificio_b = BooleanToggle(True)
create_expander_2 = CreateExpander(
    UIElements=[create_slider_6, create_slider_7, create_slider_8, create_slider_9, create_slider_10],
    Header="EDIT_EDIFICIO B",
    Open=edificio_b)

edif_a_pocision = Slider(49, range=0..500)
edif_a_module_jump = Slider(46, range=0..650)
edif_a_rotation = Slider(94.052, range=0..100)
edif_a_altura_desplante = Slider(15.122, range=-10..20)
edif_a_sotanos = Slider(-8, range=-20..0)
create_slider_11 = CreateSlider(Slider=edif_a_pocision, ShowBounds=False, ShowTicks=False, ShowTooltip=False, ShowValLabel=True, showLabel=True)
create_slider_12 = CreateSlider(Slider=edif_a_module_jump, ShowBounds=False, ShowTicks=False, ShowTooltip=False, ShowValLabel=True, showLabel=True)
create_slider_13 = CreateSlider(Slider=edif_a_rotation, ShowBounds=False, ShowTicks=False, ShowTooltip=False, ShowValLabel=True, showLabel=True)
create_slider_14 = CreateSlider(Slider=edif_a_altura_desplante, ShowBounds=False, ShowTicks=False, ShowTooltip=False, ShowValLabel=True, showLabel=True)
create_slider_15 = CreateSlider(Slider=edif_a_sotanos, ShowBounds=False, ShowTicks=False, ShowTooltip=False, ShowValLabel=True, showLabel=True)
value_listener_6 = ValueListener(Elements=[create_slider_11, create_slider_12, create_slider_13, create_slider_14, create_slider_15], SomeProperty=True)  # -> flatten(Values), Indices
edificio_a = BooleanToggle(True)
create_expander_3 = CreateExpander(
    UIElements=[create_slider_11, create_slider_12, create_slider_13, create_slider_14, create_slider_15],
    Header="EDIT_EDIFICIO A ",
    Open=edificio_a)

edif_d_pocision = Slider(39, range=0..500)
edif_d_module_jump = Slider(22, range=0..650)
edif_d_rotation = Slider(43.514, range=0..100)
edif_d_altura_desplante = Slider(2.42, range=-10..20)
edif_d__sotanos = Slider(-8, range=-20..0)
create_slider_16 = CreateSlider(Slider=edif_d_pocision, ShowBounds=False, ShowTicks=False, ShowTooltip=False, ShowValLabel=True, showLabel=True)
create_slider_17 = CreateSlider(Slider=edif_d_module_jump, ShowBounds=False, ShowTicks=False, ShowTooltip=False, ShowValLabel=True, showLabel=True)
create_slider_18 = CreateSlider(Slider=edif_d_rotation, ShowBounds=False, ShowTicks=False, ShowTooltip=False, ShowValLabel=True, showLabel=True)
create_slider_19 = CreateSlider(Slider=edif_d_altura_desplante, ShowBounds=False, ShowTicks=False, ShowTooltip=False, ShowValLabel=True, showLabel=True)
create_slider_20 = CreateSlider(Slider=edif_d__sotanos, ShowBounds=False, ShowTicks=False, ShowTooltip=False, ShowValLabel=True, showLabel=True)
edificio_a_2 = BooleanToggle(True)
value_listener_7 = ValueListener(Elements=[create_slider_16, create_slider_17, create_slider_18, create_slider_19, create_slider_20], SomeProperty=True)  # -> flatten(Values), Indices
create_expander_4 = CreateExpander(
    UIElements=[create_slider_16, create_slider_17, create_slider_18, create_slider_19, create_slider_20],
    Header="EDIT_EDIFICIO D",
    Open=edificio_a_2)

# ----
# LOGO
panel_9 = Panel("C:\Users\Sergio\Pictures\LOGO.png")
file_path_3 = FilePath(panel_9)
create_button_3 = CreateButton(ImagePath=file_path_3, ButtonStyle=0)

edif_e_pocision = Slider(50, range=0..500)
edif_e_module_jump = Slider(22, range=0..650)
edif_e_rotation = Slider(50.17, range=0..100)
edif_e_altura_desplante = Slider(8.905, range=-10..20)
edif_e__sotanos = Slider(-14, range=-20..0)
create_slider_21 = CreateSlider(Slider=edif_e_pocision, ShowBounds=False, ShowTicks=False, ShowTooltip=False, ShowValLabel=True, showLabel=True)
create_slider_22 = CreateSlider(Slider=edif_e_module_jump, ShowBounds=False, ShowTicks=False, ShowTooltip=False, ShowValLabel=True, showLabel=True)
create_slider_23 = CreateSlider(Slider=edif_e_rotation, ShowBounds=False, ShowTicks=False, ShowTooltip=False, ShowValLabel=True, showLabel=True)
create_slider_24 = CreateSlider(Slider=edif_e_altura_desplante, ShowBounds=False, ShowTicks=False, ShowTooltip=False, ShowValLabel=True, showLabel=True)
create_slider_25 = CreateSlider(Slider=edif_e__sotanos, ShowBounds=False, ShowTicks=False, ShowTooltip=False, ShowValLabel=True, showLabel=True)
value_listener_8 = ValueListener(Elements=[create_slider_21, create_slider_22, create_slider_23, create_slider_24, create_slider_25], SomeProperty=True)  # -> flatten(Values), Indices
edificio_e = BooleanToggle(False)
create_expander_5 = CreateExpander(
    UIElements=[create_slider_21, create_slider_22, create_slider_23, create_slider_24, create_slider_25],
    Header="EDIT_EDIFICIO E ",
    Open=edificio_e)

reticula_grid = Slider(7, range=1..15)
angle_range = Slider(24, range=1..30)
random_seed = Slider(11, range=1..55)
grid_orientation = Slider(36, range=0..100)
create_slider_26 = CreateSlider(Slider=grid_orientation, ShowBounds=False, ShowTicks=False, ShowTooltip=False, ShowValLabel=True, showLabel=True)
create_slider_27 = CreateSlider(Slider=random_seed, ShowBounds=False, ShowTicks=False, ShowTooltip=False, ShowValLabel=True, showLabel=True)
create_slider_28 = CreateSlider(Slider=reticula_grid, ShowBounds=False, ShowTicks=False, ShowTooltip=False, ShowValLabel=True, showLabel=True)
create_slider_29 = CreateSlider(Slider=angle_range, ShowBounds=False, ShowTicks=False, ShowTooltip=False, ShowValLabel=True, showLabel=True)
value_listener_9 = ValueListener(Elements=[create_slider_28, create_slider_29, create_slider_27, create_slider_26], SomeProperty=True)  # -> flatten(Values), Indices
list_item_3 = ListItem(List=value_listener_9.Values, Index=0, Wrap=True)  # -> Item, Item1, Item2, Item3

height_3 = Slider(485, range=0..1000)
widht_3 = Slider(313, range=0..1000)
launch_window_3 = LaunchWindow(Show=Toggle(True), Name="DESIGN PALETTE", Width=widht_3, Height=height_3, ChildStatus=0, EnableHorizScroll=False)
create_label = CreateLabel(LabelText="TERRAIN & GRID DESIGN", LabelSize=Slider(21, range=0..500), Justification=0)
add_elements_2 = AddElements(
    Window=launch_window_3,
    Elements=flatten([create_button_2, create_label, create_slider_28, create_slider_29, create_slider_27, create_slider_26, create_expander_3, create_expander_2, create_expander, create_expander_4, create_expander_5]),
    DoVLChecking=True)  # -> AddedElements, ElementNames

# ----
# EDIT PROPERTIES
value_listener_10 = ValueListener(Elements=[create_text_box_8, create_text_box_6, create_text_box_7, create_toggle, entwine], SomeProperty=True)  # -> Values, Indices
flatten_tree = FlattenTree(Tree=value_listener_10.Values, Path="{0}")

# ---- group: Orientacion Grid
pi = Pi(Factor=Slider(0.25, range=0..0.5))

# ----
# 3. Add the element to the window
add_elements_3 = AddElements(
    Window=launch_window_2,
    Elements=flatten([create_button_3, create_text_box_8, create_text_box_6, create_text_box_7, create_toggle, entwine, create_pulldown_menu]),
    DoVLChecking=True)  # -> AddedElements, ElementNames

panel_10 = Panel(flatten_tree)

# ----
# MASK
# RESTRICTIONS
panel_11 = Panel("True")
equality_2 = Equality(FirstNumber=flatten_tree, SecondNumber=panel_11)  # -> Equality, Inequality
list_length_2 = ListLength(List=equality_2.Equality)
series_2 = Series(Start=0, Step=1, Count=list_length_2)
ghpython_script = GhPythonScript(x=series_2, y=equality_2.Equality)  # -> flatten(out), a
# ---------- ghpython_script: Python ----------
"""Provides a scripting component.
    Inputs:
        x:
        y:
    Output:
        a: The a output variable"""

__author__ = "Sergio"
__version__ = "2019.03.28"

import rhinoscriptsyntax as rs

a= [y]
b = [x]
BA = []
listac = zip(a,b)
for it,nn in listac:
	if it == True:
		print(nn)
# ---------- end ghpython_script ----------
integer = Integer(ghpython_script.out)

# ----
# PERCENTAGE OF POPULLATION
panel_12 = Panel("8")
construct_domain = ConstructDomain(DomainStart=panel_12, DomainEnd="12")
subtraction = Subtraction(A="12", B=panel_12)
range = Range(Domain=construct_domain, Steps=subtraction)
list_item_4 = ListItem(List=flatten_tree, Index=range, Wrap=True)

integer_2 = Integer(0)
integer_3 = Integer(2)
integer_4 = Integer(1)
list_item_5 = ListItem(List=flatten_tree, Index=integer_2, Wrap=True)
list_item_6 = ListItem(List=flatten_tree, Index=integer_4, Wrap=True)
list_item_7 = ListItem(List=flatten_tree, Index=integer_3, Wrap=True)

number = Number(list_item_5)
integer_5 = Integer(list_item_6)
integer_6 = Integer(list_item_7)
integer_7 = Integer(list_item_4)

# ----
# ITERATOR
ghpython_script_2 = GhPythonScript(mask=integer, cus=number, niveles_max=integer_5, edif_prior=integer_7, num_vivmax=integer_6)  # -> out, out_A, out_B, out_C, out_D, out_E; inputs mask: list, edif_prior: list
# ---------- ghpython_script_2: Python ----------
"""Provides a scripting component.
    Inputs:
        x:
        y:
    Output:
        a: The a output variable"""

__author__ = "Sergio"
__version__ = "2019.03.28"

import rhinoscriptsyntax as rs
import array as ar

import Rhino as rh
import Grasshopper as gh
import GhPython as gp
import math 
import rhinoscriptsyntax as rs
import sys
sys.path.append( "Z:\Shared\PRODUCCION\TALLER PROGRAMACION\RZM LATIZ PROTOTYPE\LIBRERIAS_PY\CLASSES")
from EDIF_CLASS import *

# Las entradas de este nodo se almacenan como lista en las variables IN.

#Var : Inputs
edif_niveles=0
num_max_vivedif=0
edif_areamax=0

#Objects
edif_A=Edificio("A",0,400,4,20,20,100,edif_prior[0],0,0)
edif_B=Edificio("B",0,576,4,12,48,144,edif_prior[1],0,0)
edif_C=Edificio("C",0,864,6,12,72,144,edif_prior[2],0,0)
edif_D=Edificio("D",0,1200,8,24,48,147,edif_prior[3],0,0)
edif_E=Edificio("E",0,1600,12,24,72,133,edif_prior[4],0,0)

output = []

for i in mask:
    if i == 3:
        # MATHEMATHIC METHOD
        num_max_vivedif = round(edif_A.prior * num_vivmax / 100)
        viv_init = edif_A.dptos
        niv_tedif = round(num_max_vivedif / viv_init)

        if niv_tedif > niveles_max:
            edif_A.count = niv_tedif / niveles_max
        else:
            edif_A.count = 1

        edif_A.count = math.ceil(edif_A.count)
        edif_A.niveles = round(niv_tedif / edif_A.count)
        edif_A.dptos = edif_A.niveles * viv_init
        edif_A.areacons = edif_A.huella * edif_A.niveles

        output_A = [edif_A.type, edif_A.count, edif_A.dptos, edif_A.niveles, edif_A.areacons]
        out_A = output_A

    elif i == 4:
        num_max_vivedif = round(edif_B.prior * num_vivmax / 100)
        viv_init = edif_B.dptos
        niv_tedif = round(num_max_vivedif / viv_init)

        if niv_tedif > niveles_max:
            edif_B.count = niv_tedif / niveles_max
        else:
            edif_B.count = 1

        edif_B.count = math.ceil(edif_B.count)
        edif_B.niveles = round(niv_tedif / edif_B.count)
        edif_B.dptos = edif_B.niveles * viv_init
        edif_B.areacons = edif_B.huella * edif_B.niveles

        output_B = [edif_B.type, edif_B.count, edif_B.dptos, edif_B.niveles, edif_B.areacons]
        out_B = output_B

    elif i == 5:
        num_max_vivedif = round(edif_C.prior * num_vivmax / 100)
        viv_init = edif_C.dptos
        niv_tedif = round(num_max_vivedif / viv_init)

        if niv_tedif > niveles_max:
            edif_C.count = niv_tedif / niveles_max
        else:
            edif_C.count = 1

        edif_C.count = math.ceil(edif_C.count)
        edif_C.niveles = round(niv_tedif / edif_C.count)
        edif_C.dptos = edif_C.niveles * viv_init
        edif_C.areacons = edif_C.huella * edif_C.niveles

        output_C = [edif_C.type, edif_C.count, edif_C.dptos, edif_C.niveles, edif_C.areacons]
        out_C = output_C

    elif i == 6:
        num_max_vivedif = round(edif_D.prior * num_vivmax / 100)
        viv_init = edif_D.dptos
        niv_tedif = round(num_max_vivedif / viv_init)

        if niv_tedif > niveles_max:
            edif_D.count = niv_tedif / niveles_max
        else:
            edif_D.count = 1

        edif_D.count = math.ceil(edif_D.count)
        edif_D.niveles = round(niv_tedif / edif_D.count)
        edif_D.dptos = edif_D.niveles * viv_init
        edif_D.areacons = edif_D.huella * edif_D.niveles

        output_D = [edif_D.type, edif_D.count, edif_D.dptos, edif_D.niveles, edif_D.areacons]
        out_D = output_D

    elif i == 7:
        num_max_vivedif = round(edif_E.prior * num_vivmax / 100)
        viv_init = edif_E.dptos
        niv_tedif = round(num_max_vivedif / viv_init)

        if niv_tedif > niveles_max:
            edif_E.count = niv_tedif / niveles_max
        else:
            edif_E.count = 1

        edif_E.count = math.ceil(edif_E.count)
        edif_E.niveles = round(niv_tedif / edif_E.count)
        edif_E.dptos = edif_E.niveles * viv_init
        edif_E.areacons = edif_E.huella * edif_E.niveles

        output_E = [edif_E.type, edif_E.count, edif_E.dptos, edif_E.niveles, edif_E.areacons]
        out_E = output_E
# ---------- end ghpython_script_2 ----------

list_item_8 = ListItem(List=value_listener_5.Values, Index=0, Wrap=True)  # -> Item, Item1, Item2, Item3, Item4

list_item_9 = ListItem(List=value_listener_4.Values, Index=0, Wrap=True)  # -> Item, Item1, Item2, Item3, Item4
colour_swatch = ColourSwatch(SwatchColor=RGBA(206, 74, 0, 148))

# ----
# EDIF_C
number_slider_2 = Slider(0.321, range=0..10)
list_item_10 = ListItem(List=ghpython_script_2.out_C, Index=1, Wrap=True)
list_item_11 = ListItem(List=ghpython_script_2.out_C, Index=3, Wrap=True)
addition = Addition(A=list_item_11, B=1)
create_material = CreateMaterial(
    Diffuse=colour_swatch,
    Specular=colour_swatch,
    Emission=RGB(0, 0, 0),
    Transparency=number_slider_2,
    Shine=Slider(8, range=0..100))
series_3 = Series(Start=0, Step=3, Count=addition)
integer_8 = Integer(list_item_10)

# ----
# EDIF_B
list_item_12 = ListItem(List=ghpython_script_2.out_B, Index=3, Wrap=True)
list_item_13 = ListItem(List=ghpython_script_2.out_B, Index=1, Wrap=True)
colour_swatch_2 = ColourSwatch(SwatchColor=RGBA(255, 255, 255, 67))
colour_swatch_3 = ColourSwatch(SwatchColor=RGBA(252, 5, 182, 232))
addition_2 = Addition(A=list_item_12, B=1)
create_material_2 = CreateMaterial(
    Diffuse=colour_swatch_2,
    Specular=colour_swatch_2,
    Emission=RGB(0, 0, 0),
    Transparency=number_slider_2,
    Shine=Slider(8, range=0..100))
series_4 = Series(Start=0, Step=3, Count=addition_2)
integer_9 = Integer(list_item_13)

list_item_14 = ListItem(List=value_listener_7.Values, Index=0, Wrap=True)  # -> Item, Item1, Item2, Item3, Item4
number_slider_3 = Slider(0.458, range=0..1)

# ----
# EDIF_A
list_item_15 = ListItem(List=ghpython_script_2.out_A, Index=1, Wrap=True)
list_item_16 = ListItem(List=ghpython_script_2.out_A, Index=3, Wrap=True)
# BUILT-IN INPUTS
colour_swatch_4 = ColourSwatch(SwatchColor=RGBA(255, 255, 255, 198))
addition_3 = Addition(A=list_item_16, B=1)
integer_10 = Integer(list_item_15)
create_material_3 = CreateMaterial(
    Diffuse=colour_swatch_4,
    Specular=colour_swatch_4,
    Emission=RGB(0, 0, 0),
    Transparency=number_slider_2,
    Shine=Slider(8, range=0..100))
series_5 = Series(Start=0, Step=3, Count=addition_3)

# ----
# EDIF_D
list_item_17 = ListItem(List=ghpython_script_2.out_D, Index=1, Wrap=True)
list_item_18 = ListItem(List=ghpython_script_2.out_D, Index=3, Wrap=True)
colour_swatch_5 = ColourSwatch(SwatchColor=RGBA(206, 74, 255, 148))
addition_4 = Addition(A=list_item_18, B=1)
create_material_4 = CreateMaterial(Diffuse=colour_swatch_5, Specular=colour_swatch_5, Emission=RGB(0, 0, 0), Transparency=number_slider_2, Shine=0)
series_6 = Series(Start=0, Step=3, Count=addition_4)
integer_11 = Integer(list_item_17)

# ----
# EDIF_E
list_item_19 = ListItem(List=ghpython_script_2.out_E, Index=3, Wrap=True)
list_item_20 = ListItem(List=ghpython_script_2.out_E, Index=1, Wrap=True)
colour_swatch_6 = ColourSwatch(SwatchColor=RGBA(55, 255, 0, 148))
addition_5 = Addition(A=list_item_19, B=1)
series_7 = Series(Start=0, Step=3, Count=addition_5)
integer_12 = Integer(list_item_20)
create_material_5 = CreateMaterial(
    Diffuse=colour_swatch_6,
    Specular=colour_swatch_6,
    Emission=colour_swatch_6,
    Transparency=number_slider_2,
    Shine=Slider(8, range=0..100))

list_item_21 = ListItem(List=value_listener_8.Values, Index=0, Wrap=True)  # -> Item, Item1, Item2, Item3, Item4
number_slider_4 = Slider(0.346, range=0..1)

construct_domain_2 = ConstructDomain(DomainStart=0, DomainEnd=100000000)

conduit_colorpalette = ConduitColorPalette(
    PaletteName="Palette 2",
    Seed=Slider(68, range=0..100),
    HueRange=Domain(-0.05, 0.05),
    SaturationRange=Domain(-0.15, 0.15),
    LuminanceRange=Domain(-0.1, 0.1),
    BaseColors=ColourSwatch(SwatchColor=RGB(235, 63, 152)))
entwine_3 = Entwine(Branch00=conduit_colorpalette, FlattenInputs=True)

# ---- group: Bubble Chart
number_slider_5 = Slider(9, range=0..100)
random = Random(Range="0 to 20", Number=number_slider_5, Seed=Slider(399, range=0..1000))
random_2 = Random(Range="-1.5 to 1.5", Number=number_slider_5, Seed=Slider(230, range=0..1000))
random_3 = Random(Range="-1.5 to 1.5", Number=number_slider_5, Seed=Slider(364, range=0..1000))
format = CSharpScript(x=random)  # -> out, A; inputs x: Double
# ---------- format: C# ----------
    A = x.ToString("#.0");
# ---------- end format ----------
curve = Curve(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)
draw_a_bubble_chart = DrawChart(
    Boundary=curve,
    BubbleSize=random,
    BubbleScale=Slider(0.14, range=0.05..0.4),
    XValues=random_3,
    YValues=random_2,
    AxisPadding=0.1,
    Labels=format.A,
    LabelSize=Slider(0.29, range=0.1..0.35))

# ---- group: text objects
# Text objects automatically use the font from the current style sheet called "Default Font". You can override this font to make it as you like it.
# 
# You also can specify a new font style for any object that takes a font style for input
# A custom font in addition to the style sheet
_0_top_to_bottom_1_bottom_to_top = Slider(0, range=0..1)
_0_top_to_bottom_1_bottom_to_top_2 = Slider(0, range=0..1)
panel_13 = Panel("""Default fonts use adaptive
sizing, and will change
text heights to
fill the boundary space.""")
conduit_font = ConduitFont(Font="ISOCP", TextHeight=12, AdaptiveHeight=True, TextSpacing=1.15, Alignment=0, Bold=False, Italic=False, Color="white")
curve_2 = Curve(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)
curve_3 = Curve(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)
draw_text = DrawTextTest(
    Boundary=curve_2,
    Text=panel_13,
    TextOrdering=_0_top_to_bottom_1_bottom_to_top,
    TextDistribution=0,
    OrientVertically=False)

# ----
unit_x = UnitX(Factor=Slider(-18.847, range=-100..10))

# ----
# TOPOGRAPHY MESH ANALYSIS
mcomp = Decompose(Mesh=mesh_brep)  # -> Vertices, Faces, Colours, Normals
vcomp = Decompose(Vector=mcomp.Normals)  # -> XComponent, YComponent, ZComponent
expression = Expression(z=vcomp.ZComponent, Expression="Deg(0.0 - (Asin(Abs(z)) - 0.5*π))")
gradient = Gradient(
    LowerLimit=0,
    UpperLimit=90,
    Parameter=expression,
    stops=[0: RGB(101, 153, 5), 0: RGB(0, 128, 0), 0.441: RGB(240, 172, 36), 0.864: RGB(255, 0, 0)])
mesh = Mesh(Vertices=mcomp.Vertices, Faces=mcomp.Faces, Colours=gradient)
xy = XYPlane(Origin=Point(0, 0, 0))
prot = RotatePlane(Plane=xy, Angle=pi)
bbox = BoundingBox(Content=mesh, Plane=prot)  # -> Box, Box_2
debrep = DeconstructBrep(Brep=bbox.Box)  # -> Faces, Edges, Vertices
item = ListItem(List=debrep.Faces, Index="4", Wrap=True)
dim = Dimensions(Surface=item)  # -> UDimension, VDimension
division = Division(A=dim.VDimension, B=list_item_3.Item)
division_2 = Division(A=dim.UDimension, B=list_item_3.Item)
int = Integer(division_2)
int_2 = Integer(division)
quads = QuadPanels(Surface=item, UDivisions=int, VDivisions=int_2)
# ANALYSIS OUTPUTS
area_2 = Area(Geometry=quads)  # -> Area, Centroid

Z = UnitZ(Factor=1)
project = ProjectPoint(Point=area_2.Centroid, Direction=Z, Geometry=mesh)  # -> Point, Index

null = NullItem(Item=project.Point)  # -> NullFlags, InvalidFlags, Description
dispatch_2 = Dispatch(List=project.Point, DispatchPattern=null.NullFlags)  # -> ListA, ListB
meshcp = MeshClosestPoint(Point=dispatch_2.ListB, Mesh=mesh)  # -> Point, Index, Parameter
meval = MeshEval(Mesh=mesh, Parameter=meshcp.Parameter)  # -> Point, Normal, Colour
vcomp_2 = Decompose(Vector=meval.Normal)  # -> XComponent, YComponent, ZComponent
expression_2 = Expression(z=vcomp_2.ZComponent, Expression="Deg(0.0 - (Asin(Abs(z)) - 0.5*π))")
smaller = SmallerThan(FirstNumber=expression_2, SecondNumber=list_item_3.Item1)  # -> SmallerThan, OrEqualTo
dispatch_3 = Dispatch(List=meval.Point, DispatchPattern=smaller.SmallerThan)  # -> ListA, ListB
pgroups = PointGroups(Points=dispatch_3.ListA, Distance=list_item_3.Item2)  # -> Groups, Indices

# ----
# POINT MATRIX
flatten_tree_2 = FlattenTree(Tree=pgroups.Groups, Path="{0}")
xy_plane = XYPlane(Origin=pgroups.Groups)
cloud_display = CloudDisplay(Points=xy_plane, Colours=ColourSwatch(SwatchColor=RGB(255, 255, 255)), Size=1, SpriteType=0)
rotate_plane = RotatePlane(Plane=xy_plane, Angle=list_item_3.Item3)

panel_14 = Panel(rotate_plane)
panel_15 = Panel(pgroups.Groups)
tree_statistics = TreeStatistics(Tree=rotate_plane)  # -> Paths, Length, Count
panel_16 = Panel(tree_statistics.Length)
panel_17 = Panel(tree_statistics.Paths)

list_item_22 = ListItem(List=value_listener_6.Values, Index=0, Wrap=True)  # -> Item, Item1, Item2, Item3, Item4

# ----
# GEOMETRY MANIPULATION
number_slider_6 = Slider(0.1, range=0..0.1)
panel_18 = Panel("6")
division_3 = Division(A="12", B=2)
division_4 = Division(A="72", B=2)
series_8 = Series(Start=list_item_9.Item, Step=list_item_9.Item1, Count=integer_8)  # -> graft(Series)
list_item_23 = ListItem(List=rotate_plane, Index=series_8, Wrap=True)
center_box = CenterBox(Base=list_item_23, X=division_3, Y=division_4, Z=number_slider_6)
brep_4 = Brep(center_box)
deconstruct_brep = DeconstructBrep(Brep=brep_4)  # -> Faces, Edges, Vertices
list_item_24 = ListItem(List=deconstruct_brep.Faces, Index=Slider(4, range=0..100), Wrap=True)
brep_wireframe = BrepWireframe(Brep=list_item_24, Density=-1)
join_curves = JoinCurves(Curves=brep_wireframe, Preserve=False)
rotate = Rotate(Geometry=join_curves, Angle=list_item_9.Item2, Plane=list_item_23)  # -> Geometry, Transform
unit_z = UnitZ(Factor=list_item_9.Item4)
move = Move(Geometry=rotate.Geometry, Motion=unit_z)  # -> Geometry, Transform
fragment_patch = FragmentPatch(Boundary=move.Geometry)
area_3 = Area(Geometry=fragment_patch)  # -> Area, Centroid

# ----
# FLOORS
unit_z_2 = UnitZ(Factor=list_item_9.Item3)
unit_z_3 = UnitZ(Factor=series_3)
move_2 = Move(Geometry=rotate.Geometry, Motion=unit_z_2)  # -> Geometry, Transform
move_3 = Move(Geometry=move_2.Geometry, Motion=unit_z_3)  # -> Geometry, Transform
fragment_patch_2 = FragmentPatch(Boundary=move_3.Geometry)
loft = Loft(Curves=move_3.Geometry, Options={Adjust=False, Closed=False, LoftEnds=0, LoftSimp=0, LoftType=0, Rebuild=10, Refit=0.01})
custom_preview = CustomPreview(Geometry=fragment_patch_2, Material=colour_swatch_3)
custom_preview_2 = CustomPreview(Geometry=loft, Material=create_material)

# ----
# GEOMETRY MANIPULATION
number_slider_7 = Slider(4, range=0..100)
panel_19 = Panel("8")
series_9 = Series(Start=list_item_14.Item, Step=list_item_14.Item1, Count=integer_11)  # -> graft(Series)
division_5 = Division(A="24", B=2)
division_6 = Division(A="48", B=2)
list_item_25 = ListItem(List=rotate_plane, Index=series_9, Wrap=True)
center_box_2 = CenterBox(Base=list_item_25, X=division_5, Y=division_6, Z=Slider(0.1, range=0..0.1))
brep_5 = Brep(center_box_2)
deconstruct_brep_2 = DeconstructBrep(Brep=brep_5)  # -> Faces, Edges, Vertices
list_item_26 = ListItem(List=deconstruct_brep_2.Faces, Index=number_slider_7, Wrap=True)
brep_wireframe_2 = BrepWireframe(Brep=list_item_26, Density=-1)
join_curves_2 = JoinCurves(Curves=brep_wireframe_2, Preserve=False)
unit_z_4 = UnitZ(Factor=list_item_14.Item4)
rotate_2 = Rotate(Geometry=join_curves_2, Angle=list_item_14.Item2, Plane=list_item_25)  # -> Geometry, Transform
move_4 = Move(Geometry=rotate_2.Geometry, Motion=unit_z_4)  # -> Geometry, Transform
fragment_patch_3 = FragmentPatch(Boundary=move_4.Geometry)
area_4 = Area(Geometry=fragment_patch_3)  # -> Area, Centroid

# ----
# FLOORS
unit_z_5 = UnitZ(Factor=list_item_14.Item3)
move_5 = Move(Geometry=rotate_2.Geometry, Motion=unit_z_5)  # -> Geometry, Transform
unit_z_6 = UnitZ(Factor=series_6)
move_6 = Move(Geometry=move_5.Geometry, Motion=unit_z_6)  # -> Geometry, Transform
fragment_patch_4 = FragmentPatch(Boundary=move_6.Geometry)
loft_2 = Loft(Curves=move_6.Geometry, Options={Adjust=False, Closed=False, LoftEnds=0, LoftSimp=0, LoftType=0, Rebuild=10, Refit=0.01})
custom_preview_3 = CustomPreview(Geometry=fragment_patch_4, Material=colour_swatch_3)
custom_preview_4 = CustomPreview(Geometry=loft_2, Material=create_material_4)

# ----
# GEOMETRY MANIPULATION
series_10 = Series(Start=list_item_22.Item, Step=list_item_22.Item1, Count=integer_10)  # -> graft(Series)
list_item_27 = ListItem(List=rotate_plane, Index=series_10, Wrap=True)
panel_20 = Panel("4")
division_7 = Division(A="20", B=2)
division_8 = Division(A="20", B=2)
unit_z_7 = UnitZ(Factor=list_item_22.Item3)
unit_z_8 = UnitZ(Factor=list_item_22.Item4)
unit_z_9 = UnitZ(Factor=Slider(0.02119, range=-1..1.01))

xy_plane_2 = XYPlane(Origin=list_item_27)

center_box_3 = CenterBox(Base=xy_plane_2, X=division_7, Y=division_8, Z=Slider(0.1, range=0..0.1))
brep_6 = Brep(center_box_3)
deconstruct_brep_3 = DeconstructBrep(Brep=brep_6)  # -> Faces, Edges, Vertices
list_item_28 = ListItem(List=deconstruct_brep_3.Faces, Index=Slider(4, range=0..100), Wrap=True)
brep_wireframe_3 = BrepWireframe(Brep=list_item_28, Density=-1)
join_curves_3 = JoinCurves(Curves=brep_wireframe_3, Preserve=False)
rotate_3 = Rotate(Geometry=join_curves_3, Angle=list_item_22.Item2, Plane=list_item_27)  # -> Geometry, Transform
move_7 = Move(Geometry=rotate_3.Geometry, Motion=unit_z_7)  # -> Geometry, Transform
move_8 = Move(Geometry=rotate_3.Geometry, Motion=unit_z_8)  # -> Geometry, Transform
fragment_patch_5 = FragmentPatch(Boundary=move_7.Geometry)
fragment_patch_6 = FragmentPatch(Boundary=move_8.Geometry)
area_5 = Area(Geometry=fragment_patch_5)  # -> Area, Centroid
area_6 = Area(Geometry=fragment_patch_6)  # -> Area, Centroid
line = Line(StartPoint=area_5.Centroid, EndPoint=area_6.Centroid)
length = Length(Curve=line)
unit_z_10 = UnitZ(Factor=length)
extrude = Extrude(Base=fragment_patch_6, Direction=unit_z_10)
brep_brep = BrepBrep(BrepA=brep_2, BrepB=extrude)  # -> Curves, Points
fragment_patch_7 = FragmentPatch(Boundary=brep_brep.Curves)
extrude_2 = Extrude(Base=fragment_patch_7, Direction=unit_z_9)
trim_solid = TrimSolid(Shape=extrude, Cutters=extrude_2)
list_item_29 = ListItem(List=trim_solid, Index=0, Wrap=True)  # -> Item, Item1

fragment_patch_8 = FragmentPatch(Boundary=move_2.Geometry)
area_7 = Area(Geometry=fragment_patch_8)  # -> Area, Centroid
line_2 = Line(StartPoint=area_7.Centroid, EndPoint=area_3.Centroid)
length_2 = Length(Curve=line_2)
unit_z_11 = UnitZ(Factor=length_2)
extrude_3 = Extrude(Base=fragment_patch, Direction=unit_z_11)
brep_brep_2 = BrepBrep(BrepA=brep_2, BrepB=extrude_3)  # -> Curves, Points
fragment_patch_9 = FragmentPatch(Boundary=brep_brep_2.Curves)
extrude_4 = Extrude(Base=fragment_patch_9, Direction=unit_z_9)
trim_solid_2 = TrimSolid(Shape=extrude_3, Cutters=extrude_4)
list_item_30 = ListItem(List=trim_solid_2, Index=0, Wrap=True)  # -> Item, Item1

fragment_patch_10 = FragmentPatch(Boundary=move_5.Geometry)
area_8 = Area(Geometry=fragment_patch_10)  # -> Area, Centroid
line_3 = Line(StartPoint=area_8.Centroid, EndPoint=area_4.Centroid)
length_3 = Length(Curve=line_3)
unit_z_12 = UnitZ(Factor=length_3)
extrude_5 = Extrude(Base=fragment_patch_3, Direction=unit_z_12)
brep_brep_3 = BrepBrep(BrepA=brep_2, BrepB=extrude_5)  # -> Curves, Points
fragment_patch_11 = FragmentPatch(Boundary=brep_brep_3.Curves)
extrude_6 = Extrude(Base=fragment_patch_11, Direction=unit_z_9)
trim_solid_3 = TrimSolid(Shape=extrude_5, Cutters=extrude_6)
list_item_31 = ListItem(List=trim_solid_3, Index=0, Wrap=True)  # -> Item, Item1

# ----
# COLOR SCHEME
colour_swatch_7 = ColourSwatch(SwatchColor=RGB(0, 255, 255))
colour_swatch_8 = ColourSwatch(SwatchColor=RGB(255, 0, 0))
create_material_6 = CreateMaterial(Diffuse=colour_swatch_7, Specular=colour_swatch_7, Emission=colour_swatch_7, Transparency=number_slider_3, Shine=20)
create_material_7 = CreateMaterial(Diffuse=colour_swatch_8, Specular=colour_swatch_8, Emission=colour_swatch_8, Transparency=number_slider_3, Shine=20)
custom_preview_5 = CustomPreview(Geometry=list_item_31.Item1, Material=create_material_6)
custom_preview_6 = CustomPreview(Geometry=list_item_31.Item, Material=create_material_7)

# ----
# COLOR SCHEME
number_slider_8 = Slider(0.316, range=0..1)
colour_swatch_9 = ColourSwatch(SwatchColor=RGB(0, 255, 255))
colour_swatch_10 = ColourSwatch(SwatchColor=RGB(255, 0, 0))
create_material_8 = CreateMaterial(Diffuse=colour_swatch_9, Specular=colour_swatch_9, Emission=colour_swatch_9, Transparency=number_slider_8, Shine=20)
create_material_9 = CreateMaterial(Diffuse=colour_swatch_10, Specular=colour_swatch_10, Emission=colour_swatch_10, Transparency=number_slider_8, Shine=20)
custom_preview_7 = CustomPreview(Geometry=list_item_30.Item1, Material=create_material_8)
custom_preview_8 = CustomPreview(Geometry=list_item_30.Item, Material=create_material_9)

# ----
# COLOR SCHEME
colour_swatch_11 = ColourSwatch(SwatchColor=RGB(0, 255, 255))
colour_swatch_12 = ColourSwatch(SwatchColor=RGB(255, 0, 0))
number_slider_9 = Slider(0.223, range=0..1)
create_material_10 = CreateMaterial(Diffuse=colour_swatch_11, Specular=colour_swatch_11, Emission=colour_swatch_11, Transparency=number_slider_9, Shine=20)
create_material_11 = CreateMaterial(Diffuse=colour_swatch_12, Specular=colour_swatch_12, Emission=colour_swatch_12, Transparency=number_slider_9, Shine=20)
custom_preview_9 = CustomPreview(Geometry=list_item_29.Item1, Material=create_material_10)
custom_preview_10 = CustomPreview(Geometry=list_item_29.Item, Material=create_material_11)

# ----
# EDIF_A FILL (M3)
cluster = Cluster_2(breps=[list_item_29.Item1, extrude_2])

# ----
# EDIF_C  FILL (M3)
cluster_2 = Cluster_2(breps=[list_item_30.Item1, extrude_4])

# ----
# EDIF_D  FILL (M3)
cluster_3 = Cluster_2(breps=[list_item_31.Item1, extrude_6])

# ----
# EDIF_D  CUT  (M3)
cluster_4 = Cluster(breps=[list_item_31.Item, fragment_patch_11])

# ----
# EDIF_C  CUT  (M3)
cluster_5 = Cluster(breps=[list_item_30.Item, fragment_patch_9])

# ----
# EDIF_A  CUT  (M3)
cluster_6 = Cluster(breps=[list_item_29.Item, fragment_patch_7])

# ----
# GEOMETRY MANIPULATION
series_11 = Series(Start=list_item_8.Item, Step=list_item_8.Item1, Count=integer_9)  # -> graft(Series)
list_item_32 = ListItem(List=rotate_plane, Index=series_11, Wrap=True)
division_9 = Division(A="12", B=2)
division_10 = Division(A="48", B=2)
center_box_4 = CenterBox(Base=list_item_32, X=division_9, Y=division_10, Z=Slider(0.1, range=0..0.1))
unit_z_13 = UnitZ(Factor=list_item_8.Item3)
brep_7 = Brep(center_box_4)
deconstruct_brep_4 = DeconstructBrep(Brep=brep_7)  # -> Faces, Edges, Vertices
list_item_33 = ListItem(List=deconstruct_brep_4.Faces, Index=Slider(4, range=0..100), Wrap=True)
unit_z_14 = UnitZ(Factor=list_item_8.Item4)
brep_wireframe_4 = BrepWireframe(Brep=list_item_33, Density=-1)
join_curves_4 = JoinCurves(Curves=brep_wireframe_4, Preserve=False)
rotate_4 = Rotate(Geometry=join_curves_4, Angle=list_item_8.Item2, Plane=list_item_32)  # -> Geometry, Transform
move_9 = Move(Geometry=rotate_4.Geometry, Motion=unit_z_14)  # -> Geometry, Transform
fragment_patch_12 = FragmentPatch(Boundary=move_9.Geometry)
area_9 = Area(Geometry=fragment_patch_12)  # -> Area, Centroid

# ----
# FLOORS
move_10 = Move(Geometry=rotate_4.Geometry, Motion=unit_z_13)  # -> Geometry, Transform
unit_z_15 = UnitZ(Factor=series_4)
move_11 = Move(Geometry=move_10.Geometry, Motion=unit_z_15)  # -> Geometry, Transform
fragment_patch_13 = FragmentPatch(Boundary=move_11.Geometry)
loft_3 = Loft(
    Curves=move_11.Geometry,
    Options={Adjust=False, Closed=False, LoftEnds=0, LoftSimp=0, LoftType=0, Rebuild=10, Refit=0.01})
custom_preview_11 = CustomPreview(Geometry=loft_3, Material=colour_swatch_2)
custom_preview_12 = CustomPreview(Geometry=fragment_patch_13, Material=colour_swatch_3)

fragment_patch_14 = FragmentPatch(Boundary=move_10.Geometry)
area_10 = Area(Geometry=fragment_patch_14)  # -> Area, Centroid
line_4 = Line(StartPoint=area_10.Centroid, EndPoint=area_9.Centroid)
length_4 = Length(Curve=line_4)
unit_z_16 = UnitZ(Factor=length_4)
extrude_7 = Extrude(Base=fragment_patch_12, Direction=unit_z_16)
brep_brep_4 = BrepBrep(BrepA=brep_2, BrepB=extrude_7)  # -> Curves, Points
fragment_patch_15 = FragmentPatch(Boundary=brep_brep_4.Curves)
extrude_8 = Extrude(Base=fragment_patch_15, Direction=unit_z_9)
trim_solid_4 = TrimSolid(Shape=extrude_7, Cutters=extrude_8)
list_item_34 = ListItem(List=trim_solid_4, Index=0, Wrap=True)  # -> Item, Item1

# ----
# COLOR SCHEME
number_slider_10 = Slider(0.223, range=0..1)
colour_swatch_13 = ColourSwatch(SwatchColor=RGB(0, 255, 255))
colour_swatch_14 = ColourSwatch(SwatchColor=RGB(255, 0, 0))
create_material_12 = CreateMaterial(Diffuse=colour_swatch_13, Specular=colour_swatch_13, Emission=colour_swatch_13, Transparency=number_slider_10, Shine=20)
create_material_13 = CreateMaterial(Diffuse=colour_swatch_14, Specular=colour_swatch_14, Emission=colour_swatch_14, Transparency=number_slider_10, Shine=20)
custom_preview_13 = CustomPreview(Geometry=list_item_34.Item1, Material=create_material_12)
custom_preview_14 = CustomPreview(Geometry=list_item_34.Item, Material=create_material_13)

# ----
# EDIF_B  FILL (M3)
cluster_7 = Cluster_2(breps=[list_item_34.Item1, extrude_8])

# ----
# EDIF_B  CUT  (M3)
cluster_8 = Cluster(breps=[list_item_34.Item, fragment_patch_15])

panel_22 = Panel("12")
panel_23 = Panel("24")
panel_24 = Panel("72")
series_12 = Series(Start=list_item_21.Item, Step=list_item_21.Item1, Count=integer_12)
division_11 = Division(A="24", B=2)
division_12 = Division(A="48", B=2)
list_item_35 = ListItem(List=rotate_plane, Index=series_12, Wrap=True)
center_box_5 = CenterBox(Base=list_item_35, X=division_11, Y=division_12, Z=Slider(0.1, range=0..0.1))
brep_8 = Brep(center_box_5)
deconstruct_brep_5 = DeconstructBrep(Brep=brep_8)  # -> Faces, Edges, Vertices
list_item_36 = ListItem(List=deconstruct_brep_5.Faces, Index=Slider(4, range=0..100), Wrap=True)
brep_wireframe_5 = BrepWireframe(Brep=list_item_36, Density=-1)
join_curves_5 = JoinCurves(Curves=brep_wireframe_5, Preserve=False)
unit_z_17 = UnitZ(Factor=list_item_21.Item4)
rotate_5 = Rotate(Geometry=join_curves_5, Angle=list_item_21.Item2, Plane=list_item_35)  # -> Geometry, Transform
move_12 = Move(Geometry=rotate_5.Geometry, Motion=unit_z_17)  # -> Geometry, Transform
fragment_patch_16 = FragmentPatch(Boundary=move_12.Geometry)
area_11 = Area(Geometry=fragment_patch_16)  # -> Area, Centroid

# ----
# FLOORS
unit_z_18 = UnitZ(Factor=list_item_21.Item3)
unit_z_19 = UnitZ(Factor=series_7)
move_13 = Move(Geometry=rotate_5.Geometry, Motion=unit_z_18)  # -> Geometry, Transform
move_14 = Move(Geometry=move_13.Geometry, Motion=unit_z_19)  # -> Geometry, Transform
fragment_patch_17 = FragmentPatch(Boundary=move_14.Geometry)
loft_4 = Loft(
    Curves=move_14.Geometry,
    Options={Adjust=False, Closed=False, LoftEnds=0, LoftSimp=0, LoftType=0, Rebuild=10, Refit=0.01})
custom_preview_15 = CustomPreview(Geometry=fragment_patch_17, Material=colour_swatch_3)
custom_preview_16 = CustomPreview(Geometry=loft_4, Material=create_material_5)

fragment_patch_18 = FragmentPatch(Boundary=move_13.Geometry)
area_12 = Area(Geometry=fragment_patch_18)  # -> Area, Centroid
line_5 = Line(StartPoint=area_12.Centroid, EndPoint=area_11.Centroid)
length_5 = Length(Curve=line_5)
unit_z_20 = UnitZ(Factor=length_5)
extrude_9 = Extrude(Base=fragment_patch_16, Direction=unit_z_20)
brep_brep_5 = BrepBrep(BrepA=brep_2, BrepB=extrude_9)  # -> Curves, Points
fragment_patch_19 = FragmentPatch(Boundary=brep_brep_5.Curves)
extrude_10 = Extrude(Base=fragment_patch_19, Direction=unit_z_9)
trim_solid_5 = TrimSolid(Shape=extrude_9, Cutters=extrude_10)
list_item_37 = ListItem(List=trim_solid_5, Index=0, Wrap=True)  # -> Item, Item1

# ----
# COLOR SCHEME
colour_swatch_15 = ColourSwatch(SwatchColor=RGB(0, 255, 255))
colour_swatch_16 = ColourSwatch(SwatchColor=RGB(255, 0, 0))
create_material_14 = CreateMaterial(Diffuse=colour_swatch_15, Specular=colour_swatch_15, Emission=colour_swatch_15, Transparency=number_slider_4, Shine=20)
create_material_15 = CreateMaterial(Diffuse=colour_swatch_16, Specular=colour_swatch_16, Emission=colour_swatch_16, Transparency=number_slider_4, Shine=20)
custom_preview_17 = CustomPreview(Geometry=list_item_37.Item1, Material=create_material_14)
custom_preview_18 = CustomPreview(Geometry=list_item_37.Item, Material=create_material_15)

# ----
# EDIF_E  FILL (M3)
cluster_9 = Cluster_2(breps=[list_item_37.Item1, extrude_10])

# ----
# LAYOUT FLOOR PLAN AREA (M2)
multiplication = Multiplication(A=integer_9, B="576")
multiplication_2 = Multiplication(A=integer_8, B="864")
multiplication_3 = Multiplication(A=integer_10, B="400")
multiplication_4 = Multiplication(A=integer_12, B="1600")
multiplication_5 = Multiplication(A=integer_8, B="1200")
entwine_4 = Entwine(
    Branch00=multiplication_3,
    Branch01=multiplication,
    Branch02=multiplication_2,
    Branch03=multiplication_5,
    Branch04=multiplication_4,
    FlattenInputs=True)  # -> flatten(Result)
# OUTPUTS
clean_tree = CleanTree(RemoveNulls=True, RemoveInvalid=True, RemoveEmpty=False, Tree=entwine_4)
number_2 = Number(clean_tree)
ghpython_script_3 = GhPythonScript(SUM=number_2)  # -> out, a; inputs SUM: list
# ---------- ghpython_script_3: Python ----------
"""Provides a scripting component.
    Inputs:
        x:
        y:
    Output:
        a: The a output variable"""

__author__ = "Sergio"
__version__ = "2019.03.28"

import rhinoscriptsyntax as rs
import math as math
ab=[]
for num in SUM:
    ab.append(num)
    lst = (math.fsum(ab))
    a=lst
# ---------- end ghpython_script_3 ----------

# ----
# EDIF_E  CUT  (M3)
cluster_10 = Cluster(breps=[list_item_37.Item, fragment_patch_19])

# ----
# FILL VOLUME (M3)
entwine_5 = Entwine(Branch00=cluster, Branch01=cluster_7, Branch02=cluster_2, Branch03=cluster_3, Branch04=cluster_9, FlattenInputs=True)  # -> flatten(Result)
clean_tree_2 = CleanTree(RemoveNulls=True, RemoveInvalid=True, RemoveEmpty=False, Tree=entwine_5)
number_3 = Number(clean_tree_2)
ghpython_script_4 = GhPythonScript(SUM=number_3)  # -> out, a; inputs SUM: list; same code as ghpython_script_3

# ----
# CUT VOLUME (M3)
entwine_6 = Entwine(Branch00=cluster_6, Branch01=cluster_8, Branch02=cluster_5, Branch03=cluster_4, Branch04=cluster_10, FlattenInputs=True)  # -> flatten(Result)
clean_tree_3 = CleanTree(RemoveNulls=True, RemoveInvalid=True, RemoveEmpty=False, Tree=entwine_6)
number_4 = Number(clean_tree_3)
ghpython_script_5 = GhPythonScript(SUM=number_4)  # -> out, a; inputs SUM: list; same code as ghpython_script_3

# ----
# FLOORS
number_slider_11 = Slider(1, range=0..1)
unit_z_21 = UnitZ(Factor=series_5)
move_15 = Move(Geometry=fragment_patch_5, Motion=unit_z_21)  # -> Geometry, Transform
list_length_3 = ListLength(List=move_15.Geometry)
move_16 = Move(Geometry=move_7.Geometry, Motion=unit_z_21)  # -> Geometry, Transform
subtraction_2 = Subtraction(A=list_length_3, B=1)
series_13 = Series(Start=number_slider_11, Step=number_slider_11, Count=subtraction_2)
list_item_38 = ListItem(List=move_15.Geometry, Index=series_13, Wrap=True)
loft_5 = Loft(
    Curves=move_16.Geometry,
    Options={Adjust=False, Closed=False, LoftEnds=0, LoftSimp=0, LoftType=0, Rebuild=10, Refit=0.01})
custom_preview_19 = CustomPreview(Geometry=list_item_38, Material=colour_swatch_3)
custom_preview_20 = CustomPreview(Geometry=loft_5, Material=create_material_3)

list_item_39 = ListItem(List=move_15.Geometry, Index=0, Wrap=True)

custom_preview_21 = CustomPreview(Geometry=list_item_39, Material=ColourSwatch(SwatchColor=RGBA(255, 118, 255, 0)))

# ----
# CONSTRUCTION AREA
area_13 = Area(Geometry=fragment_patch_17)  # -> Area, Centroid
area_14 = Area(Geometry=fragment_patch_13)  # -> Area, Centroid
area_15 = Area(Geometry=move_15.Geometry)  # -> Area, Centroid
area_16 = Area(Geometry=fragment_patch_4)  # -> Area, Centroid
area_17 = Area(Geometry=fragment_patch_2)  # -> Area, Centroid
ghpython_script_6 = GhPythonScript(SUM=area_17.Area)  # -> out, a; inputs SUM: list; same code as ghpython_script_3
ghpython_script_7 = GhPythonScript(SUM=area_15.Area)  # -> out, a; inputs SUM: list; same code as ghpython_script_3
ghpython_script_8 = GhPythonScript(SUM=area_13.Area)  # -> out, a; inputs SUM: list; same code as ghpython_script_3
ghpython_script_9 = GhPythonScript(SUM=area_16.Area)  # -> out, a; inputs SUM: list; same code as ghpython_script_3
ghpython_script_10 = GhPythonScript(SUM=area_14.Area)  # -> out, a; inputs SUM: list; same code as ghpython_script_3
entwine_7 = Entwine(
    Branch00=ghpython_script_7.a,
    Branch01=ghpython_script_10.a,
    Branch02=ghpython_script_6.a,
    Branch03=ghpython_script_9.a,
    Branch04=ghpython_script_8.a,
    FlattenInputs=True)  # -> flatten(Result)
clean_tree_4 = CleanTree(RemoveNulls=True, RemoveInvalid=True, RemoveEmpty=False, Tree=entwine_7)
number_5 = Number(clean_tree_4)
ghpython_script_11 = GhPythonScript(SUM=number_5)  # -> out, a; inputs SUM: list; same code as ghpython_script_3

# ----
# FINANCIAL MATH
fill_volume_cost_foreign = Panel("63.77")
fill_volume_cost_local = Panel("115.200")
house_income_m2 = Panel("38585.0000")
construction_cost_m2 = Panel("63.770")
soft_cost = Panel("0.12")
cut_volume_cost = Panel("63.770")
number_6 = Number(house_income_m2)
number_7 = Number(construction_cost_m2)
number_8 = Number(fill_volume_cost_foreign)
number_9 = Number(fill_volume_cost_local)
number_10 = Number(soft_cost)
number_11 = Number(cut_volume_cost)
multiplication_6 = Multiplication(A=number_9, B=ghpython_script_4.a)
multiplication_7 = Multiplication(A=number_6, B=ghpython_script_11.a)
multiplication_8 = Multiplication(A=construction_cost_m2, B=ghpython_script_11.a)
multiplication_9 = Multiplication(A=number_10, B=ghpython_script_11.a)
multiplication_10 = Multiplication(A=number_11, B=ghpython_script_5.a)
multiplication_11 = Multiplication(A=number_8, B=ghpython_script_4.a)

# ----
# FINANCIAL OUTPUTS
fill_volume_cost_local_2 = Panel(multiplication_6)
fill_volume_cost_foreign_2 = Panel(multiplication_11)
soft_cost_2 = Panel(multiplication_9)
cut_volume_cost_2 = Panel(multiplication_10)
house_income_m2_2 = Panel(multiplication_7)
construction_cost_m2_2 = Panel(multiplication_8)

# ----
# TERRAIN OUTPUTS
construction_area_m2 = Panel(ghpython_script_11.a)
floor_plan_area_m2 = Panel(ghpython_script_3.a)
fill_volume_m3 = Panel(ghpython_script_4.a)
cut_volume_m3 = Panel(ghpython_script_5.a)

# ----
# PIE CHART FOR TERRAIN OUTPUTS
number_slider_12 = Slider(0.04, range=0..1)
panel_25 = Panel("""FLOOR PLAN AREA(M2)4,640
CONSTRUCTION AREA(M2)23,696.0
FILL VOLUME(M3)15,982.02
CUT VOLUME(M3)44,242.39""")
entwine_8 = Entwine(
    Branch00=floor_plan_area_m2,
    Branch01=construction_area_m2,
    Branch02=fill_volume_m3,
    Branch03=cut_volume_m3,
    FlattenInputs=True)  # -> flatten(Result)
merge = Merge(
    Data1=ColourSwatch(SwatchColor=RGB(247, 4, 203)),
    Data2=ColourSwatch(SwatchColor=RGB(106, 255, 255)),
    Data3=ColourSwatch(SwatchColor=RGB(102, 102, 255)),
    Data4=ColourSwatch(SwatchColor=RGB(184, 255, 102)))
conduit_pie_style = ConduitPieStyle(
    StyleName="IMPERATIVE STYLE",
    InnerRadius=Slider(0.56, range=0..1),
    OuterRadius=Slider(0.92, range=0..1),
    LabelRadius=Slider(1.07, range=0..2),
    LabelFontFace="BankGothic Md BT",
    RelativeLabelHeight=number_slider_12,
    LabelColor=ColourSwatch(SwatchColor=RGB(243, 255, 255)))
conduit_colorpalette_2 = ConduitColorPalette(
    PaletteName="Palette",
    Seed=Slider(52, range=0..100),
    HueRange=Domain(-0.05, 0.05),
    SaturationRange=Domain(-0.15, 0.15),
    LuminanceRange=Domain(-0.1, 0.1),
    BaseColors=merge)
curve_4 = Curve(<curve referenced from the Rhino model>)
draw_pie_chart = DrawPieChart(
    BoundaryRectangle=curve_4,
    Labels=panel_25,
    DataValues=entwine_8,
    PieStyle=conduit_pie_style,
    ColorPalette=conduit_colorpalette_2)

number_slider_13 = Slider(6, range=0..10)
construct_domain_3 = ConstructDomain(DomainStart=100000, DomainEnd=10000000)
number_12 = Number(construct_domain_3)
construct_domain_4 = ConstructDomain(DomainStart=10000, DomainEnd=graft(construction_cost_m2_2))
construct_domain_5 = ConstructDomain(DomainStart=100000, DomainEnd=graft(cut_volume_cost_2))
construct_domain_6 = ConstructDomain(DomainStart=100000, DomainEnd=graft(fill_volume_cost_local_2))
construct_domain_7 = ConstructDomain(DomainStart=100000, DomainEnd=graft(fill_volume_cost_foreign_2))
construct_domain_8 = ConstructDomain(DomainStart=500, DomainEnd=graft(soft_cost_2))
remap_numbers = RemapNumbers(Value=graft(house_income_m2_2), Source=number_12, Target=construct_domain_3)  # -> Mapped, Clipped
range_2 = Range(Domain=remap_numbers.Mapped, Steps=number_slider_13)
range_3 = Range(Domain=construct_domain_4, Steps=number_slider_13)
range_4 = Range(Domain=construct_domain_5, Steps=number_slider_13)
range_5 = Range(Domain=construct_domain_6, Steps=number_slider_13)
range_6 = Range(Domain=construct_domain_7, Steps=number_slider_13)
range_7 = Range(Domain=construct_domain_8, Steps=number_slider_13)
entwine_9 = Entwine(
    Branch00=range_2,
    Branch01=range_3,
    Branch02=range_4,
    Branch03=range_5,
    Branch04=range_6,
    Branch05=range_7,
    FlattenInputs=True)

remap_numbers_2 = RemapNumbers(Value=house_income_m2_2, Source=Slider(0, range=0..1), Target=construct_domain_2)  # -> Mapped, Clipped
merge_2 = Merge(
    Data1=remap_numbers_2.Mapped,
    Data2=remap_numbers_2.Mapped,
    Data3=construction_cost_m2_2,
    Data4=construction_cost_m2_2,
    Data5=cut_volume_cost_2,
    Data6=cut_volume_cost_2,
    Data7=fill_volume_cost_local_2,
    Data8=fill_volume_cost_local_2,
    Data9=fill_volume_cost_foreign_2,
    Data10=fill_volume_cost_foreign_2,
    Data11=soft_cost_2,
    Data12=soft_cost_2)

panel_26 = Panel("""HOUSE INCOME / M2 ($)
CONSTRUCTION COST M2 / ($) 
CUT VOLUME COST ($)
FILL VOLUME COST ($) - LOCAL
FILL VOLUME COST ($) - FOREIGN 
SOFT COST (%)}
FINANCIAL OUTPUTS""")
reverse_list = ReverseList(List=panel_26)
conduit_font_2 = ConduitFont(
    StyleName="FINANCIAL",
    Font="BankGothic Md BT",
    TextHeight=Slider(6.704, range=0..10),
    AdaptiveHeight=Toggle(False),
    TextSpacing=Slider(0.209, range=0..1),
    Alignment=0,
    Bold=Toggle(True),
    Italic=False,
    Color=ColourSwatch(SwatchColor=RGB(255, 255, 255)))
curve_5 = Curve(<curve referenced from the Rhino model>)
draw_chart = DrawChart(
    Boundary=curve_5,
    Data=entwine_9,
    Categories=reverse_list,
    AxisPadding=Slider(0.309, range=0..1),
    CategoryPadding=Slider(0, range=0..1),
    CategorySpacing=Slider(-3.734, range=-200..100),
    LineWeight=2,
    ChartFont=conduit_font_2,
    ColorPalette=entwine_3,
    IsBar=True,
    IsColumn=False,
    IsLine=False)

nyc = Panel("""38
36
40
25
20
33
39
39
44
50
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""")
la = Panel("""54
56
53
62
54
52
52
53
53
57
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""")
miami = Panel("""79
78
72
66
66
70
69
72
74
76
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""")
entwine_10 = Entwine(Branch00=nyc, Branch01=la, Branch02=miami, FlattenInputs=True)  # -> simplify(Result)
curve_6 = Curve(<curve referenced from the Rhino model>)

# ----
# You can specify the line weights for each series
number_slider_14 = Slider(1, range=1..5)
tree_statistics_2 = TreeStatistics(Tree=entwine_10)  # -> Paths, Length, Count
list_length_4 = ListLength(List=tree_statistics_2.Paths)
repeat_data = RepeatData(Data=number_slider_14, Length=list_length_4)
replace_items = ReplaceItems(List=repeat_data, Item=Slider(3, range=1..5), Indices=Slider(0, range=0..2), Wrap=False)

draw_chart_2 = DrawChart(
    Boundary=curve_6,
    Data=entwine_10,
    ValueAxisRange="0 to 90",
    AxisPadding=0.1,
    CategoryPadding=0.1,
    CategorySpacing=0.2,
    LineWeight=replace_items,
    IsBar=False,
    IsColumn=False,
    IsLine=True)

merge_3 = Merge(Data3=draw_pie_chart, Data4=draw_chart, Data5=draw_text, Data7=draw_chart_2)  # -> flatten(Result)

# ---- group: utility for getting the current active viewport
point = Point(Point(11.73649984, -303.2999099, 0))

# ----
move_17 = Move(Geometry=point, Motion=unit_x)  # -> Geometry, Transform

# ---- group: utility for getting the current active viewport (continued)
get_viewport_boundary_dimensions = GetViewportBoundaryDimensions(Refresh=Button(), Origin=move_17.Geometry, Scale=Slider(0.12, range=0..1), xDim=1726, yDim=779)

# ---- group: Right-click the HUD component icon to load a style sheet from file
# These are some of the default style names that components use if no style information is passed to them.
# 
# In your style sheet, if you create styles with these names, then components will default to those when your style sheet is loaded
# Main Defaults: Default Font
# Default Chart Font
# Default Palette
# Default Pie
# Default Axis
# Default Curve
heads_up_display_hud = HeadsUpDisplayHUD(
    ShowHUD=Toggle(True),
    DrawingObjects=merge_3,
    DrawingBoundary=get_viewport_boundary_dimensions,
    ConduitStyleSheet="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")

# ==== cluster Cluster
breps = ClusterInput()
brep_join = BrepJoin(Breps=breps)  # -> Breps, Closed
volume = Volume(Geometry=brep_join.Breps)  # -> Volume, Centroid
volume_2 = ClusterOutput(volume.Volume)

# ==== cluster Cluster_2
breps = ClusterInput()
brep_join = BrepJoin(Breps=breps)  # -> Breps, Closed
solid_union = SolidUnion(Breps=brep_join.Breps)
volume = Volume(Geometry=solid_union)  # -> Volume, Centroid
volume_2 = ClusterOutput(volume.Volume)
