# Grasshopper definition Branch2.5.1.0Alpha_Latiz Hypaar.gh (Grasshopper 1.0.4)
# plug-ins: ProvingGround.Conduit, Pufferfish, Blindfold, Biomorpher, Wallacei

brep = Brep(<brep referenced from the Rhino model>)
brep_2 = Brep(<brep referenced from the Rhino model>)
brep_3 = Brep(<brep referenced from the Rhino model>)
brep_join = BrepJoin(Breps=[brep, brep_2, brep_3])  # -> Breps, Closed

# ----
# TOPOGRAPHY MESH PANEL
limite_layout = Slider(0.42, range=0..1)
lote = Slider(24, range=0..100)
reticula_grid = Slider(7, range=1..15)
angle_range = Slider(18, range=1..30)
distance_point_groups = Slider(13, range=1..55)
rotación_grid = Slider(0.2, range=0..0.5)
layout_cell_radius = Slider(32, range=15..50)
lados_poligono = Slider(50, range=0..60)

anchor_point = Slider(234, range=0..248)
rotation = Slider(144, range=0..360)
altura_desplante_huella = Slider(1, range=1..3)
cut = Slider(-24, range=-30..-20)

layout_cell_radius_2 = Slider(28.172, range=15..50)
terraplane_region = Slider(2.5, range=0..6)
cut_2 = Slider(-6, range=-25..0)
layout_cell_radius_3 = Slider(32, range=15..50)
limite_layout_2 = Slider(0.42, range=0..1)
lados_poligono_2 = Slider(50, range=0..60)
rotation_2 = Slider(106, range=0..360)
lote_golf = Slider(0, range=0..13)

fill_volume_cost_foreign = Panel("63.77")
fill_volume_cost_local = Panel("115.200")
cut_volume_cost = Panel("63.770")
number = Number(cut_volume_cost)
number_2 = Number(fill_volume_cost_local)
number_3 = Number(fill_volume_cost_foreign)
galapagos = Galapagos(fitness=ratio_2, gene=[number_slider_8, number_slider_7, number_slider_5])

# ----
# BIG BOXES
brep_4 = Brep([<brep referenced from the Rhino model> x59])

area = Area(Geometry=brep_4)  # -> Area, Centroid
sort_list = SortList(Keys=area.Area, ValuesValuesA=brep_4)  # -> Keys, ValuesValuesA
reverse_list = ReverseList(List=sort_list.ValuesValuesA)

list_length = ListLength(List=reverse_list)
series = Series(Start=0, Step=1, Count=list_length)
list_item = ListItem(List=reverse_list, Index=lote, Wrap=True)
list_item_2 = ListItem(List=reverse_list, Index=series, Wrap=True)
item_index = ItemIndex(List=reverse_list, Item=list_item)
item_index_2 = ItemIndex(List=reverse_list, Item=list_item_2)
equality = Equality(FirstNumber=item_index, SecondNumber=item_index_2)  # -> Equality, Inequality
dispatch = Dispatch(List=reverse_list, DispatchPattern=equality.Equality)  # -> ListA, ListB
blindfold = Blindfold(Refresh=Button(), Visibility=Toggle(False), Limited=dispatch.ListB)
blindfold_2 = Blindfold(Refresh=Button(), Visibility=Toggle(True), Limited=list_item)

# ----
# VISUALIZATION
#  ENVIRONMENT
list_item_3 = ListItem(List=reverse_list, Index=lote_golf, Wrap=True)
panel = Panel("""LOTE 12
LOTE 22
LOTE 24
LOTE A
LOTE 7
LOTE 8
LOTE 52
LOTE 35
LOTE 31-B
LOTE 20
LOTE 33
LOTE 34
LOTE 37
LOTE 21
LOTE 32
LOTE 16
LOTE 28
LOTE 27
LOTE R
LOTE R
LOTE 17
LOTE 18
LOTE 9
LOTE 13
LOTE 26
LOTE 15
LOTE 23 
LOTE 21
LOTE 14
LOTE 25
LOTE B
LOTE 3-5
LOTE 6
LOTE 10
LOTE 2
LOTE 11
LOTE 51
LOTE 31-A
LOTE 22
LOTE 38
LOTE 36
LOTE 39
LOTE 40
LOTE D
LOTE 41
LOTE 49
LOTE 53
LOTE 50
LOTE 30 
LOTE E
LOTE 46
LOTE 47
LOTE 48
LOTE 44
LOTE 43
LOTE 45
LOTE 42
LOTE 29
LOTE 29-A
C.S.A.G""")
item_index_3 = ItemIndex(List=reverse_list, Item=list_item_3)
area_2 = Area(Geometry=reverse_list)  # -> Area, graft(Centroid)
equality_2 = Equality(FirstNumber=item_index_3, SecondNumber=item_index_2)  # -> Equality, Inequality
dispatch_2 = Dispatch(List=reverse_list, DispatchPattern=equality_2.Equality)  # -> ListA, ListB
graft_tree = GraftTree(Tree=panel, IncludeEmptyLists=True, IncludeNullItems=True)
text_tag = TextTag(Location=area_2.Centroid, Text=graft_tree, Colour=ColourSwatch(SwatchColor=RGB(0, 0, 0)))
blindfold_3 = Blindfold(Refresh=Button(), Visibility=Toggle(False), Limited=dispatch_2.ListB)
blindfold_4 = Blindfold(Refresh=Button(), Visibility=Toggle(True), Limited=list_item_3)

# ----
# TOPOGRAPHY
# MESH ANALYSIS
cluster = Cluster(
    brep=brep_join.Breps,
    B_2=reticula_grid,
    factor=rotación_grid,
    B=reticula_grid,
    second_number=angle_range,
    distance=distance_point_groups)  # -> mesh_2, groups
cluster_2 = Cluster(
    brep=list_item_3,
    B_2=reticula_grid,
    factor=rotación_grid,
    B=reticula_grid,
    second_number=angle_range,
    distance=distance_point_groups)  # -> mesh_2, groups
mesh = Mesh(cluster.mesh_2)
cloud_display = CloudDisplay(Points=cluster.groups, Colours=ColourSwatch(SwatchColor=RGB(255, 255, 255)), Size=1, SpriteType=0)
mesh_2 = Mesh(cluster_2.mesh_2)
cloud_display_2 = CloudDisplay(Points=cluster_2.groups, Colours=ColourSwatch(SwatchColor=RGB(255, 255, 255)), Size=1, SpriteType=0)

panel_2 = Panel(item_index)

# ----
# TRIANGULATE NEW
# BOUNDARY POLYGON
voronoi = Voronoi(Points=cluster.groups, Radius=layout_cell_radius, BruteForceOverride=False)
number_slider = Slider(10, range=0..10)
boundary_surfaces = BoundarySurfaces(Edges=voronoi)
settings_custom = SettingsCustom(
    StitchSeams=True,
    SimplePlanes=False,
    Refine=True,
    MinCount=10,
    MaxCount=400,
    AspectRatio=20,
    MaxDistance=0,
    MaxAngle=20,
    MinEdge=number_slider,
    MaxEdge=number_slider)
brep_join_2 = BrepJoin(Breps=boundary_surfaces)  # -> Breps, Closed
mesh_brep = MeshBrep(Brep=brep_join_2.Breps, Settings=settings_custom)
mesh_edges = MeshEdges(Mesh=mesh_brep)  # -> flatten(NakedEdges), InteriorEdges, NonManifoldEdges
join_curves = JoinCurves(Curves=mesh_edges.NakedEdges, Preserve=False)
length = Length(Curve=join_curves)
sort_list_2 = SortList(Keys=flatten(length), ValuesValuesA=flatten(join_curves))  # -> Keys, ValuesValuesA
reverse_list_2 = ReverseList(List=sort_list_2.ValuesValuesA)
list_item_4 = ListItem(List=reverse_list_2, Index=0, Wrap=True)
boundary_surfaces_2 = BoundarySurfaces(Edges=list_item_4)
area_3 = Area(Geometry=boundary_surfaces_2)  # -> Area, Centroid
scale = Scale(Geometry=list_item_4, Center=area_3.Centroid, Factor=limite_layout)  # -> Geometry, Transform
divide_curve = DivideCurve(Curve=scale.Geometry, Count=lados_poligono, Kinks=False)  # -> Points, Tangents, Parameters
number_slider_2 = Slider(20, range=0..100)
polyline = PolyLine(Vertices=divide_curve.Points, Closed=True)
boundary_surfaces_3 = BoundarySurfaces(Edges=polyline)
divide_surface = DivideSurface(Surface=boundary_surfaces_3, UCount=number_slider_2, VCount=number_slider_2)  # -> flatten(Points), Normals, Parameters
unit_z = UnitZ(Factor=1)
clean_tree = CleanTree(RemoveNulls=True, RemoveInvalid=True, RemoveEmpty=False, Tree=divide_surface.Points)
project_point = ProjectPoint(Point=clean_tree, Direction=unit_z, Geometry=list_item)  # -> Point, Index
clean_tree_2 = CleanTree(RemoveNulls=True, RemoveInvalid=True, RemoveEmpty=False, Tree=project_point.Point)
list_item_5 = ListItem(List=clean_tree_2, Index=anchor_point, Wrap=True)

# ----
# TRIANGULATE NEW
# BOUNDARY POLYGON
voronoi_2 = Voronoi(Points=cluster_2.groups, Radius=layout_cell_radius_3, BruteForceOverride=False)
number_slider_3 = Slider(10, range=0..10)
boundary_surfaces_4 = BoundarySurfaces(Edges=voronoi_2)
settings_custom_2 = SettingsCustom(
    StitchSeams=True,
    SimplePlanes=False,
    Refine=True,
    MinCount=10,
    MaxCount=400,
    AspectRatio=20,
    MaxDistance=0,
    MaxAngle=20,
    MinEdge=number_slider_3,
    MaxEdge=number_slider_3)
brep_join_3 = BrepJoin(Breps=boundary_surfaces_4)  # -> Breps, Closed
mesh_brep_2 = MeshBrep(Brep=brep_join_3.Breps, Settings=settings_custom_2)
mesh_edges_2 = MeshEdges(Mesh=mesh_brep_2)  # -> flatten(NakedEdges), InteriorEdges, NonManifoldEdges
join_curves_2 = JoinCurves(Curves=mesh_edges_2.NakedEdges, Preserve=False)
length_2 = Length(Curve=join_curves_2)
sort_list_3 = SortList(Keys=flatten(length_2), ValuesValuesA=flatten(join_curves_2))  # -> Keys, ValuesValuesA
reverse_list_3 = ReverseList(List=sort_list_3.ValuesValuesA)
list_item_6 = ListItem(List=reverse_list_3, Index=0, Wrap=True)
boundary_surfaces_5 = BoundarySurfaces(Edges=list_item_6)
area_4 = Area(Geometry=boundary_surfaces_5)  # -> Area, Centroid
scale_2 = Scale(Geometry=list_item_6, Center=area_4.Centroid, Factor=limite_layout_2)  # -> Geometry, Transform
divide_curve_2 = DivideCurve(Curve=scale_2.Geometry, Count=lados_poligono_2, Kinks=False)  # -> Points, Tangents, Parameters
number_slider_4 = Slider(20, range=0..100)
polyline_2 = PolyLine(Vertices=divide_curve_2.Points, Closed=True)
boundary_surfaces_6 = BoundarySurfaces(Edges=polyline_2)
divide_surface_2 = DivideSurface(Surface=boundary_surfaces_6, UCount=number_slider_4, VCount=number_slider_4)  # -> flatten(Points), Normals, Parameters
unit_z_2 = UnitZ(Factor=1)
clean_tree_3 = CleanTree(RemoveNulls=True, RemoveInvalid=True, RemoveEmpty=False, Tree=divide_surface_2.Points)
project_point_2 = ProjectPoint(Point=clean_tree_3, Direction=unit_z_2, Geometry=list_item_3)  # -> Point, Index
clean_tree_4 = CleanTree(RemoveNulls=True, RemoveInvalid=True, RemoveEmpty=False, Tree=project_point_2.Point)
list_item_7 = ListItem(List=clean_tree_4, Index=anchor_point, Wrap=True)

# ----
# PROJECT BOUNDARY GOLF
curve = Curve([<curve referenced from the Rhino model> x8])
join_curves_3 = JoinCurves(Curves=curve, Preserve=False)
boundary_surfaces_7 = BoundarySurfaces(Edges=join_curves_3)
area_5 = Area(Geometry=list_item_3)  # -> Area, Centroid
area_6 = Area(Geometry=boundary_surfaces_7)  # -> Area, Centroid
move_2pt = Move2Pt(Geometry=join_curves_3, PointA=area_6.Centroid, PointB=area_5.Centroid)  # -> Moved, Vector, Transform
unit_z_3 = UnitZ(Factor=Slider(40, range=0..100))
degrees = Degrees(Radians=rotation_2)
move = Move(Geometry=move_2pt.Moved, Motion=unit_z_3)  # -> Geometry, Transform
xy_plane = XYPlane(Origin=area_5.Centroid)

# ----
# TERRAIN AREA
area_7 = Area(Geometry=list_item)  # -> Area, Centroid

round = Round(Number=area_7.Area)  # -> Nearest, Floor, Ceiling

# ----
# TIPOLOGY "B"
number_slider_5 = Slider(99, range=0..100)
number_slider_6 = Slider(143, range=0..150)
division = Division(A=number_slider_6, B=2)
division_2 = Division(A=number_slider_5, B=2)

# ----
# TIPOLOGY "A"
number_slider_7 = Slider(78, range=75..90)
number_slider_8 = Slider(81, range=80..130)
xy_plane_2 = XYPlane(Origin=area_7.Centroid)
division_3 = Division(A=number_slider_8, B=2)
division_4 = Division(A=number_slider_7, B=2)

center_box = CenterBox(Base=xy_plane_2, X=division_2, Y=division, Z=0)
brep_wireframe = BrepWireframe(Brep=center_box, Density=-1)
join_curves_4 = JoinCurves(Curves=brep_wireframe, Preserve=False)
area_8 = Area(Geometry=join_curves_4)  # -> Area, Centroid

larger_than = LargerThan(FirstNumber=number_slider_8, SecondNumber=number_slider_7)  # -> LargerThan, OrEqualTo
center_box_2 = CenterBox(Base=xy_plane_2, X=division_3, Y=division_4, Z=0)
brep_wireframe_2 = BrepWireframe(Brep=center_box_2, Density=-1)
join_curves_5 = JoinCurves(Curves=brep_wireframe_2, Preserve=False)
ghpython_script = GhPythonScript(x=larger_than.LargerThan, y=number_slider_8, z=number_slider_7, u=larger_than.OrEqualTo)  # -> out, a
# ---------- ghpython_script: Python ----------
"""Provides a scripting component.
    Inputs:
        x:
        y:
    Output:
        a: The a output variable"""

__author__ = "Sergio"
__version__ = "2019.03.28"

if x == True:
    a = y/z
elif u == False:
    a = z/y
elif u == True:
    a = 1
print(a)
# ---------- end ghpython_script ----------

area_9 = Area(Geometry=join_curves_5)  # -> Area, Centroid

merge = Merge(Data1=join_curves_5, Data2=join_curves_4)
merge_2 = Merge(Data1=area_9.Area, Data2=area_8.Area)
ghpython_script_2 = GhPythonScript(Area_tp=round.Ceiling, lst=merge_2)  # -> out, B; inputs Area_tp: Int32, lst: list of Int32
# ---------- ghpython_script_2: Python ----------
"""Provides a scripting component.
    Inputs:
        x:
        y:
    Output:
        a: The a output variable"""

__author__ = "Sergio"
__version__ = "2019.03.28"

a=(min(lst, key=lambda x:abs(x-Area_tp)))
if Area_tp < a:
    print(lst[1])
else:
    print(a)
    B=lst[1]
# ---------- end ghpython_script_2 ----------
round_2 = Round(Number=merge_2)  # -> Nearest, Floor, Ceiling
round_3 = Round(Number=ghpython_script_2.out)  # -> Nearest, Floor, Ceiling
equality_3 = Equality(FirstNumber=round_2.Nearest, SecondNumber=round_3.Nearest)  # -> Equality, Inequality
dispatch_3 = Dispatch(List=merge, DispatchPattern=equality_3.Equality)  # -> ListA, ListB

panel_3 = Panel(ghpython_script.a)
ratio = Integer(panel_3)
ratio_2 = Number(ratio)

# ----
# SURFACE BOUNDARY GOLF
number_slider_9 = Slider(5, range=0..10)
rotate = Rotate(Geometry=move.Geometry, Angle=degrees, Plane=xy_plane)  # -> Geometry, Transform
project = Project(Curve=rotate.Geometry, Brep=list_item_3, Direction=Vector(0, 0, 1))  # -> flatten(Curve)
unit_z_4 = UnitZ(Factor=number_slider_9)
join_curves_6 = JoinCurves(Curves=project, Preserve=False)
extrude = Extrude(Base=join_curves_6, Direction=unit_z_4)
area_10 = Area(Geometry=extrude)  # -> Area, Centroid

# ----
# GOLF COOURT
move_2pt_2 = Move2Pt(Geometry=join_curves_6, PointA=area_10.Centroid, PointB=list_item_7)  # -> Moved, Vector, Transform
fill_volume_cost_foreign_2 = Panel("63.77")
fill_volume_cost_local_2 = Panel("115.200")
cut_volume_cost_2 = Panel("63.770")
number_4 = Number(fill_volume_cost_local_2)
number_5 = Number(cut_volume_cost_2)
number_6 = Number(fill_volume_cost_foreign_2)
curve_2 = Curve(<curve referenced from the Rhino model>)
curve_3 = Curve(<curve referenced from the Rhino model>)
curve_4 = Curve(<curve referenced from the Rhino model>)
cluster_3 = Cluster_8(boundary=curve_4)

list_item_8 = ListItem(List=move_2pt_2.Moved, Index=0, Wrap=True)  # -> Item, Item1
curve_5 = Curve(list_item_8.Item)
patch = Patch(Curves=curve_5, Spans=20, Flexibility=1, Trim=True)
surface_split = SurfaceSplit(Surface=patch, Curves=join_curves_6)
list_item_9 = ListItem(List=surface_split, Index=0, Wrap=True)  # -> Item, Item1
brep_5 = Brep(list_item_9.Item1)

# ----
# FILL & CUT GEOMETRY INTERSECTION
unit_z_5 = UnitZ(Factor=terraplane_region)
extrude_2 = Extrude(Base=brep_5, Direction=unit_z_5)
split_brep = SplitBrep(Brep=extrude_2, Cutter=list_item_3)
brep_6 = Brep(extrude_2)
unit_z_6 = UnitZ(Factor=cut_2)
list_item_10 = ListItem(List=split_brep, Index=0, Wrap=True)  # -> Item, Item1, Item2
panel_4 = Panel(terraplane_region)
multiplication = Multiplication(A="158", B="125")
multiplication_2 = Multiplication(A="125", B="125")
multiplication_3 = Multiplication(A="125", B="49")
ghpython_script_3 = GhPythonScript(SUM=[multiplication, multiplication_2, multiplication_3])  # -> out, a; inputs SUM: list
# ---------- ghpython_script_3: Python ----------
"""Provides a scripting component.
    Inputs:
        x:
        y:
    Output:
        a: The a output variable"""

__author__ = "Sergio"
__version__ = "2019.03.28"

import math as math
ab=[]
for num in SUM:
    ab.append(num)
    lst = (math.fsum(ab))
    a=lst
# ---------- end ghpython_script_3 ----------
multiplication_4 = Multiplication(A=ghpython_script_3.a, B=panel_4)
custom_preview = CustomPreview(Geometry=brep_6, Material=ColourSwatch(SwatchColor=RGB(0, 255, 255)))

brep_7 = Brep(list_item_10.Item2)

extrude_3 = Extrude(Base=brep_7, Direction=unit_z_6)
volume = Volume(Geometry=extrude_3)  # -> Volume, Centroid
subtraction = Subtraction(A=multiplication_4, B=volume.Volume)
custom_preview_2 = CustomPreview(Geometry=extrude_3, Material=ColourSwatch(SwatchColor=RGB(255, 0, 0)))

multiplication_5 = Multiplication(A=number_6, B=subtraction)
multiplication_6 = Multiplication(A=number_4, B=subtraction)
multiplication_7 = Multiplication(A=number_5, B=volume.Volume)
round_4 = Round(Number=multiplication_7)  # -> Nearest, Floor, Ceiling
round_5 = Round(Number=multiplication_5)  # -> Nearest, Floor, Ceiling
round_6 = Round(Number=multiplication_6)  # -> Nearest, Floor, Ceiling
fill_volume_cost_foreign_3 = Panel(round_5.Nearest)
fill_volume_cost_local_3 = Panel(round_6.Nearest)
cut_volume_cost_3 = Panel(round_4.Nearest)
cluster_4 = Cluster_6(_0_0=fill_volume_cost_foreign_3, _0_1=fill_volume_cost_local_3, boundary_rectangle=curve_2, _0_2=cut_volume_cost_3)
cluster_5 = Cluster_7(_0_0=fill_volume_cost_foreign_3, _0_1=fill_volume_cost_local_3, _0_2=cut_volume_cost_3, boundary_rectangle=curve_3)

# ----
# FLOOR PLAN REAL
curve_6 = Curve(dispatch_3.ListA)
degrees_2 = Degrees(Radians=rotation)
unit_z_7 = UnitZ(Factor=altura_desplante_huella)

area_11 = Area(Geometry=curve_6)  # -> Area, Centroid

xy_plane_3 = XYPlane(Origin=area_11.Centroid)
rotate_2 = Rotate(Geometry=curve_6, Angle=degrees_2, Plane=xy_plane_3)  # -> Geometry, Transform
move_2 = Move(Geometry=rotate_2.Geometry, Motion=unit_z_7)  # -> Geometry, Transform
move_2pt_3 = Move2Pt(Geometry=move_2.Geometry, PointA=area_11.Centroid, PointB=list_item_5)  # -> Moved, Vector, Transform

# ----
# PARKING LOT
panel_5 = Panel("-4")
integer = Integer(panel_5)
unit_z_8 = UnitZ(Factor=integer)
move_3 = Move(Geometry=move_2pt_3.Moved, Motion=unit_z_8)  # -> Geometry, Transform
loft = Loft(
    Curves=[move_3.Geometry, move_2pt_3.Moved],
    Options={Adjust=False, Closed=False, LoftEnds=0, LoftSimp=0, LoftType=0, Rebuild=10, Refit=0.01})
custom_preview_3 = CustomPreview(Geometry=loft, Material=ColourSwatch(SwatchColor=RGB(0, 255, 17)))

# ----
# OUTPUTS
area_12 = Area(Geometry=move_2pt_3.Moved)  # -> Area, Centroid
area_13 = Area(Geometry=move_3.Geometry)  # -> Area, Centroid

# ----
# FILL & CUT GEOMETRY INTERSECTION
unit_z_9 = UnitZ(Factor=cut)
move_4 = Move(Geometry=move_3.Geometry, Motion=unit_z_9)  # -> Geometry, Transform
area_14 = Area(Geometry=move_3.Geometry)  # -> Area, Centroid
area_15 = Area(Geometry=move_4.Geometry)  # -> Area, Centroid
boundary_surfaces_8 = BoundarySurfaces(Edges=move_4.Geometry)
brep_8 = Brep(list_item)
distance = Distance(PointA=area_14.Centroid, PointB=area_15.Centroid)
unit_z_10 = UnitZ(Factor=distance)

# ----
# FILL
extrude_4 = Extrude(Base=boundary_surfaces_8, Direction=unit_z_10)
solid_difference = SolidDifference(BrepsA=extrude_4, BrepsB=brep_8)
custom_preview_4 = CustomPreview(Geometry=solid_difference, Material=ColourSwatch(SwatchColor=RGB(0, 255, 255)))
volume_2 = Volume(Geometry=solid_difference)  # -> Volume, Centroid

split_brep_2 = SplitBrep(Brep=extrude_4, Cutter=brep_8)
list_item_11 = ListItem(List=split_brep_2, Index=0, Wrap=True)

# ----
# CUT
colour_swatch = ColourSwatch(SwatchColor=RGB(255, 0, 0))
volume_3 = Volume(Geometry=extrude_4)  # -> Volume, Centroid
custom_preview_5 = CustomPreview(Geometry=list_item_11, Material=colour_swatch)
subtraction_2 = Subtraction(A=volume_3.Volume, B=volume_2.Volume)

multiplication_8 = Multiplication(A=number, B=subtraction_2)
multiplication_9 = Multiplication(A=number_3, B=volume_2.Volume)
multiplication_10 = Multiplication(A=number_2, B=volume_2.Volume)

round_7 = Round(Number=multiplication_8)  # -> Nearest, Floor, Ceiling
round_8 = Round(Number=multiplication_9)  # -> Nearest, Floor, Ceiling
round_9 = Round(Number=multiplication_10)  # -> Nearest, Floor, Ceiling
fill_volume_cost_local_4 = Panel(round_9.Nearest)
fill_volume_cost_foreign_4 = Panel(round_8.Nearest)
cut_volume_cost_4 = Panel(round_7.Nearest)

cut_volume_cost_5 = Number(round_7.Nearest)
fill_volume_cost = Number(round_9.Nearest)

# ----
# SUPERSTRUCTURE
num_niveles = Slider(2, range=0..5)
a_entrepiso = Slider(4.5, range=0..10)
addition = Addition(A=num_niveles, B=1)
series_2 = Series(Start=0.25, Step=a_entrepiso, Count=addition)
unit_z_11 = UnitZ(Factor=series_2)
move_5 = Move(Geometry=move_2pt_3.Moved, Motion=unit_z_11)  # -> Geometry, Transform
unit_z_12 = UnitZ(Factor=Slider(0.3, range=0..1))
boundary_surfaces_9 = BoundarySurfaces(Edges=move_5.Geometry)
extrude_5 = Extrude(Base=boundary_surfaces_9, Direction=unit_z_12)
custom_preview_6 = CustomPreview(Geometry=extrude_5, Material=ColourSwatch(SwatchColor=RGBA(253, 0, 255, 112)))

loft_2 = Loft(Curves=move_5.Geometry, Options={Adjust=False, Closed=False, LoftEnds=0, LoftSimp=0, LoftType=0, Rebuild=10, Refit=0.01})

number_slider_10 = Slider(3, range=0..10)
merge_3 = Merge(Data1=extrude_5, Data2=loft, Data3=solid_difference, Data4=loft_2)
settings_custom_3 = SettingsCustom(
    StitchSeams=True,
    SimplePlanes=False,
    Refine=True,
    MinCount=16,
    MaxCount=400,
    AspectRatio=20,
    MaxDistance=0,
    MaxAngle=20,
    MinEdge=number_slider_10,
    MaxEdge=number_slider_10)
flatten_tree = FlattenTree(Tree=merge_3, Path="{0}")
mesh_brep_3 = MeshBrep(Brep=flatten_tree, Settings=settings_custom_3)

custom_preview_7 = CustomPreview(Geometry=loft_2, Material=ColourSwatch(SwatchColor=RGBA(253, 255, 255, 203)))

area_16 = Area(Geometry=move_5.Geometry)  # -> Area, Centroid
ghpython_script_4 = GhPythonScript(SUM=[area_16.Area, area_13.Area])  # -> out, a; inputs SUM: list; same code as ghpython_script_3

round_10 = Round(Number=ghpython_script_4.a)  # -> Nearest, Floor, Ceiling
round_11 = Round(Number=area_12.Area)  # -> Nearest, Floor, Ceiling
round_12 = Round(Number=volume_2.Volume)  # -> Nearest, Floor, Ceiling
round_13 = Round(Number=subtraction_2)  # -> Nearest, Floor, Ceiling
construction_area_m2 = Panel(round_10.Nearest)
floor_plan_area_m2 = Panel(round_11.Nearest)
fill_volume_m3 = Panel(round_12.Nearest)
cut_volume_m3 = Panel(round_13.Nearest)

# ----
# CONDUIT CHARTS
curve_7 = Curve(<curve referenced from the Rhino model>)
curve_8 = Curve(<curve referenced from the Rhino model>)
curve_9 = Curve(<curve referenced from the Rhino model>)
curve_10 = Curve(<curve referenced from the Rhino model>)
curve_11 = Curve(<curve referenced from the Rhino model>)
cluster_6 = Cluster_5(_0_0=floor_plan_area_m2, _0_1=construction_area_m2, _0_2=fill_volume_m3, _0_3=cut_volume_m3, boundary_rectangle=curve_8)
cluster_7 = Cluster_4(_0_0=floor_plan_area_m2, _0_1=construction_area_m2, _0_2=fill_volume_m3, _0_3=cut_volume_m3, boundary_rectangle=curve_9)
cluster_8 = Cluster_3(boundary_rectangle=curve_10, _0_0=fill_volume_cost_foreign_4, _0_1=fill_volume_cost_local_4, _0_2=cut_volume_cost_4)
cluster_9 = Cluster_2(_0_0=fill_volume_cost_foreign_4, _0_1=fill_volume_cost_local_4, _0_2=cut_volume_cost_4, boundary_rectangle=curve_11)
cluster_10 = Cluster_9(boundary=curve_7)
merge_4 = Merge(Data1=cluster_6, Data2=cluster_7, Data3=cluster_8, Data4=cluster_9, Data5=cluster_10)

point = Point(Point(11.73649984, -303.2999099, 0))
unit_x = UnitX(Factor=Slider(-30.544, range=-100..10))
move_6 = Move(Geometry=point, Motion=unit_x)  # -> Geometry, Transform
get_viewport_boundary_dimensions = GetViewportBoundaryDimensions(Refresh=Button(), Origin=move_6.Geometry, Scale=Slider(0.163, range=0..1))
heads_up_display_hud = HeadsUpDisplayHUD(ShowHUD=Toggle(True), DrawingObjects=merge_4, DrawingBoundary=get_viewport_boundary_dimensions)

# ----
# EVOLUTIONARY
# SOLVERS
construction_area = Integer(construction_area_m2)
wallacei_x = WallaceiX(
    Genes=[rotation, anchor_point, altura_desplante_huella, cut, number_slider_8, number_slider_7],
    Objectives=[construction_area, ratio],
    Data=cut_volume_cost_5,
    allFitness="1|56628;1|56628;1|56628;1|56628;1|56628;1|56628",
    allGenomes="90|27|2|-22|113|81_127|234|1|-24|81|79_115|245|2|-23|94|84_115|234|1|-24|80|79_128|245|2|-23|96|84_175|234|1|-24|81|78",
    curFrontIdx="1|0;1|1;1|2",
    popGen="3,2",
    total="172974")  # -> WallaceiGenomes, FitnessValues, Data, Phenotypes
biomorpher = Biomorpher(
    Genome=[anchor_point, rotation, altura_desplante_huella, cut, number_slider_8, number_slider_7, number_slider_5, number_slider_6],
    MeshEs=mesh_brep_3,
    Performance=[ratio, construction_area, fill_volume_cost, cut_volume_cost_5],
    InitialPop=Slider(100, range=0..100))  # -> GenoGuids, Population, Historic, Clusters
decode_phenotype = DecodePhenotype(WallaceiPhenotype=wallacei_x.Phenotypes, RunTheDecoder=Toggle(True))  # -> GeometriesList, MeshesList, NumbersList
decode_genome = DecodeGenome(WallaceiGenome=wallacei_x.WallaceiGenomes)

# ==== cluster Cluster
number_slider = Slider(1.17, range=0..10)
settings_custom = SettingsCustom(
    StitchSeams=True,
    SimplePlanes=False,
    Refine=True,
    MinCount=16,
    MaxCount=400,
    AspectRatio=20,
    MaxDistance=0,
    MaxAngle=20,
    MinEdge=number_slider,
    MaxEdge=number_slider)
brep = ClusterInput()
# TOPOGRAPHY MESH ANALYSIS
# BREP MESH
mesh_brep = MeshBrep(Brep=brep, Settings=settings_custom)
mcomp = Decompose(Mesh=mesh_brep)  # -> Vertices, Faces, Colours, Normals
vcomp = Decompose(Vector=mcomp.Normals)  # -> XComponent, YComponent, ZComponent
expression = Expression(z=vcomp.ZComponent, Expression="Deg(0.0 - (Asin(Abs(z)) - 0.5*π))")
gradient = Gradient(
    LowerLimit=0,
    UpperLimit=90,
    Parameter=expression,
    stops=[0: RGB(101, 153, 5), 0: RGB(0, 128, 0), 0.441: RGB(240, 172, 36), 0.864: RGB(255, 0, 0)])
factor = ClusterInput()
mesh = Mesh(Vertices=mcomp.Vertices, Faces=mcomp.Faces, Colours=gradient)
xy_plane = XYPlane(Origin=Point(0, 0, 0))
pi = Pi(Factor=factor)
rotate_plane = RotatePlane(Plane=xy_plane, Angle=pi)
bounding_box = BoundingBox(Content=mesh, Plane=rotate_plane)  # -> Box, Box_2
deconstruct_brep = DeconstructBrep(Brep=bounding_box.Box)  # -> Faces, Edges, Vertices
B = ClusterInput()
B_2 = ClusterInput()
list_item = ListItem(List=deconstruct_brep.Faces, Index="4", Wrap=True)
dimensions = Dimensions(Surface=list_item)  # -> UDimension, VDimension
division = Division(A=dimensions.VDimension, B=B)
division_2 = Division(A=dimensions.UDimension, B=B_2)
integer = Integer(division_2)
integer_2 = Integer(division)
quad_panels = QuadPanels(Surface=list_item, UDivisions=integer, VDivisions=integer_2)
area = Area(Geometry=quad_panels)  # -> Area, Centroid

unit_z = UnitZ(Factor=1)
project_point = ProjectPoint(Point=area.Centroid, Direction=unit_z, Geometry=mesh)  # -> Point, Index

null_item = NullItem(Item=project_point.Point)  # -> NullFlags, InvalidFlags, Description
dispatch = Dispatch(List=project_point.Point, DispatchPattern=null_item.NullFlags)  # -> ListA, ListB
mesh_closest_point = MeshClosestPoint(Point=dispatch.ListB, Mesh=mesh)  # -> Point, Index, Parameter
mesh_eval = MeshEval(Mesh=mesh, Parameter=mesh_closest_point.Parameter)  # -> Point, Normal, Colour
vcomp_2 = Decompose(Vector=mesh_eval.Normal)  # -> XComponent, YComponent, ZComponent
expression_2 = Expression(z=vcomp_2.ZComponent, Expression="Deg(0.0 - (Asin(Abs(z)) - 0.5*π))")
second_number = ClusterInput()
distance = ClusterInput()
smaller_than = SmallerThan(FirstNumber=expression_2, SecondNumber=second_number)  # -> SmallerThan, OrEqualTo
dispatch_2 = Dispatch(List=mesh_eval.Point, DispatchPattern=smaller_than.SmallerThan)  # -> ListA, ListB
point_groups = PointGroups(Points=dispatch_2.ListA, Distance=distance)  # -> flatten(Groups), Indices
mesh_2 = ClusterOutput(mesh)
groups = ClusterOutput(point_groups.Groups)

# ==== cluster Cluster_2
_0_0 = ClusterInput()
_0_1 = ClusterInput()
_0_2 = ClusterInput()
boundary_rectangle = ClusterInput()

merge = Merge(
    Data1=ColourSwatch(SwatchColor=RGB(10, 186, 255)),
    Data2=ColourSwatch(SwatchColor=RGB(24, 242, 220)),
    Data3=ColourSwatch(SwatchColor=RGB(233, 0, 0)))
conduit_colorpalette = ConduitColorPalette(
    PaletteName="PaletteCrfrfrfrf",
    Seed=Slider(52, range=0..100),
    HueRange=Domain(-0.05, 0.05),
    SaturationRange=Domain(-0.15, 0.15),
    LuminanceRange=Domain(-0.1, 0.1),
    BaseColors=merge)
conduit_pie_style = ConduitPieStyle(
    StyleName="inner values",
    InnerRadius=Slider(0.62, range=0..1),
    OuterRadius=Slider(0.94, range=0..1),
    LabelRadius=Slider(1.11, range=0..2),
    LabelFontFace="BankGothic Md BT",
    RelativeLabelHeight=Slider(0.04, range=0..1),
    LabelColor=ColourSwatch(SwatchColor=RGB(243, 255, 255)))
entwine = Entwine(Branch00=_0_0, Branch01=_0_1, Branch02=_0_2, FlattenInputs=True)  # -> flatten(Result)
text = Text(entwine)
draw_pie_chart = DrawPieChart(
    BoundaryRectangle=boundary_rectangle,
    Labels=text,
    DataValues=entwine,
    PieStyle=conduit_pie_style,
    ColorPalette=conduit_colorpalette)

hud_pie_chart_object = ClusterOutput(draw_pie_chart)

# ==== cluster Cluster_3
_0_0 = ClusterInput()
_0_1 = ClusterInput()
_0_2 = ClusterInput()
boundary_rectangle = ClusterInput()

entwine = Entwine(Branch00=_0_0, Branch01=_0_1, Branch02=_0_2, FlattenInputs=True)  # -> flatten(Result)
panel = Panel("""FILL VOLUME COST ($) -FOREIGN
FILL VOLUME COST (4) - LOCAL
CUT VOLUME COST ($)""")
merge = Merge(
    Data1=ColourSwatch(SwatchColor=RGB(10, 186, 255)),
    Data2=ColourSwatch(SwatchColor=RGB(24, 242, 220)),
    Data3=ColourSwatch(SwatchColor=RGB(233, 0, 0)))
conduit_colorpalette = ConduitColorPalette(
    PaletteName="PaletteCab",
    Seed=Slider(52, range=0..100),
    HueRange=Domain(-0.05, 0.05),
    SaturationRange=Domain(-0.15, 0.15),
    LuminanceRange=Domain(-0.1, 0.1),
    BaseColors=merge)
conduit_pie_style = ConduitPieStyle(
    StyleName="CUIT AND FILL",
    InnerRadius=Slider(0.62, range=0..1),
    OuterRadius=Slider(0.94, range=0..1),
    LabelRadius=Slider(1.11, range=0..2),
    LabelFontFace="BankGothic Md BT",
    RelativeLabelHeight=Slider(0.04, range=0..1),
    LabelColor=ColourSwatch(SwatchColor=RGB(243, 255, 255)))
draw_pie_chart = DrawPieChart(
    BoundaryRectangle=boundary_rectangle,
    Labels=panel,
    DataValues=entwine,
    PieStyle=conduit_pie_style,
    ColorPalette=conduit_colorpalette)

hud_pie_chart_object = ClusterOutput(draw_pie_chart)

# ==== cluster Cluster_4
_0_0 = ClusterInput()
_0_1 = ClusterInput()
_0_2 = ClusterInput()
_0_3 = ClusterInput()
boundary_rectangle = ClusterInput()

entwine = Entwine(Branch00=_0_0, Branch01=_0_1, Branch02=_0_2, Branch03=_0_3, FlattenInputs=True)  # -> flatten(Result)
merge = Merge(
    Data1=ColourSwatch(SwatchColor=RGB(247, 4, 203)),
    Data2=ColourSwatch(SwatchColor=RGB(106, 255, 255)),
    Data3=ColourSwatch(SwatchColor=RGB(102, 102, 255)),
    Data4=ColourSwatch(SwatchColor=RGB(184, 255, 102)))
panel = Panel("""FLOOR PLAN AREA (M2)
CONSTRUCTION AREA (M2)
FILL VOLUME (M3)
CUT VOLUME (M3)""")
conduit_pie_style = ConduitPieStyle(
    StyleName="hola",
    InnerRadius=Slider(0.61, range=0..1),
    OuterRadius=Slider(0.93, range=0..1),
    LabelRadius=Slider(1.19, range=0..2),
    LabelFontFace="BankGothic Md BT",
    RelativeLabelHeight=Slider(0.04, range=0..1),
    LabelColor=ColourSwatch(SwatchColor=RGB(243, 255, 255)))
conduit_colorpalette = ConduitColorPalette(
    PaletteName="a1",
    Seed=Slider(52, range=0..100),
    HueRange=Domain(-0.05, 0.05),
    SaturationRange=Domain(-0.15, 0.15),
    LuminanceRange=Domain(-0.1, 0.1),
    BaseColors=merge)

text = Text(panel)

draw_pie_chart = DrawPieChart(
    BoundaryRectangle=boundary_rectangle,
    Labels=text,
    DataValues=entwine,
    PieStyle=conduit_pie_style,
    ColorPalette=conduit_colorpalette)

hud_pie_chart_object = ClusterOutput(draw_pie_chart)

# ==== cluster Cluster_5
_0_0 = ClusterInput()
_0_1 = ClusterInput()
_0_2 = ClusterInput()
_0_3 = ClusterInput()
boundary_rectangle = ClusterInput()

entwine = Entwine(Branch00=_0_0, Branch01=_0_1, Branch02=_0_2, Branch03=_0_3, FlattenInputs=True)  # -> flatten(Result)
merge = Merge(
    Data1=ColourSwatch(SwatchColor=RGB(247, 4, 203)),
    Data2=ColourSwatch(SwatchColor=RGB(106, 255, 255)),
    Data3=ColourSwatch(SwatchColor=RGB(102, 102, 255)),
    Data4=ColourSwatch(SwatchColor=RGB(184, 255, 102)))
conduit_pie_style = ConduitPieStyle(
    StyleName="abdidhcnekfe",
    InnerRadius=Slider(0.58, range=0..1),
    OuterRadius=Slider(0.91, range=0..1),
    LabelRadius=Slider(1.1, range=0..2),
    LabelFontFace="BankGothic Md BT",
    RelativeLabelHeight=Slider(0.05, range=0..1),
    LabelColor=ColourSwatch(SwatchColor=RGB(243, 255, 255)))
conduit_colorpalette = ConduitColorPalette(
    PaletteName="a3",
    Seed=Slider(52, range=0..100),
    HueRange=Domain(-0.05, 0.05),
    SaturationRange=Domain(-0.15, 0.15),
    LuminanceRange=Domain(-0.1, 0.1),
    BaseColors=merge)

text = Text(entwine)

draw_pie_chart = DrawPieChart(
    BoundaryRectangle=boundary_rectangle,
    Labels=text,
    DataValues=entwine,
    PieStyle=conduit_pie_style,
    ColorPalette=conduit_colorpalette)

hud_pie_chart_object = ClusterOutput(draw_pie_chart)

# ==== cluster Cluster_6
panel = Panel("""FILL VOLUME COST ($)-FOREIGN
FILL VOLUME COST($)-LOCAL
CUT VOLUME COST($)""")
_0_0 = ClusterInput()
_0_1 = ClusterInput()
_0_2 = ClusterInput()
boundary_rectangle = ClusterInput()

merge = Merge(
    Data1=ColourSwatch(SwatchColor=RGB(10, 186, 255)),
    Data2=ColourSwatch(SwatchColor=RGB(24, 242, 220)),
    Data3=ColourSwatch(SwatchColor=RGB(233, 0, 0)))
conduit_colorpalette = ConduitColorPalette(
    PaletteName="EL GOLF",
    Seed=Slider(52, range=0..100),
    HueRange=Domain(-0.05, 0.05),
    SaturationRange=Domain(-0.15, 0.15),
    LuminanceRange=Domain(-0.1, 0.1),
    BaseColors=merge)
entwine = Entwine(Branch00=_0_0, Branch01=_0_1, Branch02=_0_2, FlattenInputs=True)  # -> flatten(Result)
conduit_pie_style = ConduitPieStyle(
    StyleName="GOLFITO",
    InnerRadius=Slider(0.62, range=0..1),
    OuterRadius=Slider(0.94, range=0..1),
    LabelRadius=Slider(1.11, range=0..2),
    LabelFontFace="BankGothic Md BT",
    RelativeLabelHeight=Slider(0.04, range=0..1),
    LabelColor=ColourSwatch(SwatchColor=RGB(243, 255, 255)))
draw_pie_chart = DrawPieChart(
    BoundaryRectangle=boundary_rectangle,
    Labels=panel,
    DataValues=entwine,
    PieStyle=conduit_pie_style,
    ColorPalette=conduit_colorpalette)

hud_pie_chart_object = ClusterOutput(draw_pie_chart)

# ==== cluster Cluster_7
_0_0 = ClusterInput()
_0_1 = ClusterInput()
_0_2 = ClusterInput()
boundary_rectangle = ClusterInput()

merge = Merge(
    Data1=ColourSwatch(SwatchColor=RGB(10, 186, 255)),
    Data2=ColourSwatch(SwatchColor=RGB(24, 242, 220)),
    Data3=ColourSwatch(SwatchColor=RGB(233, 0, 0)))
entwine = Entwine(Branch00=_0_0, Branch01=_0_1, Branch02=_0_2, FlattenInputs=True)  # -> flatten(Result)
conduit_colorpalette = ConduitColorPalette(
    PaletteName="EL GOLF",
    Seed=Slider(52, range=0..100),
    HueRange=Domain(-0.05, 0.05),
    SaturationRange=Domain(-0.15, 0.15),
    LuminanceRange=Domain(-0.1, 0.1),
    BaseColors=merge)
conduit_pie_style = ConduitPieStyle(
    StyleName="GOLFITO",
    InnerRadius=Slider(0.62, range=0..1),
    OuterRadius=Slider(0.94, range=0..1),
    LabelRadius=Slider(1.11, range=0..2),
    LabelFontFace="BankGothic Md BT",
    RelativeLabelHeight=Slider(0.04, range=0..1),
    LabelColor=ColourSwatch(SwatchColor=RGB(243, 255, 255)))
text = Text(entwine)
draw_pie_chart = DrawPieChart(
    BoundaryRectangle=boundary_rectangle,
    Labels=text,
    DataValues=entwine,
    PieStyle=conduit_pie_style,
    ColorPalette=conduit_colorpalette)

hud_pie_chart_object = ClusterOutput(draw_pie_chart)

# ==== cluster Cluster_8
conduit_font = ConduitFont(
    StyleName="BIG BOX",
    Font="BankGothic Md BT",
    TextHeight=Slider(13, range=0..100),
    AdaptiveHeight=False,
    TextSpacing=Slider(4.135, range=0..10),
    Alignment=0,
    Bold=False,
    Italic=False,
    Color=RGB(0, 0, 0))
text = Text("GOLF COURT PERFORMANCE")
boundary = ClusterInput()
draw_text = DrawText(
    Boundary=boundary,
    Text=text,
    TextOrdering=1,
    TextDistribution=0,
    ColorOverride=ColourSwatch(SwatchColor=RGB(255, 255, 255)),
    OrientVertically=False,
    CustomFont=conduit_font)
drawing_object = ClusterOutput(draw_text)

# ==== cluster Cluster_9
conduit_font = ConduitFont(
    StyleName="BIG BOX",
    Font="BankGothic Md BT",
    TextHeight=Slider(18, range=0..100),
    AdaptiveHeight=False,
    TextSpacing=Slider(4.135, range=0..10),
    Alignment=0,
    Bold=False,
    Italic=False,
    Color=RGB(0, 0, 0))
text = Text("BIG BOXES PERFORMANCE")
boundary = ClusterInput()
draw_text = DrawText(
    Boundary=boundary,
    Text=text,
    TextOrdering=1,
    TextDistribution=0,
    ColorOverride=ColourSwatch(SwatchColor=RGB(255, 255, 255)),
    OrientVertically=False,
    CustomFont=conduit_font)
drawing_object = ClusterOutput(draw_text)
