# Grasshopper definition Branch2.5.1.1Alpha_Latiz Hypaar.gh (Grasshopper 1.0.4)
# plug-ins: ProvingGround.Conduit, Pufferfish, Blindfold, Biomorpher, Wallacei

# ----
# TOPOGRAPHY MESH PANEL
lote = Slider(1, range=0..100)
reticula_grid = Slider(7, range=1..15)
angle_range = Slider(20, range=1..30)
distance_point_groups = Slider(22, range=1..55)
rotación_grid = Slider(0.12, range=0..0.5)
layout_cell_radius = Slider(27.76, range=15..50)
limite_layout = Slider(0.65, range=0..1)
lados_poligono = Slider(22, range=0..60)

rotation = Slider(148, range=0..360)
anchor_point = Slider(228, range=0..335)
altura_desplante_huella = Slider(2, range=-20..35)
cut = Slider(-35, range=-35..0)

# ----
# CUT VOLUME & AREA
# FILL VOLUME & AREA
colour_swatch = ColourSwatch(SwatchColor=RGB(214, 39, 0))
custom_preview = CustomPreview(Material=colour_swatch)
custom_preview_2 = CustomPreview(Material=ColourSwatch(SwatchColor=RGBA(0, 255, 255, 97)))
flatten_tree = FlattenTree(Path="{0}")
brep_join = BrepJoin(Breps=flatten_tree)  # -> Breps, Closed
flatten_tree_2 = FlattenTree(Path="{0}")
brep_join_2 = BrepJoin(Breps=flatten_tree_2)  # -> Breps, Closed

boundary_surfaces = BoundarySurfaces()
# OUTPUTS
mesh_brep = MeshBrep(
    Brep=boundary_surfaces,
    Settings={GridMaxCount=0, GridMinCount=16, JaggedSeams=False, MaxEdgeLength=0, MinEdgeLength=0.0001, MinTolerance=0, Refine=True, RefineAngle=0, RelativeTolerance=0.65, SimplePlanes=True, Tolerance=0})
area = Area(Geometry=mesh_brep)  # -> flatten(Area), flatten(Centroid)
clean_tree = CleanTree(RemoveNulls=True, RemoveInvalid=invert(True), RemoveEmpty=invert(False), Tree=area.Area)
number = Number(clean_tree)
ghpython_script = GhPythonScript(SUM=number)  # -> out, a; inputs SUM: list
# ---------- ghpython_script: Python ----------
"""Provides a scripting component.
    Inputs:
        x:
        y:
    Output:
        a: The a output variable"""

__author__ = "Sergio"
__version__ = "2019.03.28"

import math as math
ab=[]
for num in SUM:
    ab.append(num)
    lst = (math.fsum(ab))
    a=lst
# ---------- end ghpython_script ----------

mesh_brep_2 = MeshBrep(Settings={GridMaxCount=0, GridMinCount=16, JaggedSeams=False, MaxEdgeLength=0, MinEdgeLength=0.0001, MinTolerance=0, Refine=True, RefineAngle=0, RelativeTolerance=0.65, SimplePlanes=True, Tolerance=0})
mesh_brep_3 = MeshBrep(Settings={GridMaxCount=0, GridMinCount=16, JaggedSeams=False, MaxEdgeLength=0, MinEdgeLength=0.0001, MinTolerance=0, Refine=True, RefineAngle=0, RelativeTolerance=0.65, SimplePlanes=True, Tolerance=0})
mesh_brep_4 = MeshBrep(Settings={GridMaxCount=0, GridMinCount=16, JaggedSeams=False, MaxEdgeLength=0, MinEdgeLength=0.0001, MinTolerance=0, Refine=True, RefineAngle=0, RelativeTolerance=0.65, SimplePlanes=True, Tolerance=0})
mesh_brep_5 = MeshBrep(Settings={GridMaxCount=0, GridMinCount=16, JaggedSeams=False, MaxEdgeLength=0, MinEdgeLength=0.0001, MinTolerance=0, Refine=True, RefineAngle=0, RelativeTolerance=0.65, SimplePlanes=True, Tolerance=0})

mesh_brep_6 = MeshBrep(
    Brep=brep_join.Breps,
    Settings={GridMaxCount=0, GridMinCount=16, JaggedSeams=False, MaxEdgeLength=0, MinEdgeLength=0.0001, MinTolerance=0, Refine=True, RefineAngle=0, RelativeTolerance=0.65, SimplePlanes=True, Tolerance=0})  # -> flatten(Mesh)
mesh_brep_7 = MeshBrep(
    Brep=brep_join_2.Breps,
    Settings={GridMaxCount=0, GridMinCount=16, JaggedSeams=False, MaxEdgeLength=0, MinEdgeLength=0.0001, MinTolerance=0, Refine=True, RefineAngle=0, RelativeTolerance=0.65, SimplePlanes=True, Tolerance=0})  # -> flatten(Mesh)
volume = Volume(Geometry=mesh_brep_6)  # -> Volume, Centroid
volume_2 = Volume(Geometry=mesh_brep_7)  # -> Volume, Centroid
ghpython_script_2 = GhPythonScript(SUM=volume.Volume)  # -> out, a; inputs SUM: list; same code as ghpython_script
ghpython_script_3 = GhPythonScript(SUM=volume_2.Volume)  # -> out, a; inputs SUM: list; same code as ghpython_script

mesh_brep_8 = MeshBrep(Settings={GridMaxCount=0, GridMinCount=16, JaggedSeams=False, MaxEdgeLength=0, MinEdgeLength=0.0001, MinTolerance=0, Refine=True, RefineAngle=0, RelativeTolerance=0.65, SimplePlanes=True, Tolerance=0})
mesh_brep_9 = MeshBrep(Settings={GridMaxCount=0, GridMinCount=16, JaggedSeams=False, MaxEdgeLength=0, MinEdgeLength=0.0001, MinTolerance=0, Refine=True, RefineAngle=0, RelativeTolerance=0.65, SimplePlanes=True, Tolerance=0})
area_2 = Area(Geometry=flatten(mesh_brep_8))  # -> Area, Centroid
ghpython_script_4 = GhPythonScript(SUM=area_2.Area)  # -> out, a; inputs SUM: list; same code as ghpython_script

comercial_income_m2 = Panel("57000")
number_2 = Number(comercial_income_m2)
galapagos = Galapagos(fitness=wlc__profit)

brep = Brep([<brep referenced from the Rhino model> x59])

# ----
# VISUALIZATION
#  ENVIRONMENT
area_3 = Area(Geometry=brep)  # -> Area, Centroid
sort_list = SortList(Keys=area_3.Area, ValuesValuesA=brep)  # -> Keys, ValuesValuesA
reverse_list = ReverseList(List=sort_list.ValuesValuesA)
panel = Panel("""LOTE 12
LOTE 22
LOTE 24
LOTE A
LOTE 7
LOTE 8
LOTE 52
LOTE 35
LOTE 31-B
LOTE 20
LOTE 33
LOTE 34
LOTE 37
LOTE 21
LOTE 32
LOTE 16
LOTE 28
LOTE 27
LOTE R
LOTE R
LOTE 17
LOTE 18
LOTE 9
LOTE 13
LOTE 26
LOTE 15
LOTE 23 
LOTE 21
LOTE 14
LOTE 25
LOTE B
LOTE 3-5
LOTE 6
LOTE 10
LOTE 2
LOTE 11
LOTE 51
LOTE 31-A
LOTE 22
LOTE 38
LOTE 36
LOTE 39
LOTE 40
LOTE D
LOTE 41
LOTE 49
LOTE 53
LOTE 50
LOTE 30 
LOTE E
LOTE 46
LOTE 47
LOTE 48
LOTE 44
LOTE 43
LOTE 45
LOTE 42
LOTE 29
LOTE 29-A
C.S.A.G""")
brep_2 = Brep([<brep referenced from the Rhino model> x59])
area_4 = Area(Geometry=brep_2)  # -> Area, graft(Centroid)
graft_tree = GraftTree(Tree=panel, IncludeEmptyLists=True, IncludeNullItems=True)
text_tag = TextTag(Location=area_4.Centroid, Text=graft_tree, Colour=ColourSwatch(SwatchColor=RGB(0, 0, 0)))

list_length = ListLength(List=reverse_list)
series = Series(Start=0, Step=1, Count=list_length)
list_item = ListItem(List=reverse_list, Index=series, Wrap=True)
list_item_2 = ListItem(List=reverse_list, Index=lote, Wrap=True)
item_index = ItemIndex(List=reverse_list, Item=list_item)
item_index_2 = ItemIndex(List=reverse_list, Item=list_item_2)
equality = Equality(FirstNumber=item_index_2, SecondNumber=item_index)  # -> Equality, Inequality
dispatch = Dispatch(List=reverse_list, DispatchPattern=equality.Equality)  # -> ListA, ListB
blindfold = Blindfold(Refresh=Button(), Visibility=Toggle(True), Limited=list_item_2)
blindfold_2 = Blindfold(Refresh=Button(), Visibility=Toggle(False), Limited=dispatch.ListB)

# ----
# TOPOGRAPHY
# MESH ANALYSIS
cluster = Cluster(
    brep=list_item_2,
    B_2=reticula_grid,
    factor=rotación_grid,
    B=reticula_grid,
    second_number=angle_range,
    distance=distance_point_groups)  # -> mesh_2, groups
mesh = Mesh(cluster.mesh_2)
cloud_display = CloudDisplay(Points=cluster.groups, Colours=ColourSwatch(SwatchColor=RGB(255, 255, 255)), Size=1, SpriteType=0)

# ----
# TRIANGULATE NEW
# BOUNDARY POLYGON
voronoi = Voronoi(Points=cluster.groups, Radius=layout_cell_radius, BruteForceOverride=False)
number_slider = Slider(10, range=0..10)
boundary_surfaces_2 = BoundarySurfaces(Edges=voronoi)
settings_custom = SettingsCustom(
    StitchSeams=True,
    SimplePlanes=False,
    Refine=True,
    MinCount=10,
    MaxCount=400,
    AspectRatio=20,
    MaxDistance=0,
    MaxAngle=20,
    MinEdge=number_slider,
    MaxEdge=number_slider)
brep_join_3 = BrepJoin(Breps=boundary_surfaces_2)  # -> Breps, Closed
mesh_brep_10 = MeshBrep(Brep=brep_join_3.Breps, Settings=settings_custom)
mesh_edges = MeshEdges(Mesh=mesh_brep_10)  # -> flatten(NakedEdges), InteriorEdges, NonManifoldEdges
join_curves = JoinCurves(Curves=mesh_edges.NakedEdges, Preserve=False)
length = Length(Curve=join_curves)
sort_list_2 = SortList(Keys=flatten(length), ValuesValuesA=flatten(join_curves))  # -> Keys, ValuesValuesA
reverse_list_2 = ReverseList(List=sort_list_2.ValuesValuesA)
list_item_3 = ListItem(List=reverse_list_2, Index=0, Wrap=True)
boundary_surfaces_3 = BoundarySurfaces(Edges=list_item_3)
area_5 = Area(Geometry=boundary_surfaces_3)  # -> Area, Centroid
scale = Scale(Geometry=list_item_3, Center=area_5.Centroid, Factor=limite_layout)  # -> Geometry, Transform
divide_curve = DivideCurve(Curve=scale.Geometry, Count=lados_poligono, Kinks=False)  # -> Points, Tangents, Parameters
number_slider_2 = Slider(25, range=0..100)
polyline = PolyLine(Vertices=divide_curve.Points, Closed=True)
boundary_surfaces_4 = BoundarySurfaces(Edges=polyline)
divide_surface = DivideSurface(Surface=boundary_surfaces_4, UCount=number_slider_2, VCount=number_slider_2)  # -> flatten(Points), Normals, Parameters
clean_tree_2 = CleanTree(RemoveNulls=True, RemoveInvalid=True, RemoveEmpty=False, Tree=divide_surface.Points)
list_item_4 = ListItem(List=clean_tree_2, Index=anchor_point, Wrap=True)

# ----
# TERRAIN AREA
area_6 = Area(Geometry=list_item_2)  # -> Area, Centroid

round = Round(Number=area_6.Area)  # -> Nearest, Floor, Ceiling

# ----
# TIPOLOGY "B"
number_slider_3 = Slider(75, range=0..100)
division = Division(A=Slider(100, range=0..150), B=2)
division_2 = Division(A=number_slider_3, B=2)

# ----
# TIPOLOGY "A"
number_slider_4 = Slider(130, range=0..150)
xy_plane = XYPlane(Origin=area_6.Centroid)
division_3 = Division(A=Slider(90, range=0..100), B=2)
division_4 = Division(A=number_slider_4, B=2)

center_box = CenterBox(Base=xy_plane, X=division_2, Y=division, Z=0)
brep_wireframe = BrepWireframe(Brep=center_box, Density=-1)
join_curves_2 = JoinCurves(Curves=brep_wireframe, Preserve=False)
area_7 = Area(Geometry=join_curves_2)  # -> Area, Centroid

center_box_2 = CenterBox(Base=xy_plane, X=division_3, Y=division_4, Z=0)
brep_wireframe_2 = BrepWireframe(Brep=center_box_2, Density=-1)
join_curves_3 = JoinCurves(Curves=brep_wireframe_2, Preserve=False)

area_8 = Area(Geometry=join_curves_3)  # -> Area, Centroid

merge = Merge(Data1=join_curves_3, Data2=join_curves_2)
merge_2 = Merge(Data1=area_8.Area, Data2=area_7.Area)
round_2 = Round(Number=merge_2)  # -> Nearest, Floor, Ceiling
ghpython_script_5 = GhPythonScript(Area_tp=round.Ceiling, lst=merge_2)  # -> out, a; inputs Area_tp: Int32, lst: list of Int32
# ---------- ghpython_script_5: Python ----------
"""Provides a scripting component.
    Inputs:
        x:
        y:
    Output:
        a: The a output variable"""

__author__ = "Sergio"
__version__ = "2019.03.28"

a=(min(lst, key=lambda x:abs(x-Area_tp)))
if Area_tp < a:
    print(lst[1])
else:
    print(a)
# ---------- end ghpython_script_5 ----------
round_3 = Round(Number=ghpython_script_5.out)  # -> Nearest, Floor, Ceiling
equality_2 = Equality(FirstNumber=round_2.Nearest, SecondNumber=round_3.Nearest)  # -> Equality, Inequality
dispatch_2 = Dispatch(List=merge, DispatchPattern=equality_2.Equality)  # -> ListA, ListB

# ----
# FLOOR PLAN REAL
curve = Curve(dispatch_2.ListA)
degrees = Degrees(Radians=rotation)
unit_z = UnitZ(Factor=altura_desplante_huella)

area_9 = Area(Geometry=curve)  # -> Area, Centroid

xy_plane_2 = XYPlane(Origin=area_9.Centroid)
rotate = Rotate(Geometry=curve, Angle=degrees, Plane=xy_plane_2)  # -> Geometry, Transform
move = Move(Geometry=rotate.Geometry, Motion=unit_z)  # -> Geometry, Transform
move_2pt = Move2Pt(Geometry=move.Geometry, PointA=area_9.Centroid, PointB=list_item_4)  # -> Moved, Vector, Transform

# ----
# SUPERSTRUCTURE
num_niveles = Slider(2, range=0..5)
a_entrepiso = Slider(4.5, range=0..10)
addition = Addition(A=num_niveles, B=1)
series_2 = Series(Start=0.25, Step=a_entrepiso, Count=addition)
unit_z_2 = UnitZ(Factor=series_2)
move_2 = Move(Geometry=move_2pt.Moved, Motion=unit_z_2)  # -> Geometry, Transform
unit_z_3 = UnitZ(Factor=Slider(0.3, range=0..1))
boundary_surfaces_5 = BoundarySurfaces(Edges=move_2.Geometry)
extrude = Extrude(Base=boundary_surfaces_5, Direction=unit_z_3)

# ----
# PARKING LOT
panel_2 = Panel("-4")
integer = Integer(panel_2)
unit_z_4 = UnitZ(Factor=integer)
move_3 = Move(Geometry=move_2pt.Moved, Motion=unit_z_4)  # -> Geometry, Transform
loft = Loft(
    Curves=[move_3.Geometry, move_2pt.Moved],
    Options={Adjust=False, Closed=False, LoftEnds=0, LoftSimp=0, LoftType=0, Rebuild=10, Refit=0.01})

boundary_surfaces_6 = BoundarySurfaces(Edges=move_3.Geometry)
area_10 = Area(Geometry=boundary_surfaces_6)  # -> Area, Centroid
loft_2 = Loft(Curves=move_2.Geometry, Options={Adjust=False, Closed=False, LoftEnds=0, LoftSimp=0, LoftType=0, Rebuild=10, Refit=0.01})
area_11 = Area(Geometry=boundary_surfaces_5)  # -> Area, Centroid
fit_line = FitLine(Points=[area_10.Centroid, area_11.Centroid])
length_2 = Length(Curve=fit_line)
custom_preview_3 = CustomPreview(Geometry=extrude, Material=ColourSwatch(SwatchColor=RGBA(253, 0, 255, 112)))
custom_preview_4 = CustomPreview(Geometry=loft_2, Material=ColourSwatch(SwatchColor=RGBA(253, 255, 255, 203)))
custom_preview_5 = CustomPreview(Geometry=loft, Material=ColourSwatch(SwatchColor=RGB(0, 255, 17)))
unit_z_5 = UnitZ(Factor=length_2)
extrude_2 = Extrude(Base=boundary_surfaces_6, Direction=unit_z_5)

mesh_brep_11 = MeshBrep(Settings={GridMaxCount=0, GridMinCount=16, JaggedSeams=False, MaxEdgeLength=0, MinEdgeLength=0.0001, MinTolerance=0, Refine=True, RefineAngle=0, RelativeTolerance=0.65, SimplePlanes=True, Tolerance=0})
construction_cost_m2 = Panel("63.770")
soft_cost = Panel("0.12")
parking_lot_m2_cost = Panel("72.50")
house_income_m2 = Panel("38585.0000")
area_12 = Area(Geometry=flatten(mesh_brep_11))  # -> Area, Centroid
fill_volume_cost_local = Panel("115.200")
fill_volume_cost_foreign = Panel("63.77")
cut_volume_cost = Panel("63.770")
area_13 = Area()  # -> flatten(Area), Centroid
flatten_tree_3 = FlattenTree(Path="{0}")
flatten_tree_4 = FlattenTree(Path="{0}")
flatten_tree_5 = FlattenTree(Path="{0}")
number_3 = Number(parking_lot_m2_cost)
number_4 = Number(soft_cost)
number_5 = Number(construction_cost_m2)
number_6 = Number(house_income_m2)
number_7 = Number(fill_volume_cost_local)
ghpython_script_6 = GhPythonScript(SUM=area_13.Area)  # -> out, a; inputs SUM: list; same code as ghpython_script
number_8 = Number(fill_volume_cost_foreign)
number_9 = Number(cut_volume_cost)
ghpython_script_7 = GhPythonScript(SUM=area_12.Area)  # -> out, a; inputs SUM: list; same code as ghpython_script
ghpython_script_8 = GhPythonScript(SUM=flatten_tree_4)  # -> out, a; inputs SUM: list; same code as ghpython_script
multiplication = Multiplication(A=number_3, B=ghpython_script_8.a)
multiplication_2 = Multiplication(A=number_6, B=ghpython_script_4.a)
ghpython_script_9 = GhPythonScript(SUM=flatten_tree_3)  # -> out, a; inputs SUM: list; same code as ghpython_script
ghpython_script_10 = GhPythonScript(SUM=flatten_tree_5)  # -> out, a; inputs SUM: list; same code as ghpython_script
multiplication_3 = Multiplication(A=number_5, B=ghpython_script_4.a)
multiplication_4 = Multiplication(A=number_9, B=ghpython_script_2.a)
multiplication_5 = Multiplication(A=number_4, B=ghpython_script_4.a)
multiplication_6 = Multiplication(A=number_8, B=ghpython_script_3.a)
multiplication_7 = Multiplication(A=number_7, B=ghpython_script_3.a)

multiplication_8 = Multiplication(A=number_2, B=ghpython_script_7.a)

round_4 = Round(Number=multiplication_4)  # -> Nearest, Floor, Ceiling
round_5 = Round(Number=multiplication_6)  # -> Nearest, Floor, Ceiling
round_6 = Round(Number=multiplication_2)  # -> Nearest, Floor, Ceiling
round_7 = Round(Number=multiplication_7)  # -> Nearest, Floor, Ceiling
round_8 = Round(Number=multiplication_3)  # -> Nearest, Floor, Ceiling
round_9 = Round(Number=multiplication_5)  # -> Nearest, Floor, Ceiling
round_10 = Round(Number=multiplication_8)  # -> Nearest, Floor, Ceiling
fill_volume_cost_local_2 = Panel(round_7.Nearest)
fill_volume_cost_foreign_2 = Panel(round_5.Nearest)
soft_cost_2 = Panel(round_9.Nearest)
cut_volume_cost_2 = Panel(round_4.Nearest)
comercial_income_m2_2 = Panel(round_10.Nearest)
construction_cost_m2_2 = Panel(round_8.Nearest)
house_income_m2_2 = Panel(round_6.Nearest)

round_11 = Round(Number=ghpython_script_7.a)  # -> Nearest, Floor, Ceiling
round_12 = Round(Number=ghpython_script_6.a)  # -> Nearest, Floor, Ceiling
round_13 = Round(Number=ghpython_script_4.a)  # -> Nearest, Floor, Ceiling
# FINANCIAL MATH
round_14 = Round(Number=ghpython_script.a)  # -> Nearest, Floor, Ceiling
round_15 = Round(Number=ghpython_script_3.a)  # -> Nearest, Floor, Ceiling
round_16 = Round(Number=ghpython_script_2.a)  # -> Nearest, Floor, Ceiling
floor_plan_area_m2 = Panel(round_14.Nearest)
construction_area_m2 = Panel(round_13.Nearest)
fill_volume_m3 = Panel(round_15.Nearest)
cut_volume_m3 = Panel(round_16.Nearest)
parking_m2 = Panel(round_12.Nearest)
comercial_m2 = Panel(round_11.Nearest)
subtraction = Subtraction(A=round_13.Nearest, B=round_11.Nearest)

multiplication_9 = Multiplication(A=round_13.Nearest, B=Slider(0.15, range=0..1))
subtraction_2 = Subtraction(A=round_13.Nearest, B=multiplication_9)

curve_2 = Curve(<curve referenced from the Rhino model>)
curve_3 = Curve(<curve referenced from the Rhino model>)
curve_4 = Curve(<curve referenced from the Rhino model>)
cluster_2 = Cluster_2(
    curve=curve_4,
    value=house_income_m2_2,
    domain_end=construction_cost_m2_2,
    domain_end_2=cut_volume_cost_2,
    domain_end_3=fill_volume_cost_local_2,
    domain_end_4=fill_volume_cost_foreign_2,
    domain_end_5=soft_cost_2)
# CONDUIT CHARTS
cluster_3 = Cluster_4(curve=curve_2, _0_0=subtraction, _0_1=round_11.Nearest, _0_2=round_12.Nearest)
cluster_4 = Cluster_3(_0_0=floor_plan_area_m2, _0_1=construction_area_m2, _0_2=fill_volume_m3, _0_3=cut_volume_m3, curve=curve_3)
merge_3 = Merge(Data3=cluster_4, Data5=cluster_3)  # -> flatten(Result)
point = Point(Point(11.73649984, -303.2999099, 0))
unit_x = UnitX(Factor=Slider(-30.544, range=-100..10))
move_4 = Move(Geometry=point, Motion=unit_x)  # -> Geometry, Transform
get_viewport_boundary_dimensions = GetViewportBoundaryDimensions(Refresh=Button(), Origin=move_4.Geometry, Scale=Slider(0.135, range=0..1))
heads_up_display_hud = HeadsUpDisplayHUD(ShowHUD=Toggle(True), DrawingObjects=merge_3, DrawingBoundary=get_viewport_boundary_dimensions)

comercial_income = Number(round_10.Nearest)
numero_de_cajones = Number(ghpython_script_9.a)
numero_de_viviendas = Number(ghpython_script_10.a)
m2_estacionamiento = Number(ghpython_script_8.a)
parking_lot_cost = Number(multiplication)
m2_viviendas = Number(subtraction_2)
construction_total_area = Number(ghpython_script_4.a)
fill_volumecost_foreign = Number(multiplication_6)
construction_cost_m2_3 = Number(multiplication_3)
fill_volumecost_local = Number(multiplication_7)
cut_volume_cost_3 = Number(multiplication_4)
# EVOLUTIONARY
# SOLVERS
floor_plan_area = Number(ghpython_script.a)
house_income = Number(multiplication_2)
cut_volume = Number(ghpython_script_2.a)
fill_volume = Number(ghpython_script_3.a)
soft_cost_3 = Number(multiplication_5)

one_over_x = OneOverX(Value=soft_cost_3)
merge_4 = Merge(
    Data1=mesh_brep_9,
    Data2=mesh_brep_6,
    Data3=mesh_brep_7,
    Data4=mesh_brep_2,
    Data5=mesh_brep_3,
    Data6=mesh_brep_4,
    Data7=mesh_brep_5,
    Data8=mesh_brep_11)
wlc_soft_cost = Number(one_over_x)
wlc__profit = Number(round_6.Nearest)
wallacei_x = WallaceiX(
    Objectives=[house_income, wlc_soft_cost],
    Data=construction_total_area,
    allFitness="0.0004580768|701938320.000004;0.0004827|666131440.000005;0.0004637875|693295280.000003;0.0004210455|763674320.000004;0.0005453752|589578800.000002;0.0004358438|737745200.000003;0.0004307968|746388240.000003;0.0004307968|746388240.000003;0.0004358438|737745200.000003;0.0004704908|683417520.000003;0.0004387812|732806320.000006;0.0004580768|701938320.000004;0.0004827|666131440.000005;0.0004580768|701938320.000004;0.0005582351|575996880.000003;0.0004163336|772317360.000005;0.0004800307|669835600.000005;0.0004827|666131440.000005;0.0004827|666131440.000005;0.0004800307|669835600.000005",
    allGenomes="25|11|47|77|66_43|35|94|10|64_3|25|32|99|68_65|28|62|70|70_95|9|16|38|80_1|25|32|75|66_26|11|47|100|81_25|9|47|98|68_3|27|32|79|66_97|11|47|76|80_43|33|94|8|56_25|12|47|80|66_43|35|94|11|64_25|11|47|77|66_95|9|13|10|64_43|35|15|10|64_95|10|93|9|66_43|35|94|10|64_43|36|94|10|66_95|9|97|10|62",
    curFrontIdx="3|0;3|1;3|2;3|3;3|4",
    popGen="5,4",
    total="238104")  # -> WallaceiGenomes, FitnessValues, Data, Phenotypes
biomorpher = Biomorpher(
    MeshEs=merge_4,
    Performance=[house_income, comercial_income, soft_cost_3, floor_plan_area],
    InitialPop=Slider(5, range=0..10))  # -> GenoGuids, Population, Historic, Clusters

# ==== cluster Cluster
number_slider = Slider(1.17, range=0..10)
settings_custom = SettingsCustom(
    StitchSeams=True,
    SimplePlanes=False,
    Refine=True,
    MinCount=16,
    MaxCount=400,
    AspectRatio=20,
    MaxDistance=0,
    MaxAngle=20,
    MinEdge=number_slider,
    MaxEdge=number_slider)
brep = ClusterInput()
# TOPOGRAPHY MESH ANALYSIS
# BREP MESH
mesh_brep = MeshBrep(Brep=brep, Settings=settings_custom)
mcomp = Decompose(Mesh=mesh_brep)  # -> Vertices, Faces, Colours, Normals
vcomp = Decompose(Vector=mcomp.Normals)  # -> XComponent, YComponent, ZComponent
expression = Expression(z=vcomp.ZComponent, Expression="Deg(0.0 - (Asin(Abs(z)) - 0.5*π))")
gradient = Gradient(
    LowerLimit=0,
    UpperLimit=90,
    Parameter=expression,
    stops=[0: RGB(101, 153, 5), 0: RGB(0, 128, 0), 0.441: RGB(240, 172, 36), 0.864: RGB(255, 0, 0)])
factor = ClusterInput()
mesh = Mesh(Vertices=mcomp.Vertices, Faces=mcomp.Faces, Colours=gradient)
xy_plane = XYPlane(Origin=Point(0, 0, 0))
pi = Pi(Factor=factor)
rotate_plane = RotatePlane(Plane=xy_plane, Angle=pi)
bounding_box = BoundingBox(Content=mesh, Plane=rotate_plane)  # -> Box, Box_2
deconstruct_brep = DeconstructBrep(Brep=bounding_box.Box)  # -> Faces, Edges, Vertices
B = ClusterInput()
B_2 = ClusterInput()
list_item = ListItem(List=deconstruct_brep.Faces, Index="4", Wrap=True)
dimensions = Dimensions(Surface=list_item)  # -> UDimension, VDimension
division = Division(A=dimensions.VDimension, B=B)
division_2 = Division(A=dimensions.UDimension, B=B_2)
integer = Integer(division_2)
integer_2 = Integer(division)
quad_panels = QuadPanels(Surface=list_item, UDivisions=integer, VDivisions=integer_2)
area = Area(Geometry=quad_panels)  # -> Area, Centroid

unit_z = UnitZ(Factor=1)
project_point = ProjectPoint(Point=area.Centroid, Direction=unit_z, Geometry=mesh)  # -> Point, Index

null_item = NullItem(Item=project_point.Point)  # -> NullFlags, InvalidFlags, Description
dispatch = Dispatch(List=project_point.Point, DispatchPattern=null_item.NullFlags)  # -> ListA, ListB
mesh_closest_point = MeshClosestPoint(Point=dispatch.ListB, Mesh=mesh)  # -> Point, Index, Parameter
mesh_eval = MeshEval(Mesh=mesh, Parameter=mesh_closest_point.Parameter)  # -> Point, Normal, Colour
vcomp_2 = Decompose(Vector=mesh_eval.Normal)  # -> XComponent, YComponent, ZComponent
expression_2 = Expression(z=vcomp_2.ZComponent, Expression="Deg(0.0 - (Asin(Abs(z)) - 0.5*π))")
second_number = ClusterInput()
distance = ClusterInput()
smaller_than = SmallerThan(FirstNumber=expression_2, SecondNumber=second_number)  # -> SmallerThan, OrEqualTo
dispatch_2 = Dispatch(List=mesh_eval.Point, DispatchPattern=smaller_than.SmallerThan)  # -> ListA, ListB
point_groups = PointGroups(Points=dispatch_2.ListA, Distance=distance)  # -> flatten(Groups), Indices
mesh_2 = ClusterOutput(mesh)
groups = ClusterOutput(point_groups.Groups)

# ==== cluster Cluster_2
domain_end = ClusterInput()
domain_end_2 = ClusterInput()
domain_end_3 = ClusterInput()
domain_end_4 = ClusterInput()
domain_end_5 = ClusterInput()
value = ClusterInput()

number_slider = Slider(6, range=0..10)
construct_domain = ConstructDomain(DomainStart=100000, DomainEnd=10000000)
number = Number(construct_domain)
construct_domain_2 = ConstructDomain(DomainStart=10000, DomainEnd=graft(domain_end))
construct_domain_3 = ConstructDomain(DomainStart=100000, DomainEnd=graft(domain_end_2))
construct_domain_4 = ConstructDomain(DomainStart=100000, DomainEnd=graft(domain_end_3))
construct_domain_5 = ConstructDomain(DomainStart=100000, DomainEnd=graft(domain_end_4))
construct_domain_6 = ConstructDomain(DomainStart=500, DomainEnd=graft(domain_end_5))
remap_numbers = RemapNumbers(Value=graft(value), Source=number, Target=construct_domain)  # -> Mapped, Clipped
range = Range(Domain=remap_numbers.Mapped, Steps=number_slider)
range_2 = Range(Domain=construct_domain_2, Steps=number_slider)
range_3 = Range(Domain=construct_domain_3, Steps=number_slider)
range_4 = Range(Domain=construct_domain_4, Steps=number_slider)
range_5 = Range(Domain=construct_domain_5, Steps=number_slider)
range_6 = Range(Domain=construct_domain_6, Steps=number_slider)
entwine = Entwine(
    Branch00=range,
    Branch01=range_2,
    Branch02=range_3,
    Branch03=range_4,
    Branch04=range_5,
    Branch05=range_6,
    FlattenInputs=True)

conduit_colorpalette = ConduitColorPalette(
    PaletteName="Palette 2",
    Seed=Slider(100, range=0..100),
    HueRange=Domain(-0.05, 0.05),
    SaturationRange=Domain(-0.15, 0.15),
    LuminanceRange=Domain(-0.1, 0.1),
    BaseColors=ColourSwatch(SwatchColor=RGB(235, 63, 152)))
entwine_2 = Entwine(Branch00=conduit_colorpalette, FlattenInputs=True)

curve = ClusterInput()

panel = Panel("""HOUSE INCOME / M2 ($)
CONSTRUCTION COST M2 / ($) 
CUT VOLUME COST ($)
FILL VOLUME COST ($) - LOCAL
FILL VOLUME COST ($) - FOREIGN 
SOFT COST (%)}
FINANCIAL OUTPUTS""")
reverse_list = ReverseList(List=panel)
conduit_font = ConduitFont(
    StyleName="FINANCIAL",
    Font="BankGothic Md BT",
    TextHeight=Slider(11.173, range=0..40),
    AdaptiveHeight=Toggle(False),
    TextSpacing=Slider(0, range=0..1),
    Alignment=0,
    Bold=Toggle(True),
    Italic=False,
    Color=ColourSwatch(SwatchColor=RGB(255, 255, 255)))
curve_2 = Curve(curve)

conduit_chart = ConduitChart(
    Bounds=curve_2,
    Values=range_5,
    Categories=panel,
    Title="FINANCIAL",
    ValueTitle=entwine,
    ColorPalette=entwine_2,
    Font=conduit_font)  # -> flatten(HUDDrawingObjects), ChartSettings
hud_drawing_objects = ClusterOutput(conduit_chart.HUDDrawingObjects)

# ==== cluster Cluster_3
_0_0 = ClusterInput()
_0_1 = ClusterInput()
_0_2 = ClusterInput()
_0_3 = ClusterInput()
curve = ClusterInput()

panel = Panel("""FLOOR PLAN AREA(M2)
CONSTRUCTION AREA(M2)
FILL VOLUME(M3)
CUT VOLUME(M3)""")
entwine = Entwine(Branch00=_0_0, Branch01=_0_1, Branch02=_0_2, Branch03=_0_3, FlattenInputs=True)  # -> flatten(Result)
merge = Merge(
    Data1=ColourSwatch(SwatchColor=RGB(247, 4, 203)),
    Data2=ColourSwatch(SwatchColor=RGB(106, 255, 255)),
    Data3=ColourSwatch(SwatchColor=RGB(102, 102, 255)),
    Data4=ColourSwatch(SwatchColor=RGB(184, 255, 102)))
conduit_pie_style = ConduitPieStyle(
    StyleName="IMPERATIVE STYLE",
    InnerRadius=Slider(0.56, range=0..1),
    OuterRadius=Slider(0.92, range=0..1),
    LabelRadius=Slider(1.07, range=0..2),
    LabelFontFace="BankGothic Md BT",
    RelativeLabelHeight=Slider(0.04, range=0..1),
    LabelColor=ColourSwatch(SwatchColor=RGB(243, 255, 255)))
conduit_colorpalette = ConduitColorPalette(
    PaletteName="Palette",
    Seed=Slider(52, range=0..100),
    HueRange=Domain(-0.05, 0.05),
    SaturationRange=Domain(-0.15, 0.15),
    LuminanceRange=Domain(-0.1, 0.1),
    BaseColors=merge)
curve_2 = Curve(curve)
draw_pie_chart = DrawPieChart(
    BoundaryRectangle=curve_2,
    Labels=panel,
    DataValues=entwine,
    PieStyle=conduit_pie_style,
    ColorPalette=conduit_colorpalette)

hud_pie_chart_object = ClusterOutput(draw_pie_chart)

# ==== cluster Cluster_4
_0_1 = ClusterInput()
_0_0 = ClusterInput()
_0_2 = ClusterInput()
entwine = Entwine(Branch00=_0_0, Branch01=_0_1, Branch02=_0_2, FlattenInputs=True)  # -> flatten(Result)
panel = Panel("""M2 HOUSING
M2 COMERCIAL
M2 PARKING LOT""")
merge = Merge(
    Data1=ColourSwatch(SwatchColor=RGB(243, 25, 224)),
    Data2=ColourSwatch(SwatchColor=RGB(233, 242, 170)),
    Data3=ColourSwatch(SwatchColor=RGB(10, 186, 255)))
conduit_colorpalette = ConduitColorPalette(
    PaletteName="PaletteC",
    Seed=Slider(52, range=0..100),
    HueRange=Domain(-0.05, 0.05),
    SaturationRange=Domain(-0.15, 0.15),
    LuminanceRange=Domain(-0.1, 0.1),
    BaseColors=merge)
conduit_pie_style = ConduitPieStyle(
    StyleName="WSWSW",
    InnerRadius=Slider(0.62, range=0..1),
    OuterRadius=Slider(0.94, range=0..1),
    LabelRadius=Slider(1.11, range=0..2),
    LabelFontFace="BankGothic Md BT",
    RelativeLabelHeight=Slider(0.04, range=0..1),
    LabelColor=ColourSwatch(SwatchColor=RGB(243, 255, 255)))
curve = ClusterInput()
curve_2 = Curve(curve)
draw_pie_chart = DrawPieChart(
    BoundaryRectangle=curve_2,
    Labels=panel,
    DataValues=entwine,
    PieStyle=conduit_pie_style,
    ColorPalette=conduit_colorpalette)
hud_pie_chart_object = ClusterOutput(draw_pie_chart)
