# Grasshopper definition Branch2.6.1.0Alpha_Latiz Hypaar.gh (Grasshopper 1.0.4)
# plug-ins: ProvingGround.Conduit, Pufferfish, Blindfold, Biomorpher, Wallacei

colour_picker = ColourPicker(PickedColour=RGB(40, 163, 94))
colour_swatch = ColourSwatch(SwatchColor=RGB(17, 79, 52))
colour = Colour(colour_picker)
brep = Brep([<brep referenced from the Rhino model> x56])
create_material = CreateMaterial(
    Diffuse=colour,
    Specular=colour_swatch,
    Emission=colour_swatch,
    Transparency=Slider(0.126, range=0..1),
    Shine=Slider(0, range=0..1))
# BIG BOXES
custom_preview = CustomPreview(Geometry=brep, Material=create_material)

brep_2 = Brep(<brep referenced from the Rhino model>)
deconstruct_brep = DeconstructBrep(Brep=brep_2)  # -> Faces, Edges, Vertices
brep_join = BrepJoin(Breps=deconstruct_brep.Faces)  # -> Breps, Closed

# ----
# TOPOGRAPHY MESH PANEL
limite_layout = Slider(0.2, range=0..1)
lote = Slider(24, range=0..100)
reticula_grid = Slider(7, range=1..15)
angle_range = Slider(18, range=1..30)
distance_point_groups = Slider(18, range=1..55)
rotación_grid = Slider(0.15, range=0..0.5)
layout_cell_radius = Slider(28.86, range=15..50)
lados_poligono = Slider(18, range=0..60)

anchor_point = Slider(0, range=0..54)
altura_desplante_huella = Slider(2, range=1..5)
rotation = Slider(213, range=0..360)
cut = Slider(-27, range=-30..-15)
brep_3 = Brep(brep_join.Breps)
unit_z = UnitZ(Factor=Slider(0.25, range=0..1))
unit_z_2 = UnitZ(Factor=Slider(0.6, range=0..1))
number_slider = Slider(0.526, range=0..1)
colour_swatch_2 = ColourSwatch(SwatchColor=RGB(26, 26, 26))
create_material_2 = CreateMaterial(
    Diffuse=ColourSwatch(SwatchColor=RGB(206, 10, 255)),
    Specular=RGB(255, 255, 255),
    Emission=ColourSwatch(SwatchColor=RGB(184, 0, 184)),
    Transparency=Slider(0.255, range=0..1),
    Shine=0)
create_material_3 = CreateMaterial(
    Diffuse=ColourSwatch(SwatchColor=RGB(176, 176, 176)),
    Specular=RGB(255, 255, 255),
    Emission=colour_swatch_2,
    Transparency=number_slider,
    Shine=0)
create_material_4 = CreateMaterial(
    Diffuse=ColourSwatch(SwatchColor=RGB(41, 202, 209)),
    Specular=RGB(255, 255, 255),
    Emission=ColourSwatch(SwatchColor=RGB(33, 150, 184)),
    Transparency=Slider(0.255, range=0..1),
    Shine=0)
create_material_5 = CreateMaterial(
    Diffuse=ColourSwatch(SwatchColor=RGB(176, 176, 176)),
    Specular=RGB(255, 255, 255),
    Emission=colour_swatch_2,
    Transparency=number_slider,
    Shine=0)
create_material_6 = CreateMaterial(
    Diffuse=ColourSwatch(SwatchColor=RGB(237, 237, 237)),
    Specular=ColourSwatch(SwatchColor=RGB(184, 184, 184)),
    Emission=RGB(0, 0, 0),
    Transparency=Slider(0, range=0..1),
    Shine=0)
create_material_7 = CreateMaterial(
    Diffuse=ColourSwatch(SwatchColor=RGB(10, 8, 237)),
    Specular=ColourSwatch(SwatchColor=RGB(53, 55, 184)),
    Emission=RGB(0, 0, 0),
    Transparency=Slider(0.454, range=0..1),
    Shine=0)
colour_swatch_3 = ColourSwatch(SwatchColor=RGBA(69, 69, 69, 154))
colour_swatch_4 = ColourSwatch(SwatchColor=RGBA(130, 130, 130, 213))
fill_volume_cost_foreign = Panel("63.77")
fill_volume_cost_local = Panel("115.200")
cut_volume_cost = Panel("63.770")
number = Number(cut_volume_cost)
number_2 = Number(fill_volume_cost_local)
number_3 = Number(fill_volume_cost_foreign)
curve = Curve(<curve referenced from the Rhino model>)
curve_2 = Curve(<curve referenced from the Rhino model>)
# CONDUIT CHARTS
curve_3 = Curve(<curve referenced from the Rhino model>)
cluster = Cluster_3(boundary=curve_3)
galapagos = Galapagos(fitness=ratio_2, gene=[number_slider_6, number_slider_5, number_slider_4])

brep_4 = Brep(brep_join.Breps)

area = Area(Geometry=brep_4)  # -> Area, Centroid
sort_list = SortList(Keys=area.Area, ValuesValuesA=brep_4)  # -> Keys, ValuesValuesA
reverse_list = ReverseList(List=sort_list.ValuesValuesA)

list_length = ListLength(List=reverse_list)
series = Series(Start=0, Step=1, Count=list_length)
list_item = ListItem(List=reverse_list, Index=lote, Wrap=True)
list_item_2 = ListItem(List=reverse_list, Index=series, Wrap=True)
item_index = ItemIndex(List=reverse_list, Item=list_item)
item_index_2 = ItemIndex(List=reverse_list, Item=list_item_2)
equality = Equality(FirstNumber=item_index, SecondNumber=item_index_2)  # -> Equality, Inequality
dispatch = Dispatch(List=reverse_list, DispatchPattern=equality.Equality)  # -> ListA, ListB
blindfold = Blindfold(Refresh=Button(), Visibility=Toggle(False), Limited=dispatch.ListB)
blindfold_2 = Blindfold(Refresh=Button(), Visibility=Toggle(True), Limited=list_item)

# ----
# VISUALIZATION
#  ENVIRONMENT
list_item_3 = ListItem(List=reverse_list, Index=0, Wrap=True)
panel = Panel("""LOTE 12
LOTE 22
LOTE 24
LOTE A
LOTE 7
LOTE 8
LOTE 52
LOTE 35
LOTE 31-B
LOTE 20
LOTE 33
LOTE 34
LOTE 37
LOTE 21
LOTE 32
LOTE 16
LOTE 28
LOTE 27
LOTE R
LOTE R
LOTE 17
LOTE 18
LOTE 9
LOTE 13
LOTE 26
LOTE 15
LOTE 23 
LOTE 21
LOTE 14
LOTE 25
LOTE B
LOTE 3-5
LOTE 6
LOTE 10
LOTE 2
LOTE 11
LOTE 51
LOTE 31-A
LOTE 22
LOTE 38
LOTE 36
LOTE 39
LOTE 40
LOTE D
LOTE 41
LOTE 49
LOTE 53
LOTE 50
LOTE 30 
LOTE E
LOTE 46
LOTE 47
LOTE 48
LOTE 44
LOTE 43
LOTE 45
LOTE 42
LOTE 29
LOTE 29-A
C.S.A.G""")
item_index_3 = ItemIndex(List=reverse_list, Item=list_item_3)
area_2 = Area(Geometry=reverse_list)  # -> Area, graft(Centroid)
equality_2 = Equality(FirstNumber=item_index_3, SecondNumber=item_index_2)  # -> Equality, Inequality
dispatch_2 = Dispatch(List=reverse_list, DispatchPattern=equality_2.Equality)  # -> ListA, ListB
graft_tree = GraftTree(Tree=panel, IncludeEmptyLists=True, IncludeNullItems=True)
text_tag = TextTag(Location=area_2.Centroid, Text=graft_tree, Colour=ColourSwatch(SwatchColor=RGB(0, 0, 0)))
blindfold_3 = Blindfold(Refresh=Button(), Visibility=Toggle(False), Limited=dispatch_2.ListB)
blindfold_4 = Blindfold(Refresh=Button(), Visibility=Toggle(True), Limited=list_item_3)

# ----
# TOPOGRAPHY
# MESH ANALYSIS
colour_swatch_5 = ColourSwatch(SwatchColor=RGB(255, 255, 255))
cluster_2 = Cluster(
    brep=list_item_3,
    B_2=reticula_grid,
    factor=rotación_grid,
    B=reticula_grid,
    second_number=angle_range,
    distance=distance_point_groups)  # -> mesh_2, groups
cluster_3 = Cluster(
    brep=brep_join.Breps,
    B_2=reticula_grid,
    factor=rotación_grid,
    B=reticula_grid,
    second_number=angle_range,
    distance=distance_point_groups)  # -> mesh_2, groups
mesh = Mesh(cluster_3.mesh_2)
cloud_display = CloudDisplay(Points=cluster_3.groups, Colours=colour_swatch_5, Size=1, SpriteType=0)
mesh_2 = Mesh(cluster_2.mesh_2)
cloud_display_2 = CloudDisplay(Points=cluster_2.groups, Colours=ColourSwatch(SwatchColor=RGB(255, 255, 255)), Size=1, SpriteType=0)

panel_2 = Panel(item_index)

# ----
# TERRAIN AREA
area_3 = Area(Geometry=list_item)  # -> Area, Centroid

# ----
# TRIANGULATE NEW
# BOUNDARY POLYGON
voronoi = Voronoi(Points=cluster_3.groups, Radius=layout_cell_radius, BruteForceOverride=False)
number_slider_2 = Slider(10, range=0..10)
boundary_surfaces = BoundarySurfaces(Edges=voronoi)
settings_custom = SettingsCustom(
    StitchSeams=True,
    SimplePlanes=False,
    Refine=True,
    MinCount=10,
    MaxCount=400,
    AspectRatio=20,
    MaxDistance=0,
    MaxAngle=20,
    MinEdge=number_slider_2,
    MaxEdge=number_slider_2)
brep_join_2 = BrepJoin(Breps=boundary_surfaces)  # -> Breps, Closed
mesh_brep = MeshBrep(Brep=brep_join_2.Breps, Settings=settings_custom)
mesh_edges = MeshEdges(Mesh=mesh_brep)  # -> flatten(NakedEdges), InteriorEdges, NonManifoldEdges
join_curves = JoinCurves(Curves=mesh_edges.NakedEdges, Preserve=False)
length = Length(Curve=join_curves)
sort_list_2 = SortList(Keys=flatten(length), ValuesValuesA=flatten(join_curves))  # -> Keys, ValuesValuesA
reverse_list_2 = ReverseList(List=sort_list_2.ValuesValuesA)
list_item_4 = ListItem(List=reverse_list_2, Index=0, Wrap=True)
boundary_surfaces_2 = BoundarySurfaces(Edges=list_item_4)
area_4 = Area(Geometry=boundary_surfaces_2)  # -> Area, Centroid
scale = Scale(Geometry=list_item_4, Center=area_4.Centroid, Factor=limite_layout)  # -> Geometry, Transform
divide_curve = DivideCurve(Curve=scale.Geometry, Count=lados_poligono, Kinks=False)  # -> Points, Tangents, Parameters
number_slider_3 = Slider(10, range=0..100)
polyline = PolyLine(Vertices=divide_curve.Points, Closed=True)
boundary_surfaces_3 = BoundarySurfaces(Edges=polyline)
divide_surface = DivideSurface(Surface=boundary_surfaces_3, UCount=number_slider_3, VCount=number_slider_3)  # -> flatten(Points), Normals, Parameters
unit_z_3 = UnitZ(Factor=1)
clean_tree = CleanTree(RemoveNulls=True, RemoveInvalid=True, RemoveEmpty=False, Tree=divide_surface.Points)
project_point = ProjectPoint(Point=clean_tree, Direction=unit_z_3, Geometry=brep_3)  # -> Point, Index
clean_tree_2 = CleanTree(RemoveNulls=True, RemoveInvalid=True, RemoveEmpty=False, Tree=project_point.Point)
list_item_5 = ListItem(List=clean_tree_2, Index=anchor_point, Wrap=True)

round = Round(Number=area_3.Area)  # -> Nearest, Floor, Ceiling

# ----
# TIPOLOGY "B"
number_slider_4 = Slider(0, range=0..100)
division = Division(A=Slider(0, range=0..150), B=2)
division_2 = Division(A=number_slider_4, B=2)

# ----
# TIPOLOGY "A"
number_slider_5 = Slider(84, range=75..90)
number_slider_6 = Slider(112, range=80..130)
xy_plane = XYPlane(Origin=area_3.Centroid)
division_3 = Division(A=number_slider_6, B=2)
division_4 = Division(A=number_slider_5, B=2)

center_box = CenterBox(Base=xy_plane, X=division_2, Y=division, Z=0)
brep_wireframe = BrepWireframe(Brep=center_box, Density=-1)
join_curves_2 = JoinCurves(Curves=brep_wireframe, Preserve=False)
area_5 = Area(Geometry=join_curves_2)  # -> Area, Centroid

larger_than = LargerThan(FirstNumber=number_slider_6, SecondNumber=number_slider_5)  # -> LargerThan, OrEqualTo
center_box_2 = CenterBox(Base=xy_plane, X=division_3, Y=division_4, Z=0)
brep_wireframe_2 = BrepWireframe(Brep=center_box_2, Density=-1)
join_curves_3 = JoinCurves(Curves=brep_wireframe_2, Preserve=False)
ghpython_script = GhPythonScript(x=larger_than.LargerThan, y=number_slider_6, z=number_slider_5, u=larger_than.OrEqualTo)  # -> out, a
# ---------- ghpython_script: Python ----------
"""Provides a scripting component.
    Inputs:
        x:
        y:
    Output:
        a: The a output variable"""

__author__ = "Sergio"
__version__ = "2019.03.28"

if x == True:
    a = y/z
elif u == False:
    a = z/y
elif u == True:
    a = 1
print(a)
# ---------- end ghpython_script ----------

area_6 = Area(Geometry=join_curves_3)  # -> Area, Centroid

merge = Merge(Data1=join_curves_3, Data2=join_curves_2)
merge_2 = Merge(Data1=area_6.Area, Data2=area_5.Area)
ghpython_script_2 = GhPythonScript(Area_tp=round.Ceiling, lst=merge_2)  # -> out, B; inputs Area_tp: Int32, lst: list of Int32
# ---------- ghpython_script_2: Python ----------
"""Provides a scripting component.
    Inputs:
        x:
        y:
    Output:
        a: The a output variable"""

__author__ = "Sergio"
__version__ = "2019.03.28"

a=(min(lst, key=lambda x:abs(x-Area_tp)))
if Area_tp < a:
    print(lst[1])
else:
    print(a)
    B=lst[1]
# ---------- end ghpython_script_2 ----------
round_2 = Round(Number=merge_2)  # -> Nearest, Floor, Ceiling
round_3 = Round(Number=ghpython_script_2.out)  # -> Nearest, Floor, Ceiling
equality_3 = Equality(FirstNumber=round_2.Nearest, SecondNumber=round_3.Nearest)  # -> Equality, Inequality
dispatch_3 = Dispatch(List=merge, DispatchPattern=equality_3.Equality)  # -> ListA, ListB

panel_3 = Panel(ghpython_script.a)
ratio = Integer(panel_3)
ratio_2 = Number(ratio)

# ----
# FLOOR PLAN REAL
curve_4 = Curve(dispatch_3.ListA)
degrees = Degrees(Radians=rotation)
unit_z_4 = UnitZ(Factor=altura_desplante_huella)

area_7 = Area(Geometry=curve_4)  # -> Area, Centroid

xy_plane_2 = XYPlane(Origin=area_7.Centroid)
rotate = Rotate(Geometry=curve_4, Angle=degrees, Plane=xy_plane_2)  # -> Geometry, Transform
move = Move(Geometry=rotate.Geometry, Motion=unit_z_4)  # -> Geometry, Transform
move_2pt = Move2Pt(Geometry=move.Geometry, PointA=area_7.Centroid, PointB=list_item_5)  # -> Moved, Vector, Transform

# ----
# OUTPUTS
area_8 = Area(Geometry=move_2pt.Moved)  # -> Area, Centroid

# ----
# FILL & CUT GEOMETRY INTERSECTION
number_slider_7 = Slider(3, range=0..10)
unit_z_5 = UnitZ(Factor=cut)
settings_custom_2 = SettingsCustom(
    StitchSeams=True,
    SimplePlanes=False,
    Refine=True,
    MinCount=16,
    MaxCount=400,
    AspectRatio=20,
    MaxDistance=0,
    MaxAngle=20,
    MinEdge=number_slider_7,
    MaxEdge=number_slider_7)
mesh_brep_2 = MeshBrep(Brep=brep_join.Breps, Settings=settings_custom_2)
mesh_edges_2 = MeshEdges(Mesh=mesh_brep_2)  # -> NakedEdges, InteriorEdges, NonManifoldEdges
curve_5 = Curve(mesh_edges_2.NakedEdges)
join_curves_4 = JoinCurves(Curves=curve_5, Preserve=False)
brep_5 = Brep(brep_join.Breps)
patch = Patch(Curves=join_curves_4, Spans=20, Flexibility=1, Trim=True)

# ----
# SUPERSTRUCTURE
num_niveles = Slider(2, range=0..5)
a_entrepiso = Slider(5, range=0..10)
addition = Addition(A=num_niveles, B=1)
series_2 = Series(Start=0.25, Step=a_entrepiso, Count=addition)
unit_z_6 = UnitZ(Factor=series_2)
move_2 = Move(Geometry=move_2pt.Moved, Motion=unit_z_6)  # -> Geometry, Transform
divide_curve_2 = DivideCurve(Curve=move_2.Geometry, Count=10, Kinks=False)  # -> Points, Tangents, Parameters
flip_matrix = FlipMatrix(Data=divide_curve_2.Points)
fit_line = FitLine(Points=flip_matrix)  # -> flatten(Line)
network_surface = NetworkSurface(CurvesU=move_2.Geometry, CurvesV=fit_line, Continuity=2)
offset_surface = OffsetSurface(Surface=network_surface, Distance=Slider(0.891, range=0..1), Retrim=True)
unit_z_7 = UnitZ(Factor=Slider(0.65, range=0..1))
boundary_surfaces_4 = BoundarySurfaces(Edges=move_2.Geometry)
extrude = Extrude(Base=boundary_surfaces_4, Direction=unit_z_7)

loft = Loft(Curves=move_2.Geometry, Options={Adjust=False, Closed=False, LoftEnds=0, LoftSimp=0, LoftType=0, Rebuild=10, Refit=0.01})
custom_preview_2 = CustomPreview(Geometry=extrude, Material=create_material_2)
area_9 = Area(Geometry=move_2.Geometry)  # -> Area, Centroid

# ----
# PARKING LOT
panel_4 = Panel("-4")
integer = Integer(panel_4)
unit_z_8 = UnitZ(Factor=integer)
move_3 = Move(Geometry=move_2pt.Moved, Motion=unit_z_8)  # -> Geometry, Transform
loft_2 = Loft(
    Curves=[move_3.Geometry, move_2pt.Moved],
    Options={Adjust=False, Closed=False, LoftEnds=0, LoftSimp=0, LoftType=0, Rebuild=10, Refit=0.01})

boundary_surfaces_5 = BoundarySurfaces(Edges=move_3.Geometry)
move_4 = Move(Geometry=boundary_surfaces_5, Motion=unit_z)  # -> Geometry, Transform
extrude_2 = Extrude(Base=move_4.Geometry, Direction=unit_z_2)

brep_edges = BrepEdges(Brep=[offset_surface, loft_2])  # -> flatten(Naked), Interior, NonManifold
curve_6 = Curve(brep_edges.Naked)

custom_preview_3 = CustomPreview(Geometry=[offset_surface, loft_2], Material=create_material_5)
custom_preview_4 = CustomPreview(Geometry=loft_2, Material=create_material_3)
custom_preview_5 = CustomPreview(Geometry=curve_6, Material=create_material_6)
custom_preview_6 = CustomPreview(Geometry=extrude_2, Material=create_material_4)

custom_preview_7 = CustomPreview(Geometry=boundary_surfaces_5, Material=ColourSwatch(SwatchColor=RGB(0, 255, 255)))

area_10 = Area(Geometry=move_3.Geometry)  # -> Area, Centroid
ghpython_script_3 = GhPythonScript(SUM=[area_9.Area, area_10.Area])  # -> out, a; inputs SUM: list
# ---------- ghpython_script_3: Python ----------
"""Provides a scripting component.
    Inputs:
        x:
        y:
    Output:
        a: The a output variable"""

__author__ = "Sergio"
__version__ = "2019.03.28"

import math as math
ab=[]
for num in SUM:
    ab.append(num)
    lst = (math.fsum(ab))
    a=lst
# ---------- end ghpython_script_3 ----------

move_5 = Move(Geometry=move_3.Geometry, Motion=unit_z_5)  # -> Geometry, Transform
area_11 = Area(Geometry=move_3.Geometry)  # -> Area, Centroid
area_12 = Area(Geometry=move_5.Geometry)  # -> Area, Centroid
boundary_surfaces_6 = BoundarySurfaces(Edges=move_5.Geometry)
distance = Distance(PointA=area_11.Centroid, PointB=area_12.Centroid)
unit_z_9 = UnitZ(Factor=distance)

# ----
# FILL
extrude_3 = Extrude(Base=boundary_surfaces_6, Direction=unit_z_9)
solid_difference = SolidDifference(BrepsA=extrude_3, BrepsB=patch)
volume = Volume(Geometry=solid_difference)  # -> Volume, Centroid

split_brep = SplitBrep(Brep=extrude_3, Cutter=patch)
list_item_6 = ListItem(List=split_brep, Index=0, Wrap=True)  # -> Item, Item1

# ----
# CUT
colour_swatch_6 = ColourSwatch(SwatchColor=RGB(255, 0, 0))
volume_2 = Volume(Geometry=extrude_3)  # -> Volume, Centroid
custom_preview_8 = CustomPreview(Geometry=list_item_6.Item, Material=colour_swatch_6)
subtraction = Subtraction(A=volume_2.Volume, B=volume.Volume)

custom_preview_9 = CustomPreview(Geometry=list_item_6.Item1, Material=create_material_7)

custom_preview_10 = CustomPreview(Geometry=list_item_6.Item1, Material=ColourSwatch(SwatchColor=RGBA(0, 255, 255, 167)))

multiplication = Multiplication(A=number, B=volume.Volume)
multiplication_2 = Multiplication(A=number_3, B=subtraction)
multiplication_3 = Multiplication(A=number_2, B=subtraction)

round_4 = Round(Number=multiplication)  # -> Nearest, Floor, Ceiling
round_5 = Round(Number=multiplication_2)  # -> Nearest, Floor, Ceiling
round_6 = Round(Number=multiplication_3)  # -> Nearest, Floor, Ceiling
fill_volume_cost_local_2 = Panel(round_6.Nearest)
fill_volume_cost_foreign_2 = Panel(round_5.Nearest)
cut_volume_cost_2 = Panel(round_4.Nearest)

round_7 = Round(Number=ghpython_script_3.a)  # -> Nearest, Floor, Ceiling
round_8 = Round(Number=area_8.Area)  # -> Nearest, Floor, Ceiling
round_9 = Round(Number=subtraction)  # -> Nearest, Floor, Ceiling
round_10 = Round(Number=volume.Volume)  # -> Nearest, Floor, Ceiling
construction_area_m2 = Panel(round_7.Nearest)
floor_plan_area_m2 = Panel(round_8.Nearest)
fill_volume_m3 = Panel(round_9.Nearest)
cut_volume_m3 = Panel(round_10.Nearest)

cluster_4 = Cluster_2(_0_0=floor_plan_area_m2, _0_1=construction_area_m2, _0_2=fill_volume_m3, boundary_rectangle=curve, _0_3=cut_volume_m3)

number_slider_8 = Slider(3, range=0..10)
merge_3 = Merge(Data1=extrude, Data2=loft_2, Data3=solid_difference, Data4=loft)
settings_custom_3 = SettingsCustom(
    StitchSeams=True,
    SimplePlanes=False,
    Refine=True,
    MinCount=16,
    MaxCount=400,
    AspectRatio=20,
    MaxDistance=0,
    MaxAngle=20,
    MinEdge=number_slider_8,
    MaxEdge=number_slider_8)
flatten_tree = FlattenTree(Tree=merge_3, Path="{0}")
mesh_brep_3 = MeshBrep(Brep=flatten_tree, Settings=settings_custom_3)

cut_volume_cost_3 = Number(round_4.Nearest)
# EVOLUTIONARY
# SOLVERS
construction_area = Integer(construction_area_m2)
fill_volume_cost = Number(round_6.Nearest)
wallacei_x = WallaceiX(
    Genes=[rotation, anchor_point, altura_desplante_huella, cut, number_slider_6, number_slider_5],
    Objectives=[construction_area, ratio],
    Data=cut_volume_cost_3,
    allFitness="1|56628;1|56628;1|56628;1|56628;1|56628;1|56628",
    allGenomes="90|27|2|-22|113|81_127|234|1|-24|81|79_115|245|2|-23|94|84_115|234|1|-24|80|79_128|245|2|-23|96|84_175|234|1|-24|81|78",
    curFrontIdx="1|0;1|1;1|2",
    popGen="3,2",
    total="172974")  # -> WallaceiGenomes, FitnessValues, Data, Phenotypes
floor_plan_area = Number(round_8.Nearest)
decode_phenotype = DecodePhenotype(WallaceiPhenotype=wallacei_x.Phenotypes, RunTheDecoder=Toggle(True))  # -> GeometriesList, MeshesList, NumbersList
decode_genome = DecodeGenome(WallaceiGenome=wallacei_x.WallaceiGenomes)
biomorpher = Biomorpher(
    Genome=[rotation, altura_desplante_huella, cut, number_slider_6, number_slider_5],
    MeshEs=mesh_brep_3,
    Performance=[ratio, cut_volume_cost_3, fill_volume_cost, floor_plan_area],
    InitialPop=Slider(100, range=0..100))  # -> GenoGuids, Population, Historic, Clusters

number_slider_9 = Slider(0.04, range=0..1)
number_slider_10 = Slider(1.19, range=0..2)
entwine = Entwine(
    Branch00=floor_plan_area_m2,
    Branch01=construction_area_m2,
    Branch02=fill_volume_m3,
    Branch03=cut_volume_m3,
    FlattenInputs=True)  # -> flatten(Result)
merge_4 = Merge(
    Data1=ColourSwatch(SwatchColor=RGB(247, 4, 203)),
    Data2=ColourSwatch(SwatchColor=RGB(106, 255, 255)),
    Data3=ColourSwatch(SwatchColor=RGB(102, 102, 255)),
    Data4=ColourSwatch(SwatchColor=RGB(184, 255, 102)))
panel_5 = Panel("""FLOOR PLAN AREA (M2)
CONSTRUCTION AREA (M2)
FILL VOLUME (M3)
CUT VOLUME (M3)""")
conduit_pie_style = ConduitPieStyle(
    StyleName="hola",
    InnerRadius=Slider(0.61, range=0..1),
    OuterRadius=Slider(0.93, range=0..1),
    LabelRadius=Slider(1.1, range=0..2),
    LabelFontFace="Arial Rounded MT Bold",
    RelativeLabelHeight=Slider(0.04, range=0..1),
    LabelColor=ColourSwatch(SwatchColor=RGB(0, 0, 0)))
conduit_colorpalette = ConduitColorPalette(
    PaletteName="a1",
    Seed=Slider(52, range=0..100),
    HueRange=Domain(-0.05, 0.05),
    SaturationRange=Domain(-0.15, 0.15),
    LuminanceRange=Domain(-0.1, 0.1),
    BaseColors=merge_4)

text = Text(panel_5)

draw_pie_chart = DrawPieChart(
    BoundaryRectangle=curve_2,
    Labels=text,
    DataValues=entwine,
    PieStyle=conduit_pie_style,
    ColorPalette=conduit_colorpalette)

merge_5 = Merge(Data1=draw_pie_chart, Data3=cluster)

point = Point(Point(11.73649984, -303.2999099, 0))
unit_x = UnitX(Factor=Slider(-28.78, range=-100..10))
move_6 = Move(Geometry=point, Motion=unit_x)  # -> Geometry, Transform
get_viewport_boundary_dimensions = GetViewportBoundaryDimensions(Refresh=Button(), Origin=move_6.Geometry, Scale=Slider(0.208, range=0..1))
heads_up_display_hud = HeadsUpDisplayHUD(ShowHUD=Toggle(True), DrawingObjects=merge_5, DrawingBoundary=get_viewport_boundary_dimensions)

# ==== cluster Cluster
number_slider = Slider(1.17, range=0..10)
settings_custom = SettingsCustom(
    StitchSeams=True,
    SimplePlanes=False,
    Refine=True,
    MinCount=16,
    MaxCount=400,
    AspectRatio=20,
    MaxDistance=0,
    MaxAngle=20,
    MinEdge=number_slider,
    MaxEdge=number_slider)
brep = ClusterInput()
# TOPOGRAPHY MESH ANALYSIS
# BREP MESH
mesh_brep = MeshBrep(Brep=brep, Settings=settings_custom)
mcomp = Decompose(Mesh=mesh_brep)  # -> Vertices, Faces, Colours, Normals
vcomp = Decompose(Vector=mcomp.Normals)  # -> XComponent, YComponent, ZComponent
expression = Expression(z=vcomp.ZComponent, Expression="Deg(0.0 - (Asin(Abs(z)) - 0.5*π))")
gradient = Gradient(
    LowerLimit=0,
    UpperLimit=90,
    Parameter=expression,
    stops=[0: RGB(101, 153, 5), 0: RGB(0, 128, 0), 0.441: RGB(240, 172, 36), 0.864: RGB(255, 0, 0)])
factor = ClusterInput()
mesh = Mesh(Vertices=mcomp.Vertices, Faces=mcomp.Faces, Colours=gradient)
xy_plane = XYPlane(Origin=Point(0, 0, 0))
pi = Pi(Factor=factor)
rotate_plane = RotatePlane(Plane=xy_plane, Angle=pi)
bounding_box = BoundingBox(Content=mesh, Plane=rotate_plane)  # -> Box, Box_2
deconstruct_brep = DeconstructBrep(Brep=bounding_box.Box)  # -> Faces, Edges, Vertices
B = ClusterInput()
B_2 = ClusterInput()
list_item = ListItem(List=deconstruct_brep.Faces, Index="4", Wrap=True)
dimensions = Dimensions(Surface=list_item)  # -> UDimension, VDimension
division = Division(A=dimensions.VDimension, B=B)
division_2 = Division(A=dimensions.UDimension, B=B_2)
integer = Integer(division_2)
integer_2 = Integer(division)
quad_panels = QuadPanels(Surface=list_item, UDivisions=integer, VDivisions=integer_2)
area = Area(Geometry=quad_panels)  # -> Area, Centroid

unit_z = UnitZ(Factor=1)
project_point = ProjectPoint(Point=area.Centroid, Direction=unit_z, Geometry=mesh)  # -> Point, Index

null_item = NullItem(Item=project_point.Point)  # -> NullFlags, InvalidFlags, Description
dispatch = Dispatch(List=project_point.Point, DispatchPattern=null_item.NullFlags)  # -> ListA, ListB
mesh_closest_point = MeshClosestPoint(Point=dispatch.ListB, Mesh=mesh)  # -> Point, Index, Parameter
mesh_eval = MeshEval(Mesh=mesh, Parameter=mesh_closest_point.Parameter)  # -> Point, Normal, Colour
vcomp_2 = Decompose(Vector=mesh_eval.Normal)  # -> XComponent, YComponent, ZComponent
expression_2 = Expression(z=vcomp_2.ZComponent, Expression="Deg(0.0 - (Asin(Abs(z)) - 0.5*π))")
second_number = ClusterInput()
distance = ClusterInput()
smaller_than = SmallerThan(FirstNumber=expression_2, SecondNumber=second_number)  # -> SmallerThan, OrEqualTo
dispatch_2 = Dispatch(List=mesh_eval.Point, DispatchPattern=smaller_than.SmallerThan)  # -> ListA, ListB
point_groups = PointGroups(Points=dispatch_2.ListA, Distance=distance)  # -> flatten(Groups), Indices
mesh_2 = ClusterOutput(mesh)
groups = ClusterOutput(point_groups.Groups)

# ==== cluster Cluster_2
_0_0 = ClusterInput()
_0_1 = ClusterInput()
_0_2 = ClusterInput()
_0_3 = ClusterInput()
boundary_rectangle = ClusterInput()

entwine = Entwine(Branch00=_0_0, Branch01=_0_1, Branch02=_0_2, Branch03=_0_3, FlattenInputs=True)  # -> flatten(Result)
merge = Merge(
    Data1=ColourSwatch(SwatchColor=RGB(247, 4, 203)),
    Data2=ColourSwatch(SwatchColor=RGB(106, 255, 255)),
    Data3=ColourSwatch(SwatchColor=RGB(102, 102, 255)),
    Data4=ColourSwatch(SwatchColor=RGB(184, 255, 102)))
conduit_pie_style = ConduitPieStyle(
    StyleName="abdidhcnekfe",
    InnerRadius=Slider(0.58, range=0..1),
    OuterRadius=Slider(0.91, range=0..1),
    LabelRadius=Slider(1.1, range=0..2),
    LabelFontFace="BankGothic Md BT",
    RelativeLabelHeight=Slider(0.05, range=0..1),
    LabelColor=ColourSwatch(SwatchColor=RGB(243, 255, 255)))
conduit_colorpalette = ConduitColorPalette(
    PaletteName="a3",
    Seed=Slider(52, range=0..100),
    HueRange=Domain(-0.05, 0.05),
    SaturationRange=Domain(-0.15, 0.15),
    LuminanceRange=Domain(-0.1, 0.1),
    BaseColors=merge)

text = Text(entwine)

draw_pie_chart = DrawPieChart(
    BoundaryRectangle=boundary_rectangle,
    Labels=text,
    DataValues=entwine,
    PieStyle=conduit_pie_style,
    ColorPalette=conduit_colorpalette)

hud_pie_chart_object = ClusterOutput(draw_pie_chart)

# ==== cluster Cluster_3
conduit_font = ConduitFont(
    StyleName="BIG BOX",
    Font="BankGothic Md BT",
    TextHeight=Slider(18, range=0..100),
    AdaptiveHeight=False,
    TextSpacing=Slider(4.135, range=0..10),
    Alignment=0,
    Bold=False,
    Italic=False,
    Color=RGB(0, 0, 0))
text = Text("BIG BOXES")
boundary = ClusterInput()
draw_text = DrawText(
    Boundary=boundary,
    Text=text,
    TextOrdering=1,
    TextDistribution=0,
    ColorOverride=ColourSwatch(SwatchColor=RGB(0, 0, 0)),
    OrientVertically=False,
    CustomFont=conduit_font)
drawing_object = ClusterOutput(draw_text)
