# Grasshopper definition BranchGOLF2.5.1.0Alpha_Latiz Hypaar.gh (Grasshopper 1.0.4)
# plug-ins: ProvingGround.Conduit, Pufferfish, Biomorpher, TT Toolbox

terrenos = Brep([<brep referenced from the Rhino model> x2])
list_item = ListItem(List=terrenos, Index=Slider(0, range=0..1), Wrap=True)

number_slider = Slider(3, range=0..10)
settings_custom = SettingsCustom(
    StitchSeams=True,
    SimplePlanes=False,
    Refine=True,
    MinCount=16,
    MaxCount=400,
    AspectRatio=20,
    MaxDistance=0,
    MaxAngle=20,
    MinEdge=number_slider,
    MaxEdge=number_slider)
mesh_brep = MeshBrep(Brep=list_item, Settings=settings_custom)
mesh_edges = MeshEdges(Mesh=mesh_brep)  # -> NakedEdges, InteriorEdges, NonManifoldEdges
curve = Curve(mesh_edges.NakedEdges)
join_curves = JoinCurves(Curves=curve, Preserve=False)
join_curves_2 = JoinCurves(Curves=join_curves, Preserve=False)

# ----
# TOPOGRAPHY MESH PANEL
limite_layout = Slider(1.04, range=0..2)
reticula_grid = Slider(7, range=1..15)
angle_range = Slider(18, range=1..30)
lote = Slider(24, range=0..149)
distance_point_groups = Slider(13, range=1..55)
rotación_grid = Slider(0.21, range=0..0.5)
layout_cell_radius = Slider(34.858, range=15..50)
lados_poligono = Slider(20, range=0..60)

seed = Slider(132, range=132..135)
anchor_point = Slider(6, range=4..6)
radius = Slider(130, range=130..145)
wings_angle = Slider(14, range=10..18)
basement_widht = Slider(52, range=50..60)
wings_lenght = Slider(138, range=135..145)
rotation = Slider(223, range=210..240)
building_pad_level = Slider(-2, range=-7..10)

data = Data([seed, anchor_point, radius, wings_angle, basement_widht, wings_lenght, rotation, building_pad_level])
list_length = ListLength(List=data)

# ----
# TOPOGRAPHY
# MESH ANALYSIS
cluster = Cluster(
    brep=list_item,
    B_2=reticula_grid,
    factor=rotación_grid,
    B=reticula_grid,
    second_number=angle_range,
    distance=distance_point_groups)  # -> mesh_2, groups
mesh = Mesh(cluster.mesh_2)
cloud_display = CloudDisplay(Points=cluster.groups, Colours=ColourSwatch(SwatchColor=RGB(255, 255, 255)), Size=1, SpriteType=0)

larger_than = LargerThan(FirstNumber=wings_lenght, SecondNumber=basement_widht)  # -> LargerThan, OrEqualTo
cluster_2 = Cluster_2(
    radius_2=radius,
    factor=radius,
    radius=radius,
    degrees=wings_angle,
    value=wings_angle,
    y_component_2=wings_lenght,
    length_3=wings_lenght,
    length=basement_widht,
    y_component=wings_lenght,
    length_2=wings_lenght)
ghpython_script = GhPythonScript(x=larger_than.LargerThan, y=wings_lenght, z=basement_widht, u=larger_than.OrEqualTo)  # -> out, a
# ---------- ghpython_script: Python ----------
"""Provides a scripting component.
    Inputs:
        x:
        y:
    Output:
        a: The a output variable"""

__author__ = "Sergio"
__version__ = "2019.03.28"

if x == True:
    a = y/z
elif u == False:
    a = z/y
elif u == True:
    a = 1
print(a)
# ---------- end ghpython_script ----------

number_slider_2 = Slider(0.6, range=0..10)
unit_z = UnitZ(Factor=number_slider_2)
number_slider_3 = Slider(9, range=0..10)
boolean_toggle = BooleanToggle(True)
fly = Ladybug_fly(inputSliders=[Slider(75, range=0..100), Slider(50, range=0..100), Slider(125, range=0..1000)])  # -> Vviiiiiiiiiizzz; plug-in component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
panel = Panel("""FLOOR PLAN AREA (M2)
CONSTRUCTION AREA (M2)
FILL VOLUME (M3)
CUT VOLUME (M3)""")
curve_2 = Curve(<curve referenced from the Rhino model>)
curve_3 = Curve(<curve referenced from the Rhino model>)
curve_4 = Curve(<curve referenced from the Rhino model>)
run_data_recorder = BooleanToggle(False)
ghpython_script_2 = GhPythonScript(x=data, y=run_data_recorder)  # -> out, a; inputs x: list
# ---------- ghpython_script_2: Python ----------
"""Provides a scripting component.
    Inputs:
        x:
        y:
    Output:
        a: The a output variable"""

__author__ = "Sergio"
__version__ = "2019.03.28"

for nums in x:
    if y:
        print(nums)
    else:
        pass
# ---------- end ghpython_script_2 ----------
integer = Integer(ghpython_script_2.out)
data_recorder = DataRecorder(integer, DataLimit=-10, RecordData=True)
partition_list = PartitionList(List=data_recorder, Size=list_length)
panel_2 = Panel(partition_list)

colour_picker = ColourPicker(PickedColour=RGB(40, 163, 94))
colour_swatch = ColourSwatch(SwatchColor=RGB(93, 132, 52))
colour = Colour(colour_picker)
lotes_todos = Brep([<brep referenced from the Rhino model> x56])

# ----
# TRIANGULATE NEW
# BOUNDARY POLYGON
voronoi = Voronoi(Points=cluster.groups, Radius=layout_cell_radius, BruteForceOverride=False)
number_slider_4 = Slider(10, range=0..10)
boundary_surfaces = BoundarySurfaces(Edges=voronoi)
settings_custom_2 = SettingsCustom(
    StitchSeams=True,
    SimplePlanes=False,
    Refine=True,
    MinCount=10,
    MaxCount=400,
    AspectRatio=20,
    MaxDistance=0,
    MaxAngle=20,
    MinEdge=number_slider_4,
    MaxEdge=number_slider_4)
brep_join = BrepJoin(Breps=boundary_surfaces)  # -> Breps, Closed
mesh_brep_2 = MeshBrep(Brep=brep_join.Breps, Settings=settings_custom_2)
mesh_edges_2 = MeshEdges(Mesh=mesh_brep_2)  # -> flatten(NakedEdges), InteriorEdges, NonManifoldEdges
join_curves_3 = JoinCurves(Curves=mesh_edges_2.NakedEdges, Preserve=False)
length = Length(Curve=join_curves_3)
sort_list = SortList(Keys=flatten(length), ValuesValuesA=flatten(join_curves_3))  # -> Keys, ValuesValuesA
reverse_list = ReverseList(List=sort_list.ValuesValuesA)
list_item_2 = ListItem(List=reverse_list, Index=0, Wrap=True)
boundary_surfaces_2 = BoundarySurfaces(Edges=list_item_2)
area = Area(Geometry=boundary_surfaces_2)  # -> Area, Centroid
scale = Scale(Geometry=list_item_2, Center=area.Centroid, Factor=limite_layout)  # -> Geometry, Transform
divide_curve = DivideCurve(Curve=scale.Geometry, Count=lados_poligono, Kinks=False)  # -> Points, Tangents, Parameters
number_slider_5 = Slider(22, range=0..100)
polyline = PolyLine(Vertices=divide_curve.Points, Closed=True)
boundary_surfaces_3 = BoundarySurfaces(Edges=polyline)
divide_surface = DivideSurface(Surface=boundary_surfaces_3, UCount=number_slider_5, VCount=number_slider_5)  # -> flatten(Points), Normals, Parameters
clean_tree = CleanTree(RemoveNulls=True, RemoveInvalid=True, RemoveEmpty=False, Tree=divide_surface.Points)

divide_surface_2 = DivideSurface(Surface=boundary_surfaces_3, UCount=number_slider_5, VCount=number_slider_5)  # -> Points, Normals, Parameters
clean_tree_2 = CleanTree(RemoveNulls=True, RemoveInvalid=True, RemoveEmpty=False, Tree=divide_surface_2.Points)
flip_matrix = FlipMatrix(Data=clean_tree_2)

fit_line = FitLine(Points=flip_matrix)  # -> flatten(Line)
list_item_3 = ListItem(List=fit_line, Index=seed, Wrap=True)
list_item_4 = ListItem(List=fit_line, Index=0, Wrap=True)
divide_curve_2 = DivideCurve(Curve=list_item_3, Count=10, Kinks=False)  # -> Points, Tangents, Parameters
divide_curve_3 = DivideCurve(Curve=list_item_4, Count=10, Kinks=False)  # -> Points, Tangents, Parameters
list_item_5 = ListItem(List=divide_curve_3.Points, Index=0, Wrap=True)
list_item_6 = ListItem(List=divide_curve_2.Points, Index=anchor_point, Wrap=True)

join_curves_4 = JoinCurves(Curves=cluster_2, Preserve=False)
area_2 = Area(Geometry=join_curves_4)  # -> Area, Centroid
radians = Radians(Degrees=rotation)
move_2pt = Move2Pt(Geometry=join_curves_4, PointA=area_2.Centroid, PointB=list_item_6)  # -> Moved, Vector, Transform
area_3 = Area(Geometry=move_2pt.Moved)  # -> Area, Centroid
xy_plane = XYPlane(Origin=area_3.Centroid)
rotate = Rotate(Geometry=move_2pt.Moved, Angle=radians, Plane=xy_plane)  # -> Geometry, Transform

boundary_surfaces_4 = BoundarySurfaces(Edges=rotate.Geometry)
unit_z_2 = UnitZ(Factor=building_pad_level)
move = Move(Geometry=boundary_surfaces_4, Motion=unit_z_2)  # -> Geometry, Transform
unit_z_3 = UnitZ(Factor=Slider(1, range=0..1))
extrude = Extrude(Base=move.Geometry, Direction=unit_z_3)
create_material = CreateMaterial(
    Diffuse=ColourSwatch(SwatchColor=RGB(4, 5, 3)),
    Specular=RGB(255, 255, 255),
    Emission=ColourSwatch(SwatchColor=RGB(11, 140, 84)),
    Transparency=Slider(0, range=0..1),
    Shine=Slider(0, range=0..1))
custom_preview = CustomPreview(Geometry=extrude, Material=create_material)

colour_picker_2 = ColourPicker(PickedColour=RGB(87, 166, 94))
unit_z_4 = UnitZ(Factor=Slider(31, range=0..100))
brep = Brep(list_item)
extrude_2 = Extrude(Base=move.Geometry, Direction=unit_z_4)
number_slider_6 = Slider(0.369, range=0..1)
mesh_2 = Mesh(brep)
mesh_3 = Mesh(extrude_2)
colour_swatch_2 = ColourSwatch(SwatchColor=RGB(93, 132, 52))
colour_2 = Colour(colour_picker_2)
mesh_intersection = MeshIntersection(MeshesA=mesh_2, MeshesB=mesh_3)
mesh_difference = MeshDifference(MeshesA=mesh_2, MeshesB=mesh_3)
volume = Volume(Geometry=mesh_intersection)  # -> Volume, Centroid
create_material_2 = CreateMaterial(
    Diffuse=colour_2,
    Specular=colour_swatch_2,
    Emission=colour_swatch_2,
    Transparency=number_slider_6,
    Shine=Slider(0.221, range=0..1))
custom_preview_2 = CustomPreview(Geometry=mesh_difference, Material=create_material_2)

create_material_3 = CreateMaterial(
    Diffuse=colour,
    Specular=colour_swatch,
    Emission=colour_swatch,
    Transparency=number_slider_6,
    Shine=Slider(0, range=0..1))
custom_preview_3 = CustomPreview(Geometry=lotes_todos, Material=create_material_3)

number = Number(volume.Volume)

brep_wireframe = BrepWireframe(Brep=move.Geometry, Density=-1)

list_item_7 = ListItem(List=brep_wireframe, Index=1, Wrap=True)  # -> Item, Item1, Item2
curve_5 = Curve(list_item_7.Item2)

flip_curve = FlipCurve(Curve=curve_5, Guide=list_item_7.Item)  # -> Curve, Flag
point_on_curve = PointOnCurve(flip_curve.Curve, parameter=0.75)
point_on_curve_2 = PointOnCurve(list_item_7.Item, parameter=0.75)
line = Line(StartPoint=point_on_curve_2, EndPoint=point_on_curve)
point_on_curve_3 = PointOnCurve(line, parameter=0.5)
point_on_curve_4 = PointOnCurve(list_item_7.Item1, parameter=0.5)
line_2 = Line(StartPoint=point_on_curve_3, EndPoint=point_on_curve_4)
curve_6 = Curve(list_item_7.Item1)
end_points = EndPoints(Curve=curve_6)  # -> Start, End
line_3 = Line(StartPoint=point_on_curve_2, EndPoint=end_points.Start)
line_4 = Line(StartPoint=point_on_curve, EndPoint=end_points.End)

point_on_curve_5 = PointOnCurve(line_2, parameter=0.333)

arc_3pt = Arc3Pt(PointA=point_on_curve_2, PointB=point_on_curve_5, PointC=point_on_curve)  # -> Arc, Plane, Radius
merge = Merge(Data1=arc_3pt.Arc, Data2=line_4, Data3=line_3, Data4=curve_6)  # -> flatten(Result)

unit_z_5 = UnitZ(Factor=Slider(-15, range=-15..0))
extrude_3 = Extrude(Base=move.Geometry, Direction=unit_z_5)
mesh_4 = Mesh(extrude_3)
mesh_difference_2 = MeshDifference(MeshesA=mesh_4, MeshesB=mesh_2)
close_mesh = CloseMesh(Mesh=mesh_difference_2, Quadrangulate=True)  # -> Closed, ResultBoolean
boundary_surfaces_5 = BoundarySurfaces(Edges=merge)
colour_swatch_3 = ColourSwatch(SwatchColor=RGB(86, 255, 255))
create_material_4 = CreateMaterial(
    Diffuse=colour_swatch_3,
    Specular=RGB(255, 255, 255),
    Emission=colour_swatch_3,
    Transparency=Slider(0.283, range=0..1),
    Shine=Slider(0, range=0..1))
custom_preview_4 = CustomPreview(Geometry=close_mesh.Closed, Material=create_material_4)

move_2 = Move(Geometry=boundary_surfaces_5, Motion=unit_z)  # -> Geometry, Transform

# ----
# TOP GOLF ENVELOPE
series = Series(Start=number_slider_2, Step=3.5, Count=4)
unit_z_6 = UnitZ(Factor=series)
move_3 = Move(Geometry=move_2.Geometry, Motion=unit_z_6)  # -> Geometry, Transform
brep_wireframe_2 = BrepWireframe(Brep=move_3.Geometry, Density=-1)
join_curves_5 = JoinCurves(Curves=brep_wireframe_2, Preserve=False)  # -> flatten(Curves)
unit_z_7 = UnitZ(Factor=Slider(0.5, range=0..1))
extrude_4 = Extrude(Base=move_3.Geometry, Direction=unit_z_7)
loft = Loft(Curves=join_curves_5, Options={Adjust=False, Closed=False, LoftEnds=0, LoftSimp=0, LoftType=0, Rebuild=10, Refit=0.01})
create_material_5 = CreateMaterial(
    Diffuse=ColourSwatch(SwatchColor=RGB(200, 0, 255)),
    Specular=RGB(255, 255, 255),
    Emission=ColourSwatch(SwatchColor=RGB(255, 0, 255)),
    Transparency=Slider(0.43, range=0..1),
    Shine=0)
create_material_6 = CreateMaterial(
    Diffuse=ColourSwatch(SwatchColor=RGB(255, 255, 255)),
    Specular=RGB(255, 255, 255),
    Emission=ColourSwatch(SwatchColor=RGB(143, 143, 143)),
    Transparency=Slider(0.683, range=0..1),
    Shine=0)
custom_preview_5 = CustomPreview(Geometry=extrude_4, Material=create_material_5)
custom_preview_6 = CustomPreview(Geometry=loft, Material=create_material_6)

volume_2 = Volume(Geometry=close_mesh.Closed)  # -> Volume, Centroid
round = Round(Number=volume_2.Volume)  # -> Nearest, Floor, Ceiling
fill_volume_m3 = Panel(round.Nearest)

# ----
# OUTPUTS
area_4 = Area(Geometry=move.Geometry)  # -> Area, Centroid
area_5 = Area(Geometry=move_3.Geometry)  # -> Area, Centroid
fill_volume_cost_foreign = Panel("63.77")
fill_volume_cost_local = Panel("115.200")
cut_volume_cost = Panel("63.770")
number_2 = Number(cut_volume_cost)
number_3 = Number(fill_volume_cost_local)
number_4 = Number(fill_volume_cost_foreign)
multiplication = Multiplication(A=number_2, B=number)
multiplication_2 = Multiplication(A=number_3)
multiplication_3 = Multiplication(A=number_4)
round_2 = Round(Number=area_4.Area)  # -> Nearest, Floor, Ceiling
round_3 = Round(Number=number)  # -> Nearest, Floor, Ceiling
cut_volume_m3 = Panel(round_3.Nearest)
floor_plan_area_m2 = Panel(round_2.Nearest)

addition = Addition(A=area_4.Area, B=area_5.Area)

ghpython_script_3 = GhPythonScript(SUM=addition)  # -> out, a; inputs SUM: list
# ---------- ghpython_script_3: Python ----------
"""Provides a scripting component.
    Inputs:
        x:
        y:
    Output:
        a: The a output variable"""

__author__ = "Sergio"
__version__ = "2019.03.28"

import math as math
ab=[]
for num in SUM:
    ab.append(num)
    lst = (math.fsum(ab))
    a=lst
# ---------- end ghpython_script_3 ----------
round_4 = Round(Number=ghpython_script_3.a)  # -> Nearest, Floor, Ceiling
construction_area_m2 = Panel(round_4.Nearest)
merge_2 = Merge(Data1=floor_plan_area_m2, Data2=construction_area_m2, Data3=cut_volume_m3, Data4=fill_volume_m3)  # -> flatten(Result)
data_2 = Data(merge_2)
ghpython_script_4 = GhPythonScript(x=data_2, y=run_data_recorder)  # -> out, a; inputs x: list; same code as ghpython_script_2
list_length_2 = ListLength(List=merge_2)
integer_2 = Integer(ghpython_script_4.out)
data_recorder_2 = DataRecorder(flatten(integer_2), DataLimit=-10, RecordData=True)
partition_list_2 = PartitionList(List=data_recorder_2, Size=list_length_2)

round_5 = Round(Number=multiplication)  # -> Nearest, Floor, Ceiling
round_6 = Round(Number=multiplication_3)  # -> Nearest, Floor, Ceiling
round_7 = Round(Number=multiplication_2)  # -> Nearest, Floor, Ceiling
fill_volume_cost_local_2 = Panel(round_7.Nearest)
fill_volume_cost_foreign_2 = Panel(round_6.Nearest)
cut_volume_cost_2 = Panel(round_5.Nearest)

entwine = Entwine(
    Branch00=floor_plan_area_m2,
    Branch01=construction_area_m2,
    Branch02=fill_volume_m3,
    Branch03=cut_volume_m3,
    FlattenInputs=True)  # -> flatten(Result)
text = Text(entwine)

entwine_2 = Entwine(
    Branch00=floor_plan_area_m2,
    Branch01=construction_area_m2,
    Branch02=fill_volume_m3,
    Branch03=cut_volume_m3,
    FlattenInputs=True)  # -> flatten(Result)
# CONDUIT CHARTS
panel_3 = Panel("abdidhcnekfe")
merge_3 = Merge(
    Data1=ColourSwatch(SwatchColor=RGB(247, 4, 203)),
    Data2=ColourSwatch(SwatchColor=RGB(106, 255, 255)),
    Data3=ColourSwatch(SwatchColor=RGB(102, 102, 255)),
    Data4=ColourSwatch(SwatchColor=RGB(184, 255, 102)))
conduit_pie_style = ConduitPieStyle(
    StyleName=panel_3,
    InnerRadius=Slider(0.58, range=0..1),
    OuterRadius=Slider(0.91, range=0..1),
    LabelRadius=Slider(1, range=0..2),
    LabelFontFace="Arial Rounded MT Bold",
    RelativeLabelHeight=Slider(0.03, range=0..1),
    LabelColor=ColourSwatch(SwatchColor=RGB(0, 0, 0)))
conduit_colorpalette = ConduitColorPalette(
    PaletteName="a3",
    Seed=Slider(52, range=0..100),
    HueRange=Domain(-0.05, 0.05),
    SaturationRange=Domain(-0.15, 0.15),
    LuminanceRange=Domain(-0.1, 0.1),
    BaseColors=merge_3)
draw_pie_chart = DrawPieChart(
    BoundaryRectangle=curve_4,
    Labels=panel,
    DataValues=entwine_2,
    PieStyle=conduit_pie_style,
    ColorPalette=conduit_colorpalette)

conduit_font = ConduitFont(
    StyleName="WW2W2W",
    Font="Arial Rounded MT Bold",
    TextHeight=Slider(10, range=0..100),
    AdaptiveHeight=False,
    TextSpacing=1.15,
    Alignment=0,
    Bold=False,
    Italic=False,
    Color=RGB(0, 0, 0))
conduit_font_2 = ConduitFont(
    StyleName="WW2W2W",
    Font="Arial Rounded MT Bold",
    TextHeight=Slider(6, range=0..100),
    AdaptiveHeight=False,
    TextSpacing=1.15,
    Alignment=0,
    Bold=False,
    Italic=False,
    Color=RGB(0, 0, 0))
draw_text = DrawText(Boundary=curve_2, Text=text, TextOrdering=1, TextDistribution=0, OrientVertically=False, CustomFont=conduit_font)
draw_text_2 = DrawText(Boundary=curve_3, Text=panel, TextOrdering=1, TextDistribution=0, OrientVertically=False, CustomFont=conduit_font_2)

point = Point(Point(11.73649984, -303.2999099, 0))
unit_x = UnitX(Factor=Slider(-30.544, range=-100..10))
move_4 = Move(Geometry=point, Motion=unit_x)  # -> Geometry, Transform
get_viewport_boundary_dimensions = GetViewportBoundaryDimensions(Refresh=Button(), Origin=move_4.Geometry, Scale=Slider(0.163, range=0..1))
heads_up_display_hud = HeadsUpDisplayHUD(
    ShowHUD=Toggle(True),
    DrawingObjects=[draw_pie_chart, draw_text_2, draw_text],
    DrawingBoundary=get_viewport_boundary_dimensions)

# ----
# EVOLUTIONARY
# SOLVERS
floor_plan_area = Integer(floor_plan_area_m2)
ratio = Integer(ghpython_script.a)
fill_volume = Number(round.Nearest)
cut_volume_cost_3 = Number(round_5.Nearest)
ratio_2 = Number(ratio)
floor_plan_area_2 = Number(floor_plan_area)
mesh_5 = Mesh(flatten([loft, extrude_4, extrude]))
panel_4 = Panel("""SEED
ANCHOR POINT
RADIUS
WINGS ANGLE
BASEMENT WIDHT
WINGS LENGHT
ROTATION
BUILDING PAD LEVEL""")
biomorpher = Biomorpher(
    Genome=[seed, anchor_point, radius, wings_angle, basement_widht, wings_lenght, rotation, building_pad_level],
    MeshEs=mesh_5,
    Performance=[cut_volume_cost_3, floor_plan_area_2, ratio_2, fill_volume],
    InitialPop=Slider(50, range=0..100))  # -> GenoGuids, Population, Historic, Clusters
export_to_excel_genomes_genetics = BooleanToggle(False)
text_2 = Text(panel_4)
write_to_excel = WriteToExcel(
    Run=export_to_excel_genomes_genetics,
    ExcelWorksheet="1",
    ColumnNames=text_2,
    RowNames="GENOME",
    WriteOptions="None",
    ColumnnsOrRows=Toggle(False),
    DataToWriteIntoColumns=panel_2)

panel_5 = Panel(partition_list_2)

# ==== cluster Cluster
number_slider = Slider(1.17, range=0..10)
settings_custom = SettingsCustom(
    StitchSeams=True,
    SimplePlanes=False,
    Refine=True,
    MinCount=16,
    MaxCount=400,
    AspectRatio=20,
    MaxDistance=0,
    MaxAngle=20,
    MinEdge=number_slider,
    MaxEdge=number_slider)
brep = ClusterInput()
# TOPOGRAPHY MESH ANALYSIS
# BREP MESH
mesh_brep = MeshBrep(Brep=brep, Settings=settings_custom)
mcomp = Decompose(Mesh=mesh_brep)  # -> Vertices, Faces, Colours, Normals
vcomp = Decompose(Vector=mcomp.Normals)  # -> XComponent, YComponent, ZComponent
expression = Expression(z=vcomp.ZComponent, Expression="Deg(0.0 - (Asin(Abs(z)) - 0.5*π))")
gradient = Gradient(
    LowerLimit=0,
    UpperLimit=90,
    Parameter=expression,
    stops=[0: RGB(101, 153, 5), 0: RGB(0, 128, 0), 0.441: RGB(240, 172, 36), 0.864: RGB(255, 0, 0)])
factor = ClusterInput()
mesh = Mesh(Vertices=mcomp.Vertices, Faces=mcomp.Faces, Colours=gradient)
xy_plane = XYPlane(Origin=Point(0, 0, 0))
pi = Pi(Factor=factor)
rotate_plane = RotatePlane(Plane=xy_plane, Angle=pi)
bounding_box = BoundingBox(Content=mesh, Plane=rotate_plane)  # -> Box, Box_2
deconstruct_brep = DeconstructBrep(Brep=bounding_box.Box)  # -> Faces, Edges, Vertices
B = ClusterInput()
B_2 = ClusterInput()
list_item = ListItem(List=deconstruct_brep.Faces, Index="4", Wrap=True)
dimensions = Dimensions(Surface=list_item)  # -> UDimension, VDimension
division = Division(A=dimensions.VDimension, B=B)
division_2 = Division(A=dimensions.UDimension, B=B_2)
integer = Integer(division_2)
integer_2 = Integer(division)
quad_panels = QuadPanels(Surface=list_item, UDivisions=integer, VDivisions=integer_2)
area = Area(Geometry=quad_panels)  # -> Area, Centroid

unit_z = UnitZ(Factor=1)
project_point = ProjectPoint(Point=area.Centroid, Direction=unit_z, Geometry=mesh)  # -> Point, Index

null_item = NullItem(Item=project_point.Point)  # -> NullFlags, InvalidFlags, Description
dispatch = Dispatch(List=project_point.Point, DispatchPattern=null_item.NullFlags)  # -> ListA, ListB
mesh_closest_point = MeshClosestPoint(Point=dispatch.ListB, Mesh=mesh)  # -> Point, Index, Parameter
mesh_eval = MeshEval(Mesh=mesh, Parameter=mesh_closest_point.Parameter)  # -> Point, Normal, Colour
vcomp_2 = Decompose(Vector=mesh_eval.Normal)  # -> XComponent, YComponent, ZComponent
expression_2 = Expression(z=vcomp_2.ZComponent, Expression="Deg(0.0 - (Asin(Abs(z)) - 0.5*π))")
second_number = ClusterInput()
distance = ClusterInput()
smaller_than = SmallerThan(FirstNumber=expression_2, SecondNumber=second_number)  # -> SmallerThan, OrEqualTo
dispatch_2 = Dispatch(List=mesh_eval.Point, DispatchPattern=smaller_than.SmallerThan)  # -> ListA, ListB
point_groups = PointGroups(Points=dispatch_2.ListA, Distance=distance)  # -> flatten(Groups), Indices
mesh_2 = ClusterOutput(mesh)
groups = ClusterOutput(point_groups.Groups)

# ==== cluster Cluster_2
unit_x = UnitX(Factor=1)
xy_plane = XYPlane(Origin=Point(0, 0, 0))
length = ClusterInput()
line_sdl = LineSDL(Start=xy_plane, Direction=unit_x, Length=length)
value = ClusterInput()
negative = Negative(Value=value)
degrees = ClusterInput()
curve = Curve(line_sdl)
radians = Radians(Degrees=degrees)
radians_2 = Radians(Degrees=negative)
y_component = ClusterInput()
y_component_2 = ClusterInput()
end_points = EndPoints(Curve=curve)  # -> Start, End
vector_xyz = VectorXYZ(XComponent=0, YComponent=y_component, ZComponent=0)  # -> Vector, Length
vector_xyz_2 = VectorXYZ(XComponent=0, YComponent=y_component_2, ZComponent=0)  # -> Vector, Length
length_2 = ClusterInput()
length_3 = ClusterInput()
line_sdl_2 = LineSDL(Start=end_points.End, Direction=vector_xyz.Vector, Length=length_2)
end_points_2 = EndPoints(Curve=line_sdl_2)  # -> Start, End
xy_plane_2 = XYPlane(Origin=end_points_2.Start)
rotate = Rotate(Geometry=line_sdl_2, Angle=radians_2, Plane=xy_plane_2)  # -> Geometry, Transform
line_sdl_3 = LineSDL(Start=end_points.Start, Direction=vector_xyz_2.Vector, Length=length_3)
end_points_3 = EndPoints(Curve=line_sdl_3)  # -> Start, End
xy_plane_3 = XYPlane(Origin=end_points_3.Start)
rotate_2 = Rotate(Geometry=line_sdl_3, Angle=radians, Plane=xy_plane_3)  # -> Geometry, Transform
end_points_4 = EndPoints(Curve=rotate_2.Geometry)  # -> Start, End
end_points_5 = EndPoints(Curve=rotate.Geometry)  # -> Start, End
unit_z = UnitZ(Factor=1)
radius = ClusterInput()
radius_2 = ClusterInput()
circle_cnr = CircleCNR(Center=end_points_5.End, Normal=unit_z, Radius=radius)
circle_cnr_2 = CircleCNR(Center=end_points_4.End, Normal=unit_z, Radius=radius_2)
curve_curve = CurveCurve(CurveA=circle_cnr_2, CurveB=circle_cnr)  # -> Points, ParamsA, ParamsB
factor = ClusterInput()
list_item = ListItem(List=curve_curve.Points, Index=0, Wrap=True)  # -> Item, Item1
unit_y = UnitY(Factor=factor)
move = Move(Geometry=list_item.Item1, Motion=unit_y)  # -> Geometry, Transform
arc_3pt = Arc3Pt(PointA=end_points_4.End, PointB=move.Geometry, PointC=end_points_5.End)  # -> Arc, Plane, Radius
merge = Merge(Data1=curve, Data2=rotate_2.Geometry, Data3=arc_3pt.Arc, Data4=rotate.Geometry)  # -> flatten(Result)
result = ClusterOutput(merge)
