# Grasshopper definition 190321 Latiz - Analisis Pendiente y grid GH FM.gh (Grasshopper 1.0.7)
# plug-ins: LunchBox

mesh = Mesh([<mesh referenced from the Rhino model> x2])
mcomp = Decompose(Mesh=graft(mesh))  # -> Vertices, Faces, Colours, Normals
vcomp = Decompose(Vector=mcomp.Normals)  # -> XComponent, YComponent, ZComponent
expression = Expression(z=vcomp.ZComponent, Expression="Deg(0.0 - (Asin(Abs(z)) - 0.5*π))")
panel = Panel(expression)
gradient = Gradient(
    LowerLimit=0,
    UpperLimit=90,
    Parameter=expression,
    stops=[0.145: RGB(0, 128, 0), 0.336: RGB(166, 255, 0), 0.563: RGB(240, 172, 36), 0.762: RGB(255, 0, 0)])

# ---- group: Orientacion Grid
pi = Pi(Factor=Slider(0.25, range=0..0.5))

# ----
mesh_2 = Mesh(Vertices=mcomp.Vertices, Faces=mcomp.Faces, Colours=gradient)
xy = XYPlane(Origin=Point(0, 0, 0))
prot = RotatePlane(Plane=xy, Angle=pi)
bbox = BoundingBox(Content=mesh_2, Plane=prot)  # -> Box, Box_2

# ---- group: Tamaño Gird
number_slider = Slider(9, range=1..15)

# ----
debrep = DeconstructBrep(Brep=bbox.Box)  # -> Faces, Edges, Vertices
item = ListItem(List=debrep.Faces, Index="4", Wrap=True)
dim = Dimensions(Surface=item)  # -> UDimension, VDimension
division = Division(A=dim.VDimension, B=number_slider)
division_2 = Division(A=dim.UDimension, B=number_slider)
int = Integer(division_2)
int_2 = Integer(division)
quads = QuadPanels(Surface=item, UDivisions=int, VDivisions=int_2)
area = Area(Geometry=quads)  # -> Area, Centroid

Z = UnitZ(Factor=1)
project = ProjectPoint(Point=area.Centroid, Direction=Z, Geometry=mesh_2)  # -> Point, Index

null = NullItem(Item=project.Point)  # -> NullFlags, InvalidFlags, Description
dispatch = Dispatch(List=project.Point, DispatchPattern=null.NullFlags)  # -> ListA, ListB
meshcp = MeshClosestPoint(Point=dispatch.ListB, Mesh=mesh_2)  # -> Point, Index, Parameter

# ---- group: Pendiente
angulo_maximo = Slider(17, range=0..90)

# ----
meval = MeshEval(Mesh=mesh_2, Parameter=meshcp.Parameter)  # -> Point, Normal, Colour
vcomp_2 = Decompose(Vector=meval.Normal)  # -> XComponent, YComponent, ZComponent
expression_2 = Expression(z=vcomp_2.ZComponent, Expression="Deg(0.0 - (Asin(Abs(z)) - 0.5*π))")
smaller = SmallerThan(FirstNumber=expression_2, SecondNumber=angulo_maximo)  # -> SmallerThan, OrEqualTo
dispatch_2 = Dispatch(List=meval.Point, DispatchPattern=smaller.SmallerThan)  # -> ListA, ListB
explode_tree = ExplodeTree(Data=dispatch_2.ListA)  # -> _000000, _010000
pgroups = PointGroups(Points=explode_tree._010000, Distance=Slider(19, range=1..55))  # -> Groups, Indices
bang = ExplodeTree(Data=pgroups.Groups)  # -> _0100000, _0100001, _0100002, _0100003, _0100004, _0100005, _0100006

item_2 = ListItem(List=quads, Index=0, Wrap=True)
area_2 = Area(Geometry=item_2)  # -> Area, Centroid
vec2pt = Vector2Pt(PointA=area_2.Centroid, PointB=bang._0100000, Unitize=False)  # -> Vector, Length
move = Move(Geometry=item_2, Motion=vec2pt.Vector)  # -> Geometry, Transform
Z_2 = UnitZ(Factor="4")
crv = Curve(move.Geometry)
extr = Extrude(Base=crv, Direction=Z_2)
cap = CapHoles(Brep=extr)
