# Grasshopper definition MESH INTERS4ECT.gh (Grasshopper 1.0.7)

number_slider = Slider(1, range=0..1)
brep = Brep(<brep referenced from the Rhino model>)
mesh = Mesh(<mesh referenced from the Rhino model>)
settings_custom = SettingsCustom(
    StitchSeams=True,
    SimplePlanes=False,
    Refine=True,
    MinCount=16,
    MaxCount=400,
    AspectRatio=20,
    MaxDistance=0,
    MaxAngle=20,
    MinEdge=number_slider,
    MaxEdge=number_slider)
mesh_brep = MeshBrep(Brep=brep, Settings=settings_custom)
mesh_2 = Mesh()
mesh_intersection = MeshIntersection()
