# Grasshopper definition TEXT TAGS.gh (Grasshopper 1.0.7)

brep = Brep([<brep referenced from the Rhino model> x59])
list_item = ListItem(List=brep, Index=Slider(0, range=0..100), Wrap=True)  # -> Item, Item1, Item2, Item3, Item4, Item5, Item6, Item7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
area = Area(Geometry=brep)  # -> Area, Centroid
# LOTE 12
# LOTE 24
# LOTE 24
# LOTE A
# LOTE 7
# LOTE 8
# LOTE 52
# LOTE 35
# LOTE 31-B
# LOTE 20
# LOTE 33
# LOTE 34
# LOTE 37
# 
# LOTE 21
# LOTE 32
# LOTE 16
# LOTE 28
# LOTE 27
# LOTE R
# LOTE R
# 
# LOTE 17
# LOTE 18
# LOTE 9
# LOTE 13
# LOTE 26
# LOTE 15
# LOTE 23
# LOTE 23
# LOTE 14
# LOTE 25
# LOTE B
# LOTE 3-5
# LOTE 6
# LOTE 10
# LOTE 2
# LOTE 11
text_tag_3d = TextTag3D(Location=area.Centroid, Size=1, Justification=7)
