# Grasshopper definition python coding.gh (Grasshopper 1.0.7)

series = Series(Start=Slider(2, range=0..10), Step=Slider(2, range=0..10), Count=Slider(25, range=0..100))
integer = Integer(series)
ghpython_script = GhPythonScript(ab=integer)  # -> out, a, b, f
# ---------- ghpython_script: Python ----------
"""Provides a scripting component.
    Inputs:
        x:
        y:
    Output:
        a: The a output variable"""

__author__ = "Sergio"
__version__ = "2019.03.28"
c=[]
import rhinoscriptsyntax as rs
b=[ab]
for num in b:
    a=num
    if a <= 4:
        c.append(True)
        f=c
# ---------- end ghpython_script ----------
panel = Panel(integer)
panel_2 = Panel(ghpython_script.f)
flatten_tree = FlattenTree(Tree=ghpython_script.f, Path="{0}")
panel_3 = Panel(flatten_tree)
ghpython_script_2 = GhPythonScript()  # -> out, edif_e, edif_a, edif_c
# ---------- ghpython_script_2: Python ----------
from EDIF_CLASS import *
a = Edificio
# ---------- end ghpython_script_2 ----------
box = Box()
panel_4 = Panel(ghpython_script_2.edif_e)
panel_5 = Panel(ghpython_script_2.edif_a)
panel_6 = Panel(ghpython_script_2.edif_c)
