# Grasshopper definition OpenNestExample.gh (Grasshopper 1.0.4)
# plug-ins: OpenNest

# ---- group: More complicated rotations longer solution
# 10 minutes wait
# if iterations are 400
number_slider = Slider(0.1, range=0..0.1)
curve = Curve([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])
control_points = ControlPoints(Curve=curve)  # -> Points, Weights, Knots
cull_duplicates = CullDuplicates(Points=control_points.Points, Tolerance=number_slider, CullMode=1)  # -> Points, Indices, Valence
list_item = ListItem(List=control_points.Points, Index=0, Wrap=True)  # -> flatten(Item)
curve_2 = Curve(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)
polyline = PolyLine(Vertices=cull_duplicates.Points, Closed=invert(False))  # -> flatten(Polyline)
repeat_data = RepeatData(Data=curve_2, Length=Slider(2, range=0..10))
opennest = OpenNest(
    Sheets=repeat_data,
    Polylines=polyline,
    Spacing=Slider(3, range=0..3),
    PlacementType=1,
    Tolerance=Slider(0.1, range=0..0.1),
    Rotations=Slider(360, range=0..1000),
    Iterations=Slider(1, range=0..400))  # -> Sheets, Polylines, ID, Transform

# ----
curve_3 = Curve(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)
number_slider_2 = Slider(0, range=0..100)
repeat_data_2 = RepeatData(Data=curve_3, Length=Slider(6, range=0..10))
curve_4 = Curve([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])

surface = Surface(<surface referenced from the Rhino model>)
brep = Brep(surface)
brep_wireframe = BrepWireframe(Brep=brep, Density=-1)
opennest_2 = OpenNest(
    Sheets=repeat_data_2,
    Polylines=curve_4,
    Spacing=1,
    PlacementType=1,
    Tolerance=0.01,
    Rotations=4,
    Iterations=Slider(1, range=0..4))  # -> Sheets, Polylines, ID, Transform
group = Group(Objects=Tree({0;0;0;0}: [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], {0;0;0;1}: [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], {0;0;0;2}: [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], {0;0;0;3}: [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], {0;0;0;4}: [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], {0;0;0;5}: [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]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))  # -> flatten(Group)
curve_5 = Curve([<curve referenced from the Rhino model> x4])
panel = Panel(group)
opennest_3 = OpenNest(
    Sheets=brep_wireframe,
    Polylines=curve_5,
    Spacing=Slider(2, range=0..3),
    PlacementType=1,
    Tolerance=Slider(0.1, range=0..0.1),
    Rotations=Slider(931, range=0..1000),
    Iterations=Slider(343, range=0..400))  # -> Sheets, Polylines, ID, Transform

# ---- group: If you want to nest additional goemetry
transform = Transform(Geometry=group, Transform=opennest_2.Transform)

# ----
panel_2 = Panel(opennest_3.Sheets)
area = Area(Geometry=surface)  # -> Area, Centroid
curve_6 = Curve(opennest_3.Polylines)
deconstruct = Deconstruct(Point=area.Centroid)  # -> XComponent, YComponent, ZComponent
unit_z = UnitZ(Factor=Slider(48, range=0..100))

# ---- group: If you want to nest additional goemetry
transform_2 = Transform(Geometry=curve_5, Transform=opennest_3.Transform)

# ----
vector_xyz = VectorXYZ(XComponent=deconstruct.XComponent, YComponent=deconstruct.YComponent, ZComponent=deconstruct.ZComponent)  # -> Vector, Length
project = Project(Curve=curve_6, Brep=brep, Direction=unit_z)
move = Move(Geometry=transform_2, Motion=vector_xyz.Vector)  # -> Geometry, Transform
vector_xyz_2 = VectorXYZ(XComponent=Slider(100, range=-250..100), YComponent=Slider(-266, range=-350..100), ZComponent=0)  # -> Vector, Length
number_slider_3 = Slider(10, range=0..10)
move_2 = Move(Geometry=transform_2, Motion=vector_xyz_2.Vector)  # -> Geometry, Transform
unit_z_2 = UnitZ(Factor=Slider(50, range=0..100))
extrude = Extrude(Base=move_2.Geometry, Direction=unit_z_2)
